# Grasshopper definition batch example.gh (Grasshopper 1.0.7)
# plug-ins: MetaHopper

x = Slider(40, range=0..100)
y = Slider(40, range=0..100)
bslider = BatchSlider(BatchVariable=x, Name="x", Steps=5)
bslider_2 = BatchSlider(BatchVariable=y, Name="y", Steps=5)
relpath = RelativePath(Path="batchExample")
batchdriver = BatchDriver(Run=Toggle(True), FilePath=relpath, Name="Run", ValuesA=bslider, ValuesB=bslider_2)  # -> Path, ValuesA, ValuesB
planesrf = PlaneSurface(Plane=PlaneXY(0, 0, 0), XSize=batchdriver.ValuesA, YSize=batchdriver.ValuesB)
format = Format(Format="{0} x {1}", Culture=127, Data0=batchdriver.ValuesA, Data1=batchdriver.ValuesB)
rec = DataRecorder(format, DataLimit=-10, RecordData=True)
banim = BatchAnimator(Path=batchdriver.Path)
panel = Panel(rec)
