# Grasshopper definition 全体形状+加工データ作成 ver4.gh (Grasshopper 1.0.7)
# plug-ins: Aggregations, Human, OpenNest, LunchBox, MetaHopper, Kangaroo2 Components, Fologram For Grasshopper Utilities, Bifocals, Pufferfish

number_slider = Slider(24, range=0..100)
number_slider_2 = Slider(31, range=0..100)
font_table = FontTable()
panel = Panel(font_table)
set_panel_properties = SetPanelProperties(Panel="Grasshopper.Kernel.Types.GH_ObjectWrapper", Font="Times New Roman", Stream=Toggle(True))
set_group_properties = SetGroupProperties(Style=Slider(1, range=0..2))
set_scribble_properties = SetScribbleProperties(ScribbleSize=Slider(30, range=0..100), ScribbleFont="Times New Roman")
control_wire_display = ControlWireDisplay(WireDisplay=Slider(1, range=0..2))
余し_mm_xsu = Slider(188.6, range=0..500)

長軸方向のオフセット = Slider(26, range=0..300)
短軸方向のオフセット = Slider(27, range=0..300)

短辺長さ = Slider(910, range=0..1000)
長辺長さ = Slider(1820, range=0..10000)

孔同士の横方向の距離 = Slider(10, range=0..100)

# ----
# 孔
折り曲げ位置 = Slider(0.3, range=0..0.5)
高さ = Slider(11, range=0..100)
セットバック = Slider(3, range=0..50)
幅 = Slider(18, range=0..100)

# ----
# 04-ナローウェーブ　パラメータ
# 幅＝Wa+2*Wb
# 高さ＝2*Ha+Hb
# 04-ナローウェーブ
# パラメータ（高さ、幅）
wa = Slider(50, range=0..100)
ha = Slider(10, range=0..30)
hc = Slider(12.7, range=0..30)
wb = Slider(25.4, range=0..30)
hb = Slider(12.7, range=0..20)
expression = Expression(Wa=wa, Wb=wb, Expression="Wb*2+Wa")
expression_2 = Expression(Ha=ha, Hb=hb, Expression="Ha*2+Hb")

短軸方向のオフセット_2 = Slider(23, range=0..300)
長軸方向のオフセット_2 = Slider(14, range=0..300)

# ----
# オフセット値(shopbotの加工範囲制限・パネル間)
オフセット値_パネルごとの幅 = Slider(25, range=0..30)
長軸方向のオフセット_3 = Slider(18, range=0..300)
短軸方向のオフセット_3 = Slider(18, range=0..300)

# ----
# 00,01,02-ウェーブ,ひし形,円弧 パラメータ
高さ_2 = Slider(20, range=0..30)
radius = Slider(12.7, range=0..20)
幅_2 = Slider(105, range=0..200)

# ----
# 3-直線
高さ_3 = Slider(6.35, range=0..30)
幅_3 = Slider(65, range=0..200)

# ----
# 相欠きオフセット値
加工用接合部オフセット = Slider(0.1, range=0..300)

# ----
# 基準板のサイズ
短辺長さ_2 = Slider(910, range=0..2000)
長辺長さ_2 = Slider(1820, range=0..10000)

bending加工部分_長さ_mm_xb = Slider(440, range=0..2000)
bending加工なし_長さ_mm_xss = Slider(10, range=0..500)

# ----
# 孔同士の距離
# ※最終的な数値と誤差有
孔同士の横方向の距離_w = Slider(16.25, range=0..30)
孔同士の縦方向の距離_h = Slider(9, range=-10..30)

# ----
# Sort ガイド
curve = Curve(<curve referenced from the Rhino model>)

# ----
# 注釈の作成
brep = Brep([<brep referenced from the Rhino model> x24])
bounding_box = BoundingBox(Content=brep, Plane=PlaneXY(0, 0, 0), UnionBox=False)  # -> Box, Box_2
object_attributes = ObjectAttributes(ObjectOrAttributes=brep)  # -> Name, LayerName, LayerFullPath, Color, MaterialName, LinetypeName, GroupIndices, PlotWeight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
number_slider_3 = Slider(4, range=0..10)
deconstruct_brep = DeconstructBrep(Brep=bounding_box.Box)  # -> Faces, Edges, Vertices
list_length = ListLength(List=object_attributes.LayerName)
number_slider_4 = Slider(8, range=0..100)
area = Area(Geometry=bounding_box.Box)  # -> Area, Centroid
series = Series(Start=0, Step=1, Count=list_length)
list_item = ListItem(List=deconstruct_brep.Vertices, Index=number_slider_3, Wrap=True)
deconstruct = Deconstruct(Point=area.Centroid)  # -> graft(XComponent), YComponent, ZComponent
deconstruct_2 = Deconstruct(Point=list_item)  # -> XComponent, YComponent, ZComponent
sort_along_curve = SortAlongCurve(Points=area.Centroid, Curve=curve)  # -> Points, Indices
construct_point = ConstructPoint(XCoordinate=deconstruct.XComponent, YCoordinate=deconstruct_2.YComponent, ZCoordinate=0)
list_item_2 = ListItem(List=bounding_box.Box, Index=sort_along_curve.Indices, Wrap=True)
multiplication = Multiplication(A=number_slider_4, B=2)
deconstruct_brep_2 = DeconstructBrep(Brep=list_item_2)  # -> Faces, Edges, Vertices
vector_xyz = VectorXYZ(XComponent=Slider(116, range=0..200), YComponent=multiplication, ZComponent=0)  # -> Vector, Length
list_item_3 = ListItem(List=deconstruct_brep_2.Vertices, Index=number_slider_3, Wrap=True)
move = Move(Geometry=list_item_3, Motion=vector_xyz.Vector)  # -> Geometry, Transform
text_tag_3d = TextTag3D(Location=construct_point, Text=graft(object_attributes.LayerName), Size=number_slider_4, Justification=2)
text_tag_3d_2 = TextTag3D(Location=move.Geometry, Text=graft(series), Size=Slider(29, range=0..100), Justification=7)

control_wire_display_2 = ControlWireDisplay(WireDisplay=1)

接合位置_mm_xds = Slider(120, range=0..500)
同部材接合角度 = Slider(73.125, range=0..90)

外側部材_α_mm = Slider(0, range=0..500)
異部材接合角度 = Slider(85, range=0..90)

アーチ方向_部材数 = Slider(9, range=0..50)
奥行方向部材数x2 = Slider(2, range=0..100)

切り欠き長さ_mm = Slider(30, range=0..300)
板厚_mm = Slider(12, range=0..100)

# ----
# Synchronize
get_connected_objects = GetConnectedObjects(Objects=板厚_mm)
get_selected_objects = GetSelectedObjects()  # -> ComponentObjects, ParamObjects, OtherObjects
object_info = ObjectInfo(Objects=get_connected_objects)  # -> Name, NickName, Type, Pivot, Bounds, Value, Enabled, Preview
set_object_value = SetObjectValue(ObjectToSet=get_selected_objects.ParamObjects, ValueToSet=object_info.Value)

板幅_mm = Slider(450, range=0..1000)

rectangle = Rectangle(Plane=PlaneXY(0, 0, 0), XSize=短辺長さ, YSize=長辺長さ, Radius=0)  # -> Rectangle, Length
deconstruct_brep_3 = DeconstructBrep(Brep=rectangle.Rectangle)  # -> Faces, Edges, Vertices
entwine = Entwine(Branch00=短軸方向のオフセット, Branch01=長軸方向のオフセット, FlattenInputs=True)
list_item_4 = ListItem(List=deconstruct_brep_3.Edges, Index=0, Wrap=True)  # -> Item, Item1, Item2, Item3
entwine_2 = Entwine(Branch00=[list_item_4.Item, list_item_4.Item2], Branch01=[list_item_4.Item1, list_item_4.Item3], FlattenInputs=True)
offset_on_srf = OffsetOnSrf(Curve=entwine_2, Distance=entwine, Surface=rectangle.Rectangle)
multiple_curves = MultipleCurves(Curves=flatten(offset_on_srf))  # -> Points, IndexA, IndexB, ParamA, ParamB
surface_from_points = SurfaceFromPoints(Points=multiple_curves.Points, UCount=Slider(2, range=0..10), Interpolate=False)
boundary_surfaces = BoundarySurfaces(Edges=surface_from_points)
divide_domain² = DivideDomain²(Domain=boundary_surfaces, UCount="4", VCount="2")
isotrim = Isotrim(Surface=boundary_surfaces, Domain=divide_domain²)
list_item_5 = ListItem(List=isotrim, Index=0, Wrap=True)

expression_3 = Expression(x=幅, Expression="x/2")
unit_x = UnitX(Factor=expression_3)
negative = Negative(Value=unit_x)
entwine_3 = Entwine(Branch00=unit_x, Branch01=negative, FlattenInputs=True)
construct_point_2 = ConstructPoint(XCoordinate=0, YCoordinate=0, ZCoordinate=0)
move_2 = Move(Geometry=construct_point_2, Motion=entwine_3)  # -> Geometry, Transform
explode_tree = ExplodeTree(Data=move_2.Geometry)  # -> Branch0, Branch1
line = Line(StartPoint=explode_tree.Branch0, EndPoint=explode_tree.Branch1)
evaluate_curve = EvaluateCurve(Curve=line, Parameter=折り曲げ位置)  # -> Point, Tangent, Angle
yz_plane = YZPlane(Origin=construct_point_2)
mirror = Mirror(Geometry=evaluate_curve.Point, Plane=yz_plane)  # -> Geometry, Transform
division = Division(A=高さ, B="2")
unit_y = UnitY(Factor=division)
point = Point([evaluate_curve.Point, mirror.Geometry])
move_3 = Move(Geometry=point, Motion=unit_y)  # -> Geometry, Transform
vector_2pt = Vector2Pt(PointA=move_2.Geometry, PointB=graft(move_3.Geometry), Unitize=False)  # -> Vector, Length
amplitude = Amplitude(Vector=vector_2pt.Vector, Amplitude=セットバック)
move_4 = Move(Geometry=move_2.Geometry, Motion=amplitude)  # -> Geometry, Transform
explode_tree_2 = ExplodeTree(Data=graft(move_3.Geometry))  # -> Branch0, Branch1
explode_tree_3 = ExplodeTree(Data=move_4.Geometry)  # -> Branch0, Branch1
merge = Merge(Data1=explode_tree_3.Branch0, Data2=explode_tree_2.Branch0, Data3=explode_tree_2.Branch1, Data4=explode_tree_3.Branch1)
polyline = PolyLine(Vertices=flatten(merge), Closed=False)
xz_plane = XZPlane(Origin=construct_point_2)
mirror_2 = Mirror(Geometry=polyline, Plane=xz_plane)  # -> Geometry, Transform
geometry = Geometry([polyline, mirror_2.Geometry])

# ----
# CNC加工時の平板を分割
# (shopbotの加工範囲制限を考慮)
# サブロク板を基準としている（1820mm x 910mm）
短辺長さ_3 = Panel(短辺長さ_2)
長辺長さ_3 = Panel(長辺長さ_2)
rectangle_2 = Rectangle(Plane=PlaneXY(0, 0, 0), XSize=短辺長さ_3, YSize=長辺長さ_3, Radius=0)  # -> Rectangle, Length
短軸方向のオフセット_4 = Panel(長軸方向のオフセット_3)
長軸方向のオフセット_4 = Panel(短軸方向のオフセット_3)
to_classify_edges = ToClassifyEdges(curve=rectangle_2.Rectangle)
entwine_4 = Entwine(Branch00=短軸方向のオフセット_4, Branch01=長軸方向のオフセット_4, FlattenInputs=True)
offset_on_srf_2 = OffsetOnSrf(Curve=to_classify_edges, Distance=entwine_4, Surface=rectangle_2.Rectangle)
multiple_curves_2 = MultipleCurves(Curves=flatten(offset_on_srf_2))  # -> Points, IndexA, IndexB, ParamA, ParamB
surface_from_points_2 = SurfaceFromPoints(Points=multiple_curves_2.Points, UCount="2", Interpolate=False)
divide_surface = DivideSurface(Surface=surface_from_points_2, UCount=Slider(2, range=0..10), VCount=Slider(1, range=0..10))  # -> Points, Normals, Parameters
tree_statistics = TreeStatistics(Tree=divide_surface.Points)  # -> Paths, Length, Count
list_item_6 = ListItem(List=tree_statistics.Paths, Index=Slider(1, range=0..10), Wrap=True)
tree_branch = TreeBranch(Tree=divide_surface.Points, Path=list_item_6, MaintainPaths=True)
外側部材_α = Panel(外側部材_α_mm)
unit_y_2 = UnitY(Factor=expr("-2*x", 外側部材_α))
polyline_2 = PolyLine(Vertices=tree_branch, Closed=False)
move_5 = Move(Geometry=polyline_2, Motion=unit_y_2)  # -> Geometry, Transform
# 長方形部材の場合、配置を決定
# 台形部材の場合は部材の縦方向の長さを決定するために使用
surface_split = SurfaceSplit(Surface=surface_from_points_2, Curves=move_5.Geometry)
boundary_surfaces_2 = BoundarySurfaces(Edges=surface_split)
divide_domain²_2 = DivideDomain²(Domain=boundary_surfaces_2, UCount=Slider(3, range=0..10), VCount=Slider(1, range=0..1))
isotrim_2 = Isotrim(Surface=graft(boundary_surfaces_2), Domain=divide_domain²_2)

addition = Addition(A=bending加工なし_長さ_mm_xss, B=板厚_mm)
maximum = Maximum(A=addition, B=接合位置_mm_xds)

# ----
# 04-ナローウェーブ
分割数 = Slider(50, range=0..50)
construct_point_3 = ConstructPoint(XCoordinate=0, YCoordinate=0, ZCoordinate=0)
narrow_wave = NarrowWave(N=分割数, wa=wa, wb=wb, ha=ha, hb=hb, hc=hc, target=construct_point_3)

expression_4 = Expression(r=同部材接合角度, Expression="(180-r)/2")
# 加工範囲から部材サイズの決定
subtraction = Subtraction(A=接合位置_mm_xds, B=bending加工なし_長さ_mm_xss)
expression_5 = Expression(r1=異部材接合角度, r2=expression_4, L1=subtraction, Expression="(L1*sin(r2°))/cos(r1°-r2°-90°)")

# ----
# 孔形状の作成・決定
# 0-ウェーブ
wave = Wave(N=分割数, W=幅_2, H=高さ_2, target=construct_point_3)

# ----
# 2-円弧
arc = Arc(W=幅_2, H=高さ_2, radius=radius, target=construct_point_3)

# ----
# 3-直線
line_2 = Line(W=幅_3, radius=高さ_3, target=construct_point_3)

# ----
# 1-菱形
rhombus = Rhombus(W=幅_2, H=高さ_2, radius=radius, terget=construct_point_3)

# ----
# Number Sliderで孔の選択
# ※0-ウェーブ
#    1-菱形
#    2-円弧
#    3-直線
#    4-ナローウェーブ
number_slider_5 = Slider(3, range=0..4)
stream_filter = StreamFilter(Gate=number_slider_5, Stream0=wave, Stream1=rhombus, Stream2=arc, Stream3=line_2, Stream4=narrow_wave)

deconstruct_brep_4 = DeconstructBrep(Brep=surface_from_points_2)  # -> Faces, Edges, Vertices
join_curves = JoinCurves(Curves=deconstruct_brep_4.Edges, Preserve=False)

# ----
# 基準形状の範囲の算出
bounding_box_2 = BoundingBox(Content=stream_filter, Plane=PlaneXY(0, 0, 0))  # -> Box, Box_2
dimensions = Dimensions(Surface=bounding_box_2.Box)  # -> UDimension, VDimension

number_slider_6 = Slider(1, range=0..5)
number_slider_7 = Slider(4, range=0..10)
number_slider_8 = Slider(4, range=0..10)
number_slider_9 = Slider(1, range=0..5)
孔の幅 = Panel(dimensions.UDimension)
孔の高さ = Panel(dimensions.VDimension)
expression_6 = Expression(x=孔の幅, a=number_slider_6, b=number_slider_7, Expression="a*x/b")
expression_7 = Expression(x=孔の高さ, a=number_slider_9, b=number_slider_8, Expression="a*x/b")

deconstruct_brep_5 = DeconstructBrep(Brep=list_item_5)  # -> Faces, Edges, Vertices
list_item_7 = ListItem(List=deconstruct_brep_5.Edges, Index=0, Wrap=True)  # -> Item, Item1, Item2, Item3
entwine_5 = Entwine(Branch00=[list_item_7.Item, list_item_7.Item2], Branch01=[list_item_7.Item1, list_item_7.Item3], FlattenInputs=True)
entwine_6 = Entwine(Branch00=短軸方向のオフセット_2, Branch01=長軸方向のオフセット_2, FlattenInputs=True)
offset_on_srf_3 = OffsetOnSrf(Curve=entwine_5, Distance=entwine_6, Surface=list_item_5)
multiple_curves_3 = MultipleCurves(Curves=flatten(offset_on_srf_3))  # -> Points, IndexA, IndexB, ParamA, ParamB
list_item_8 = ListItem(List=multiple_curves_3.Points, Index=Slider(1, range=0..3), Wrap=True)
surface_from_points_3 = SurfaceFromPoints(Points=multiple_curves_3.Points, UCount=Slider(2, range=0..10), Interpolate=False)
dimensions_2 = Dimensions(Surface=surface_from_points_3)  # -> UDimension, VDimension

# ----
# 1部材サイズの算定
オフセット値_パネルごとの幅_2 = Panel(オフセット値_パネルごとの幅)
explode_tree_4 = ExplodeTree(Data=isotrim_2)  # -> _00100, _00101
negative_2 = Negative(Value=オフセット値_パネルごとの幅_2)
list_item_9 = ListItem(List=explode_tree_4._00100, Index=0, Wrap=True)
offset_curve = OffsetCurve(Curve=list_item_9, Distance=negative_2, Corners=1)
dimensions_3 = Dimensions(Surface=offset_curve)  # -> UDimension, VDimension
sort_list = SortList(Keys=[dimensions_3.VDimension, dimensions_3.UDimension])  # -> Keys, ValuesValuesA
list_item_10 = ListItem(List=sort_list.Keys, Index=0, Wrap=True)  # -> Item, Item1

部材幅 = Panel(list_item_10.Item)
部材長さ = Panel(list_item_10.Item1)
data = Data(部材幅)
panel_2 = Panel(data)
data_2 = Data(部材長さ)
panel_3 = Panel(data_2)

# ----
# 部材配置用基点を取得
construct_point_4 = ConstructPoint(XCoordinate=0, YCoordinate=0, ZCoordinate=0)
discontinuity = Discontinuity(Curve=offset_curve, Level=1)  # -> Points, Parameters
discontinuity_2 = Discontinuity(Curve=list_item_9, Level=1)  # -> Points, Parameters
discontinuity_3 = Discontinuity(Curve=isotrim_2, Level=1)  # -> Points, Parameters
closest_point = ClosestPoint(Point=construct_point_4, Cloud=discontinuity.Points)  # -> ClosestPoint, CPIndex, Distance
closest_point_2 = ClosestPoint(Point=construct_point_4, Cloud=discontinuity_2.Points)  # -> ClosestPoint, CPIndex, Distance
closest_point_3 = ClosestPoint(Point=construct_point_4, Cloud=discontinuity_3.Points)  # -> ClosestPoint, CPIndex, Distance
orient = Orient(Geometry=closest_point.ClosestPoint, Source=closest_point_2.ClosestPoint, Target=closest_point_3.ClosestPoint)  # -> Geometry, Transform

expression_8 = Expression(x=幅, Expression="x/2")
minimum = Minimum(A=expression_8, B=孔同士の横方向の距離)
division_2 = Division(A=dimensions_2.VDimension, B=minimum)
round = Round(Number=division_2)  # -> Nearest, Floor, Ceiling
division_3 = Division(A=round.Ceiling, B=2)
integer = Integer(division_3)
equality = Equality(FirstNumber=division_3, SecondNumber=integer)  # -> Equality, Inequality
addition_2 = Addition(A=round.Ceiling, B="1")
stream_filter_2 = StreamFilter(Gate=equality.Equality, Stream0=round.Ceiling, Stream1=addition_2)
series_2 = Series(Start=0, Step=minimum, Count=stream_filter_2)
unit_x_2 = UnitX(Factor=series_2)

孔同士の縦方向の距離_h_2 = Panel(孔同士の縦方向の距離_h)

# ----
# 短軸方向のターゲット
孔同士の横方向の距離_w_2 = Panel(孔同士の横方向の距離_w)
孔幅_w = Panel(dimensions.UDimension)
板幅_mm_2 = Panel(板幅_mm)
expression_9 = Expression(x=孔幅_w, y=孔同士の横方向の距離_w_2, Expression="(x+y)/2")
cluster = Cluster_2(A=板幅_mm_2, B=expression_9)
addition_3 = Addition(A=cluster, B=1)
series_3 = Series(Start=0, Step=expression_9, Count=addition_3)

data_3 = Data(高さ)
division_4 = Division(A=dimensions_2.UDimension, B=data_3)
round_2 = Round(Number=division_4)  # -> Nearest, Floor, Ceiling
expression_10 = Expression(x=data_3, Expression="x/2")

orient_2 = Orient(Geometry=geometry, Source=construct_point_2, Target=list_item_8)  # -> Geometry, Transform

move_6 = Move(Geometry=graft(orient_2.Geometry), Motion=unit_x_2)  # -> Geometry, Transform
dispatch = Dispatch(List=move_6.Geometry, DispatchPattern=[True, False])  # -> ListA, ListB
geometry_2 = Geometry(dispatch.ListB)
geometry_3 = Geometry(dispatch.ListA)

series_4 = Series(Start=0, Step=data_3, Count=round_2.Ceiling)
series_5 = Series(Start=expression_10, Step=data_3, Count=round_2.Ceiling)
unit_y_3 = UnitY(Factor=series_4)
unit_y_4 = UnitY(Factor=series_5)
move_7 = Move(Geometry=graft(geometry_2), Motion=unit_y_4)  # -> Geometry, Transform
move_8 = Move(Geometry=graft(geometry_3), Motion=unit_y_3)  # -> Geometry, Transform
list_length_2 = ListLength(List=move_7.Geometry)
list_item_11 = ListItem(List=flatten(list_length_2), Index="1", Wrap=True)
subtraction_2 = Subtraction(A=list_item_11, B="1")
split_list = SplitList(List=move_7.Geometry, Index=subtraction_2)  # -> ListA, ListB
list_item_12 = ListItem(List=move_7.Geometry, Index="0", Wrap=True)
shift_paths = ShiftPaths(Data=simplify(split_list.ListB), Offset=-1)
shift_paths_2 = ShiftPaths(Data=simplify(list_item_12), Offset=-1)
unit_y_5 = UnitY(Factor=data_3)
explode_tree_5 = ExplodeTree(Data=shift_paths)  # -> Branch0, Branch1
explode_tree_6 = ExplodeTree(Data=shift_paths_2)  # -> Branch0, Branch1
geometry_4 = Geometry(split_list.ListA)
geometry_5 = Geometry(explode_tree_5.Branch1)
geometry_6 = Geometry(explode_tree_6.Branch0)
move_9 = Move(Geometry=geometry_6, Motion=expr("-x", unit_y_5))  # -> Geometry, Transform

list_item_13 = ListItem(List=explode_tree_4._00100, Index=0, Wrap=True)
孔同士の横方向の距離_w_3 = Panel(孔同士の横方向の距離_w)
孔同士の縦方向の距離_h_3 = Panel(孔同士の縦方向の距離_h)
孔幅_w_2 = Panel(dimensions.UDimension)
孔高さ_h = Panel(dimensions.VDimension)
# 短軸方向のターゲット
expression_11 = Expression(x=孔幅_w_2, y=孔同士の横方向の距離_w_3, Expression="(x+y)/2")
# 長軸方向のターゲット
addition_4 = Addition(A=孔高さ_h, B=孔同士の縦方向の距離_h_3)

unit_x_3 = UnitX(Factor=1)
unit_z = UnitZ(Factor=1)
unit_y_6 = UnitY(Factor=1)

孔同士の縦方向の距離_h_4 = Panel(孔同士の縦方向の距離_h)
# 長軸方向のターゲット
孔高さ_h_2 = Panel(dimensions.VDimension)
addition_5 = Addition(A=孔高さ_h_2, B=孔同士の縦方向の距離_h_4)

# ----
# 24mm 85
# 24mm 90
# 24mm 81
geometry_7 = Geometry(<brep referenced from the Rhino model>)
geometry_8 = Geometry(<brep referenced from the Rhino model>)
geometry_9 = Geometry(<brep referenced from the Rhino model>)

# ----
# 12mm 85
# 12mm 90
# 12mm 81
geometry_10 = Geometry(<brep referenced from the Rhino model>)
geometry_11 = Geometry(<brep referenced from the Rhino model>)
geometry_12 = Geometry(<brep referenced from the Rhino model>)

brep_wireframe = BrepWireframe(Brep=geometry_8, Density=-1)
孔 = Geometry(stream_filter)
孔の中心 = Point(construct_point_3)
join_curves_2 = JoinCurves(Curves=brep_wireframe, Preserve=False)
flatten_tree = FlattenTree(Tree=orient.Geometry, Path="{0}")

data_4 = Data([move_8.Geometry, move_9.Geometry, geometry_4, geometry_5])
explode = Explode(Curve=data_4, Recursive=True)  # -> flatten(Segments), Vertices
removeduplicatelines = RemoveDuplicateLines(Lines=explode.Segments, Tolerance=0.01)

data_5 = Data(join_curves_2)
explode_tree_7 = ExplodeTree(Data=orient.Geometry)  # -> _0010000, _0010001, _0010002, _0010003, _0010004, _0010005
list_length_3 = ListLength(List=flatten_tree)
division_5 = Division(A=list_length_3, B="2")
number_slider_10 = Slider(0, range=0..5)
split_list_2 = SplitList(List=flatten_tree, Index=division_5)  # -> ListA, ListB
list_item_14 = ListItem(List=split_list_2.ListA, Index=number_slider_10, Wrap=True)

bounding_box_3 = BoundingBox(Content=removeduplicatelines, Plane=PlaneXY(0, 0, 0), UnionBox=True)  # -> Box, Box_2
area_2 = Area(Geometry=surface_from_points_3)  # -> Area, Centroid
area_3 = Area(Geometry=bounding_box_3.Box)  # -> Area, Centroid
orient_3 = Orient(Geometry=removeduplicatelines, Source=area_3.Centroid, Target=area_2.Centroid)  # -> Geometry, Transform

list_item_15 = ListItem(List=explode_tree_7._0010000, Index=number_slider_10, Wrap=True)
# レーザー加工用データ　sort ガイド線
boolean_toggle = BooleanToggle(True)
geometry_13 = Geometry([orient_3.Geometry, surface_from_points_3, list_item_5, rectangle.Rectangle])

# ----
# 文字　溝作成
number_slider_11 = Slider(1, range=0..2)
text = Text(
    Location=list_item_14,
    Text=number_slider_10,
    Size=Slider(100, range=0..100),
    Bold=Toggle(True),
    HorizontalAlignment=number_slider_11,
    VerticalAlignment=Slider(2, range=0..2))
板厚_mm_2 = Panel(板厚_mm)
subtraction_3 = Subtraction(A=板厚_mm_2, B=Slider(4, range=0..10))
unit_z_2 = UnitZ(Factor=subtraction_3)
extrude = Extrude(Base=text, Direction=unit_z_2)
cap_holes = CapHoles(Brep=extrude)

panel_4 = Panel("""0
-1""")
boundary_surfaces_3 = BoundarySurfaces(Edges=list_item_15)
板厚_mm_3 = Slider(30, range=0..100)

# ----
# Synchronize
get_connected_objects_2 = GetConnectedObjects(Objects=板厚_mm_3)
get_selected_objects_2 = GetSelectedObjects()  # -> ComponentObjects, ParamObjects, OtherObjects
object_info_2 = ObjectInfo(Objects=get_connected_objects_2)  # -> Name, NickName, Type, Pivot, Bounds, Value, Enabled, Preview
set_object_value_2 = SetObjectValue(ObjectToSet=get_selected_objects_2.ParamObjects, ValueToSet=object_info_2.Value)

unit_z_3 = UnitZ(Factor=板厚_mm_3)

construct_point_5 = ConstructPoint(XCoordinate=0, YCoordinate=0, ZCoordinate=0)
text_2 = Text(
    Location=construct_point_5,
    Text="TYPE07",
    Size=Slider(10, range=0..10),
    Bold=Toggle(True),
    HorizontalAlignment=0,
    VerticalAlignment=0)

plane = Plane(Tree({0}: [Plane(origin=(225, 511.0971852, -74.31492206), x=(0, 0.6755902076, -0.7372773368), y=(0, 0.7372773368, 0.6755902076))], {1}: [Plane(origin=(225, 1103.294877, -74.31492206), x=(0, 0.6755902076, -0.7372773368), y=(0, 0.7372773368, 0.6755902076))], {2}: [Plane(origin=(225, 1695.492568, -74.31492206), x=(0, 0.6755902076, -0.7372773368), y=(0, 0.7372773368, 0.6755902076))], {3}: [Plane(origin=(225, 2287.690259, -74.31492206), x=(0, 0.6755902076, -0.7372773368), y=(0, 0.7372773368, 0.6755902076))], {4}: [Plane(origin=(225, 2879.887951, -74.31492206), x=(0, 0.6755902076, -0.7372773368), y=(0, 0.7372773368, 0.6755902076))], {5}: [Plane(origin=(225, 3472.085642, -74.31492206), x=(0, 0.6755902076, -0.7372773368), y=(0, 0.7372773368, 0.6755902076))], {6}: [Plane(origin=(225, 4064.283333, -74.31492206), x=(0, 0.6755902076, -0.7372773368), y=(0, 0.7372773368, 0.6755902076))], {7}: [Plane(origin=(225, 4656.481025, -74.31492206), x=(0, 0.6755902076, -0.7372773368), y=(0, 0.7372773368, 0.6755902076))]))
plane_2 = Plane(Tree({0}: [Plane(origin=(225, 496.5925425, -74.31492206), x=(0, 0.5094169368, -0.8605198339), y=(0, 0.8605198339, 0.5094169368))], {1}: [Plane(origin=(225, 1088.790234, -74.31492206), x=(0, 0.5094169368, -0.8605198339), y=(0, 0.8605198339, 0.5094169368))], {2}: [Plane(origin=(225, 1680.987925, -74.31492206), x=(0, 0.5094169368, -0.8605198339), y=(0, 0.8605198339, 0.5094169368))], {3}: [Plane(origin=(225, 2273.185617, -74.31492206), x=(0, 0.5094169368, -0.8605198339), y=(0, 0.8605198339, 0.5094169368))], {4}: [Plane(origin=(225, 2865.383308, -74.31492206), x=(0, 0.5094169368, -0.8605198339), y=(0, 0.8605198339, 0.5094169368))], {5}: [Plane(origin=(225, 3457.580999, -74.31492206), x=(0, 0.5094169368, -0.8605198339), y=(0, 0.8605198339, 0.5094169368))], {6}: [Plane(origin=(225, 4049.778691, -74.31492206), x=(0, 0.5094169368, -0.8605198339), y=(0, 0.8605198339, 0.5094169368))], {7}: [Plane(origin=(225, 4641.976382, -74.31492206), x=(0, 0.5094169368, -0.8605198339), y=(0, 0.8605198339, 0.5094169368))]))

板厚_mm_4 = Panel(板厚_mm)
division_6 = Division(A=Slider(13, range=0..100), B=2)
negative_3 = Negative(Value=division_6)

division_7 = Division(A=Slider(13, range=0..100), B=2)
negative_4 = Negative(Value=division_7)

text_join = TextJoin(Text=["Test データ", "6.35mm切削"], Join="::")
create_modify_layers = CreateModifyLayers(LayerName=text_join, DeleteLayer=Toggle(False), enableFullPath=True)  # -> LayerNames, LayerFullPath
createattributes = CreateAttributes(LayerName=create_modify_layers.LayerNames, GroupIndices=Slider(7, range=0..10), enableFullPath=False)
text_tag_3d_3 = TextTag3D(Location=list_item_14, Text=create_modify_layers.LayerNames, Size=Slider(10, range=0..10), Justification=7)

# ----
# 記号の作成
number_slider_12 = Slider(9, range=0..10)
series_6 = Series(Start=0, Step=1, Count=number_slider_12)
square = Square(Plane=PlaneXY(0, 0, 0), Size=Slider(8.5, range=0..10), ExtentX=Slider(5, range=0..10), ExtentY=Slider(2, range=0..10))  # -> Cells, Points
addition_6 = Addition(A=series_6, B=1)
shift_paths_3 = ShiftPaths(Data=square.Cells, Offset=-1)
series_7 = Series(Start=0, Step=1, Count=addition_6)
list_item_16 = ListItem(List=shift_paths_3, Index=series_7, Wrap=True)
area_4 = Area(Geometry=list_item_16)  # -> Area, Centroid
division_8 = Division(A=Slider(7.5, range=0..10), B=2)
circle = Circle(Plane=area_4.Centroid, Radius=division_8)  # -> simplify(Circle)
path_mapper = PathMapper(circle, source="{i}", target="{8-i}")

number_slider_13 = Slider(1, range=0..10)
boolean_toggle_2 = BooleanToggle(True)
xy_plane = XYPlane(Origin=Point(0, 0, 0))
flip_plane = FlipPlane(Plane=xy_plane, FlipX=boolean_toggle_2, FlipY=boolean_toggle_2, FlipZ=boolean_toggle_2)  # -> Flipped, ResultBoolean
panel_5 = Panel("""A
B""")
construct_point_6 = ConstructPoint(XCoordinate=0, YCoordinate=Slider(-470, range=-1000..1000), ZCoordinate=0)
number_slider_14 = Slider(33, range=0..100)

# ----
# 孔加工範囲の指定
長軸方向のオフセット_5 = Slider(169, range=0..300)
短軸方向のオフセット_5 = Slider(0, range=0..100)

expression_12 = Expression(Lx=data_2, Xb=bending加工部分_長さ_mm_xb, Xss=bending加工なし_長さ_mm_xss, Expression="(Lx - Xb)/2 - Xss")
division_9 = Division(A=異部材接合角度, B=2)
addition_7 = Addition(A=板幅_mm, B=短軸方向のオフセット_5)
addition_8 = Addition(A=bending加工なし_長さ_mm_xss, B=expression_12)
minimum_2 = Minimum(A=addition_8, B=maximum)

bending加工なし長さ_余し = Panel(addition_8)

radians = Radians(Degrees=division_9)
expression_13 = Expression(x=radians, L=bending加工部分_長さ_mm_xb, Expression="(L*sin(x))/x")
vector_xyz_2 = VectorXYZ(XComponent="1", YComponent=0, ZComponent="1")  # -> Vector, Length
vector_xyz_3 = VectorXYZ(XComponent=0, YComponent="1", ZComponent=0)  # -> Vector, Length
expression_14 = Expression(x=異部材接合角度, Expression="(90-x)/2")
construct_point_7 = ConstructPoint(XCoordinate=0, YCoordinate=0, ZCoordinate=0)
construct_point_8 = ConstructPoint(XCoordinate=expression_13, YCoordinate=0, ZCoordinate=0)
rotate = Rotate(Vector=vector_xyz_2.Vector, Axis=vector_xyz_3.Vector, Angle=degrees(expression_14))
arc_sed = ArcSED(Start=construct_point_7, End=construct_point_8, Direction=rotate)  # -> Arc, Plane, Radius

subtraction_4 = Subtraction(A=addition_8, B=接合位置_mm_xds)
multiplication_2 = Multiplication(A=subtraction_4, B=2)
のりしろ幅_mm = Panel(multiplication_2)
panel_6 = Panel(expression_13)
vector_display = VectorDisplay(Anchor=construct_point_7, Vector=rotate)

bending加工なし長さ_xss = Panel(bending加工なし_長さ_mm_xss)
異部材接合角度_2 = Panel(division_9)
expression_15 = Expression(x=異部材接合角度_2, Xss=bending加工なし長さ_xss, Expression="Xss*sin(x°)")
bending加工なし長さ_余し_2 = Panel(addition_8)
negative_5 = Negative(Value=expression_15)
line_type = Panel("0")
point_a = Point(construct_point_7)
point_b = Point(construct_point_8)
extend_curve = ExtendCurve(Curve=arc_sed.Arc, Type=line_type, Start=bending加工なし長さ_余し_2, End=bending加工なし長さ_余し_2)
vector_xyz_4 = VectorXYZ(XComponent=0, YComponent=0, ZComponent=negative_5)  # -> Vector, Length
line_3 = Line(StartPoint=point_a, EndPoint=point_b)
move_10 = Move(Geometry=line_3, Motion=vector_xyz_4.Vector)  # -> Geometry, Transform
mirror_curve = MirrorCurve(Geometry=extend_curve, Curve=move_10.Geometry, Tangent=True)
外側部材_α_2 = Panel(外側部材_α_mm)
negative_6 = Negative(Value=外側部材_α_2)
line_type_2 = Panel("0")
extend_curve_2 = ExtendCurve(Curve=mirror_curve, Type=line_type_2, Start=外側部材_α_2, End=外側部材_α_2)
extend_curve_3 = ExtendCurve(Curve=extend_curve, Type=line_type_2, Start=negative_6, End=negative_6)
merge_2 = Merge(Data1=extend_curve_3, Data2=extend_curve_2)
板幅 = Panel(addition_7)
vector_xyz_5 = VectorXYZ(XComponent=0, YComponent=板幅, ZComponent=0)  # -> Vector, Length
extrude_2 = Extrude(Base=merge_2, Direction=vector_xyz_5.Vector)

panel_7 = Panel(arc_sed.Radius)

division_10 = Division(A="1", B=arc_sed.Radius)
bending_曲率 = Panel(division_10)

# ----
# 1部材あたりの孔加工範囲の指定
bending加工なし長さ_余し_3 = Panel(addition_8)
外側部材_α_3 = Panel(外側部材_α_mm)
短軸方向のオフセット_孔加工 = Panel(短軸方向のオフセット_5)
subtraction_5 = Subtraction(A=bending加工なし長さ_余し_3, B=外側部材_α_3)
boundary_surfaces_4 = BoundarySurfaces(Edges=offset_curve)
to_classify_edges_2 = ToClassifyEdges(curve=offset_curve)
entwine_7 = Entwine(Branch00=subtraction_5, Branch01=短軸方向のオフセット_孔加工, FlattenInputs=True)
offset_on_srf_4 = OffsetOnSrf(Curve=to_classify_edges_2, Distance=entwine_7, Surface=boundary_surfaces_4)
multiple_curves_4 = MultipleCurves(Curves=flatten(offset_on_srf_4))  # -> Points, IndexA, IndexB, ParamA, ParamB
surface_from_points_4 = SurfaceFromPoints(Points=multiple_curves_4.Points, UCount="2", Interpolate=False)
dimensions_4 = Dimensions(Surface=surface_from_points_4)  # -> UDimension, VDimension

deconstruct_brep_6 = DeconstructBrep(Brep=extrude_2)  # -> Faces, Edges, Vertices
join_curves_3 = JoinCurves(Curves=deconstruct_brep_6.Edges, Preserve=False)
multiple_curves_5 = MultipleCurves(Curves=flatten(join_curves_3))  # -> Points, IndexA, IndexB, ParamA, ParamB
vector_xyz_6 = VectorXYZ(XComponent=0, YComponent="1", ZComponent=0)  # -> Vector, Length
negative_7 = Negative(Value=vector_xyz_6.Vector)
longest_list = LongestList(ListListA=multiple_curves_5.Points, ListListB=[negative_7, vector_xyz_6.Vector], PaddingMode=3)  # -> ListListA, ListListB
切り欠き長さ = Panel(切り欠き長さ_mm)
line_sdl = LineSDL(Start=longest_list.ListListA, Direction=longest_list.ListListB, Length=切り欠き長さ)
板厚 = Panel(板厚_mm)
division_11 = Division(A=板厚, B=2)
pipe = Pipe(Curve=line_sdl, Radius=division_11, Caps=Slider(1, range=0..2))

bounding_box_4 = BoundingBox(Content=merge_2, Plane=PlaneXY(0, 0, 0), UnionBox=True)  # -> Box, Box_2
dimensions_5 = Dimensions(Surface=bounding_box_4.Box)  # -> UDimension, VDimension

# ----
# 長軸方向のターゲット
# 部材毎での長軸方向の孔間隔の変更
孔間隔の下限値 = Slider(8.5, range=0..10)
孔間隔の上限値 = Slider(12, range=0..20)
アーチ方向_部材数_2 = Panel(アーチ方向_部材数)
subtraction_6 = Subtraction(A=アーチ方向_部材数_2, B=1)
construct_domain = ConstructDomain(DomainStart=孔間隔の下限値, DomainEnd=孔間隔の上限値)
range = Range(Domain=Domain(0, 1), Steps=subtraction_6)
remap_numbers = RemapNumbers(Value=range, Source=Domain(0, 1), Target=construct_domain)  # -> Mapped, Clipped
部材縦幅_bending加工 = Panel(dimensions_4.UDimension)
孔高さ_h_3 = Panel(dimensions.VDimension)
addition_9 = Addition(A=孔高さ_h_3, B=remap_numbers.Mapped)
cluster_2 = Cluster_3(A=部材縦幅_bending加工, B=addition_9)
addition_10 = Addition(A=cluster_2, B=1)
series_8 = Series(Start=0, Step=addition_9, Count=addition_10)

trim_solid = TrimSolid(Shape=extrude_2, Cutters=flatten(pipe))
板厚_2 = Panel(板厚_mm)
division_12 = Division(A=板厚_2, B=2)
negative_8 = Negative(Value=division_12)
offset_surface = OffsetSurface(Surface=graft(extrude_2), Distance=[division_12, negative_8], Retrim=True)
deconstruct_brep_7 = DeconstructBrep(Brep=offset_surface)  # -> Faces, Edges, Vertices
join_curves_4 = JoinCurves(Curves=deconstruct_brep_7.Edges, Preserve=False)
shift_paths_4 = ShiftPaths(Data=join_curves_4, Offset=-2)
loft = Loft(Curves=shift_paths_4, Options={Adjust=False, Closed=False, LoftEnds=0, LoftSimp=0, LoftType=0, Rebuild=10, Refit=0.01})
brep_join = BrepJoin(Breps=[loft, offset_surface])  # -> Breps, Closed

pointa_接線ベクトル = Vector(rotate)
deconstruct_vector = DeconstructVector(Vector=pointa_接線ベクトル)  # -> XComponent, YComponent, ZComponent
negative_9 = Negative(Value=deconstruct_vector.ZComponent)
vector_xyz_7 = VectorXYZ(XComponent=deconstruct_vector.XComponent, YComponent=0, ZComponent=negative_9)  # -> Vector, Length
pointa_接線ベクトル_2 = Vector(rotate)
接合位置 = Panel(minimum_2)
接合位置_2 = Panel(minimum_2)
amplitude_2 = Amplitude(Vector=expr("-x", pointa_接線ベクトル_2), Amplitude=接合位置)
amplitude_3 = Amplitude(Vector=vector_xyz_7.Vector, Amplitude=接合位置_2)
point_a_2 = Point(construct_point_7)
point_b_2 = Point(construct_point_8)
move_11 = Move(Geometry=point_a_2, Motion=amplitude_2)  # -> Geometry, Transform
move_12 = Move(Geometry=point_b_2, Motion=amplitude_3)  # -> Geometry, Transform

# ----
# ターゲットの抽出（間隔修正なし）
cross_reference = CrossReference(ListListA=series_8, ListListB=series_3, CrossMode=1)  # -> ListListA, ListListB
construct_point_9 = ConstructPoint(XCoordinate=cross_reference.ListListA, YCoordinate=cross_reference.ListListB, ZCoordinate=0)
partition_list = PartitionList(List=construct_point_9, Size=graft(addition_10))
dispatch_2 = Dispatch(List=partition_list, DispatchPattern=[True, False])  # -> ListA, ListB
tree_statistics_2 = TreeStatistics(Tree=partition_list)  # -> Paths, Length, Count
dispatch_3 = Dispatch(List=tree_statistics_2.Paths, DispatchPattern=[True, False])  # -> ListA, ListB
tree_branch_2 = TreeBranch(Tree=dispatch_2.ListB, Path=dispatch_3.ListB, MaintainPaths=True)
tree_branch_3 = TreeBranch(Tree=dispatch_2.ListA, Path=dispatch_3.ListA, MaintainPaths=True)
merge_3 = Merge(Data1=tree_branch_3, Data2=tree_branch_2)
shift_paths_5 = ShiftPaths(Data=merge_3, Offset=-1)
bounding_box_5 = BoundingBox(Content=shift_paths_5, Plane=PlaneXY(0, 0, 0), UnionBox=True)  # -> Box, Box_2
area_5 = Area(Geometry=bounding_box_5.Box)  # -> Area, Centroid
xy_plane_2 = XYPlane(Origin=area_5.Centroid)
area_6 = Area(Geometry=surface_from_points_4)  # -> Area, Centroid
flip_plane_2 = FlipPlane(Plane=xy_plane_2, ReverseX=Toggle(False), ReverseY=Toggle(False), SwapAxes=Toggle(True))
orient_4 = Orient(Geometry=shift_paths_5, Source=flip_plane_2, Target=area_6.Centroid)  # -> Geometry, Transform

部材横幅_bending加工 = Panel(dimensions_4.VDimension)
部材縦幅_bending加工_2 = Panel(dimensions_4.UDimension)
cluster_3 = Cluster(A=部材縦幅_bending加工_2, B=addition_4)
cluster_4 = Cluster_2(A=部材横幅_bending加工, B=expression_11)

# ----
# ターゲットの抽出（間隔修正なし）
addition_11 = Addition(A=cluster_3, B=1)
addition_12 = Addition(A=cluster_4, B=1)
series_9 = Series(Start=0, Step=addition_4, Count=addition_11)
series_10 = Series(Start=0, Step=expression_11, Count=addition_12)
cross_reference_2 = CrossReference(ListListA=series_9, ListListB=series_10, CrossMode=1)  # -> ListListA, ListListB
construct_point_10 = ConstructPoint(XCoordinate=cross_reference_2.ListListA, YCoordinate=cross_reference_2.ListListB, ZCoordinate=0)
partition_list_2 = PartitionList(List=construct_point_10, Size=addition_11)
dispatch_4 = Dispatch(List=partition_list_2, DispatchPattern=[True, False])  # -> ListA, ListB
tree_statistics_3 = TreeStatistics(Tree=partition_list_2)  # -> Paths, Length, Count
dispatch_5 = Dispatch(List=tree_statistics_3.Paths, DispatchPattern=[True, False])  # -> ListA, ListB
tree_branch_4 = TreeBranch(Tree=dispatch_4.ListA, Path=dispatch_5.ListA, MaintainPaths=True)
tree_branch_5 = TreeBranch(Tree=dispatch_4.ListB, Path=dispatch_5.ListB, MaintainPaths=True)
merge_4 = Merge(Data1=tree_branch_4, Data2=tree_branch_5)
bounding_box_6 = BoundingBox(Content=flatten(merge_4), Plane=PlaneXY(0, 0, 0), UnionBox=True)  # -> Box, Box_2
area_7 = Area(Geometry=bounding_box_6.Box)  # -> Area, Centroid
xy_plane_3 = XYPlane(Origin=area_7.Centroid)
area_8 = Area(Geometry=surface_from_points_4)  # -> Area, Centroid
flip_plane_3 = FlipPlane(Plane=xy_plane_3, ReverseX=Toggle(False), ReverseY=Toggle(False), SwapAxes=Toggle(True))
orient_5 = Orient(Geometry=merge_4, Source=flip_plane_3, Target=area_8.Centroid)  # -> Geometry, Transform
point_in_curve = PointInCurve(Point=orient_5.Geometry, Curve=surface_from_points_4)  # -> Relationship, Point
equality_2 = Equality(FirstNumber=point_in_curve.Relationship, SecondNumber=2)  # -> Equality, Inequality
cull_pattern = CullPattern(List=orient_5.Geometry, CullPattern=equality_2.Equality)
orient_6 = Orient(Geometry=孔, Source=孔の中心, Target=cull_pattern)  # -> Geometry, Transform

切り欠き長さ_2 = Panel(切り欠き長さ_mm)
板厚方向ベクトル = Vector(vector_xyz_5.Vector)
板幅_2 = Panel(addition_7)
multiplication_3 = Multiplication(A=切り欠き長さ_2, B=2)
explode_tree_8 = ExplodeTree(Data=brep_join.Breps)  # -> _0010000, _0010001
division_13 = Division(A=板厚方向ベクトル, B=2)
subtraction_7 = Subtraction(A=板幅_2, B=multiplication_3)
move_13 = Move(Geometry=move_11.Geometry, Motion=division_13)  # -> Geometry, Transform
move_14 = Move(Geometry=move_12.Geometry, Motion=division_13)  # -> Geometry, Transform
pointb_接線ベクトル = Vector(amplitude_3)
pointa_接線ベクトル_3 = Vector(rotate)
vector_xyz_8 = VectorXYZ(XComponent=0, YComponent=subtraction_7, ZComponent=0)  # -> Vector, Length
construct_plane = ConstructPlane(Origin=move_13.Geometry, XAxis=pointa_接線ベクトル_3, YAxis=unit_z)
construct_plane_2 = ConstructPlane(Origin=move_14.Geometry, XAxis=pointb_接線ベクトル, YAxis=unit_z)
move_15 = Move(Geometry=explode_tree_8._0010001, Motion=vector_xyz_8.Vector)  # -> Geometry, Transform
部材接合角度 = Panel(同部材接合角度)
merge_5 = Merge(Data1=explode_tree_8._0010000, Data2=move_15.Geometry)
rotate_plane = RotatePlane(Plane=construct_plane_2, Angle=degrees(部材接合角度))
create_tile = CreateTile(Geo=merge_5, Planes=[rotate_plane, move_13.Geometry])
orient_7 = Orient(Geometry=explode_tree_8._0010000, Source=construct_plane, Target=rotate_plane)  # -> Geometry, Transform
アーチ方向_部材数_3 = Panel(アーチ方向_部材数)
subtraction_8 = Subtraction(A=アーチ方向_部材数_3, B=2)
linear_t = LinearT(Geometry=create_tile, Transform=orient_7.Transform, Num=subtraction_8)

部材縦幅_bending加工_3 = Panel(dimensions_4.UDimension)
cluster_5 = Cluster(A=部材縦幅_bending加工_3, B=addition_5)
addition_13 = Addition(A=cluster_5, B=1)
series_11 = Series(Start=0, Step=addition_5, Count=addition_13)
cross_reference_3 = CrossReference(ListListA=series_11, ListListB=series_3, CrossMode=1)  # -> ListListA, ListListB
explode_tile = ExplodeTile(Tile=create_tile)  # -> Geo, Lines, IDPlanes, Planes, Planes_2, Planes_3
construct_point_11 = ConstructPoint(XCoordinate=cross_reference_3.ListListA, YCoordinate=cross_reference_3.ListListB, ZCoordinate=0)
partition_list_3 = PartitionList(List=construct_point_11, Size=addition_13)
orient_8 = Orient(Geometry=孔, Source=孔の中心, Target=orient_4.Geometry)  # -> Geometry, Transform
dispatch_6 = Dispatch(List=partition_list_3, DispatchPattern=[True, False])  # -> ListA, ListB
tree_statistics_4 = TreeStatistics(Tree=partition_list_3)  # -> Paths, Length, Count
tree_statistics_5 = TreeStatistics(Tree=orient_8.Geometry)  # -> Paths, Length, Count
panel_8 = Panel(partition_list_3)

explode_tile_2 = ExplodeTile(Tile=linear_t)  # -> Geo, Lines, IDPlanes, Planes, Planes_2, Planes_3
list_item_17 = ListItem(List=flatten(explode_tile_2.Planes), Index=0, Wrap=True)  # -> Item1, Item
list_item_18 = ListItem(List=flatten(explode_tile_2.Planes_2), Index=0, Wrap=True)  # -> Item1, Item
vector_2pt_2 = Vector2Pt(PointA=list_item_18.Item, PointB=list_item_17.Item1, Unitize=False)  # -> Vector, Length
xz_plane_2 = XZPlane(Origin=Point(0, 0, 0))
align_plane = AlignPlane(Plane=xz_plane_2, Direction=vector_2pt_2.Vector)  # -> Plane, Angle
orient_9 = Orient(Geometry=explode_tile_2.Geo, Source=align_plane.Plane, Target=xz_plane_2)  # -> Geometry, Transform

panel_9 = Panel(explode_tile_2.Geo)
dispatch_7 = Dispatch(List=tree_statistics_4.Paths, DispatchPattern=[True, False])  # -> ListA, ListB
list_item_19 = ListItem(List=tree_statistics_5.Paths, Index=Slider(1, range=0..10), Wrap=True)

板幅_3 = Panel(addition_7)
切り欠き長さ_3 = Panel(切り欠き長さ_mm)
multiplication_4 = Multiplication(A=板幅_3, B=2)
multiplication_5 = Multiplication(A=切り欠き長さ_3, B=4)
奥行方向部材数x2_2 = Panel(奥行方向部材数x2)
subtraction_9 = Subtraction(A=multiplication_4, B=multiplication_5)
series_12 = Series(Start=0, Step=subtraction_9, Count=奥行方向部材数x2_2)
unit_y_7 = UnitY(Factor=series_12)

data_6 = Data(explode_tile_2.Geo)
tree_branch_6 = TreeBranch(Tree=orient_8.Geometry, Path=list_item_19, MaintainPaths=True)
# ターゲットの抽出（間隔修正なし）
tree_branch_7 = TreeBranch(Tree=dispatch_6.ListA, Path=dispatch_7.ListA, MaintainPaths=True)
tree_branch_8 = TreeBranch(Tree=dispatch_6.ListB, Path=dispatch_7.ListB, MaintainPaths=True)
orient_10 = Orient(Geometry=tree_branch_6, Source=closest_point.ClosestPoint, Target=list_item_14)  # -> Geometry, Transform

data_7 = Data(multiple_curves_5.Points)
list_item_20 = ListItem(List=data_7, Index=0, Wrap=True)  # -> Item, Item1, Item2, Item3
line_4 = Line(StartPoint=list_item_20.Item, EndPoint=list_item_20.Item3)
line_5 = Line(StartPoint=list_item_20.Item1, EndPoint=list_item_20.Item2)
curve_middle = CurveMiddle(Curve=[line_4, line_5])
linear_t_2 = LinearT(Geometry=curve_middle, Transform=orient_7.Transform, Num=subtraction_8)
construct_plane_3 = ConstructPlane(Origin=linear_t_2, XAxis=Vector(1, 0, 0), YAxis=Vector(0, 1, 0))
orient_11 = Orient(Geometry=construct_plane_3, Source=align_plane.Plane, Target=xz_plane_2)  # -> Geometry, Transform
sort_points = SortPoints(Points=flatten(orient_11.Geometry))  # -> Points, Indices
polyline_3 = PolyLine(Vertices=sort_points.Points, Closed=False)
perp_frame = PerpFrame(Curve=reparameterize(polyline_3), Parameter=[Slider(0, range=0..100), Slider(1, range=0..100)])  # -> graft(Frame)
bounding_box_7 = BoundingBox(Content=polyline_3, Plane=PlaneXY(0, 0, 0))  # -> Box, Box_2
deconstruct_plane = DeconstructPlane(Plane=perp_frame)  # -> Origin, XAxis, YAxis, ZAxis
entwine_8 = Entwine(Branch00=Slider(200, range=0..1000), Branch01=Slider(450, range=0..1000), FlattenInputs=True)
deconstruct_brep_8 = DeconstructBrep(Brep=bounding_box_7.Box)  # -> Faces, Edges, Vertices
negative_10 = Negative(Value=deconstruct_plane.XAxis)
division_14 = Division(A=entwine_8, B=2)
item_selector = ItemSelector(deconstruct_brep_8.Faces, {"Untrimmed Surface"}, selected="Untrimmed Surface")
line_sdl_2 = LineSDL(Start=perp_frame, Direction=[deconstruct_plane.XAxis, negative_10], Length=division_14)
join_curves_5 = JoinCurves(Curves=line_sdl_2, Preserve=False)
dimensions_6 = Dimensions(Surface=item_selector)  # -> UDimension, VDimension
end_points = EndPoints(Curve=join_curves_5)  # -> Start, End
flip_matrix = FlipMatrix(Data=[end_points.Start, end_points.End])
unit_z_4 = UnitZ(Factor=dimensions_6.VDimension)
polyline_4 = PolyLine(Vertices=flip_matrix, Closed=False)
extrude_3 = Extrude(Base=polyline_4, Direction=unit_z_4)
unit_y_8 = UnitY(Factor=1)
project = Project(Curve=polyline_3, Brep=extrude_3, Direction=unit_y_8)
explode_tree_9 = ExplodeTree(Data=project)  # -> _0000, _0100
loft_2 = Loft(
    Curves=flatten([explode_tree_9._0000, explode_tree_9._0100]),
    Options={Adjust=False, Closed=False, LoftEnds=0, LoftSimp=0, LoftType=0, Rebuild=10, Refit=0.01})
edge_surface = EdgeSurface(CurveA=explode_tree_9._0000, CurveB=explode_tree_9._0100)
unroll = Unroll(MeshOrBrep=edge_surface)  # -> Brep, Curves, Points, TextDotsLocation, TextDots
deconstruct_brep_9 = DeconstructBrep(Brep=loft_2)  # -> Faces, Edges, Vertices
project_2 = Project(Geometry=unroll.Brep, Plane=PlaneXY(0, 0, 0))  # -> Geometry, Transform
deconstruct_brep_10 = DeconstructBrep(Brep=project_2.Geometry)  # -> Faces, Edges, Vertices
offset_surface_2 = OffsetSurface(Surface=deconstruct_brep_9.Faces, Distance=Slider(12, range=0..100), Retrim=True)
area_9 = Area(Geometry=deconstruct_brep_10.Faces)  # -> Area, Centroid
area_10 = Area(Geometry=deconstruct_brep_10.Faces)  # -> Area, Centroid
list_length_4 = ListLength(List=area_9.Centroid)
deconstruct_3 = Deconstruct(Point=area_9.Centroid)  # -> XComponent, YComponent, ZComponent
scale_nu = ScaleNU(Geometry=deconstruct_brep_10.Faces, Plane=area_10.Centroid, ScaleX=1, ScaleY=Slider(1.14, range=0..10), ScaleZ=1)  # -> Geometry, Transform
series_13 = Series(Start=0, Step=1, Count=list_length_4)
sort_list_2 = SortList(Keys=deconstruct_3.YComponent, ValuesValuesA=series_13)  # -> Keys, ValuesValuesA
list_item_21 = ListItem(List=deconstruct_brep_10.Faces, Index=sort_list_2.ValuesValuesA, Wrap=True)
dispatch_8 = Dispatch(List=list_item_21, DispatchPattern=[True, False])  # -> ListA, ListB
deconstruct_brep_11 = DeconstructBrep(Brep=dispatch_8.ListA)  # -> Faces, Edges, Vertices
panel_10 = Panel(deconstruct_brep_11.Edges)
panel_11 = Panel("""1
2""")
list_item_22 = ListItem(List=deconstruct_brep_11.Edges, Index=panel_11, Wrap=True)
curve_middle_2 = CurveMiddle(Curve=list_item_22)
cull_index = CullIndex(List=deconstruct_brep_11.Edges, Indices=panel_11, Wrap=True)
sort_points_2 = SortPoints(Points=curve_middle_2)  # -> Points, Indices
curve_middle_3 = CurveMiddle(Curve=cull_index)
geometry_14 = Geometry(merge_2)
list_item_23 = ListItem(List=list_item_22, Index=sort_points_2.Indices, Wrap=True)
curve_to_polyline = CurveToPolyline(Curve=list_item_23, ToleranceDistance=0, ToleranceAngle=0)  # -> Polyline, Segments
multiple_curves_6 = MultipleCurves(Curves=geometry_14)  # -> Points, IndexA, IndexB, ParamA, ParamB
list_item_24 = ListItem(List=multiple_curves_6.Points, Index=0, Wrap=True)  # -> Item, Item1
list_item_25 = ListItem(List=curve_to_polyline.Polyline, Index=0, Wrap=True)
部材xy平面投影長さ = Panel(dimensions_5.UDimension)
distance = Distance(PointA=list_item_24.Item, PointB=list_item_24.Item1)
unit_y_9 = UnitY(Factor=1)
unit_vector = UnitVector(Vector=list_item_25)
xy_plane_4 = XYPlane(Origin=Point(0, 0, 0))
部材xy平面投影長さ_2 = Panel(dimensions_5.VDimension)
subtraction_10 = Subtraction(A=部材xy平面投影長さ, B=distance)
panel_12 = Panel(distance)
angle = Angle(VectorA=unit_vector, VectorB=unit_y_9, Plane=xy_plane_4)  # -> Angle, Reflex
division_15 = Division(A=subtraction_10, B=2)
division_16 = Division(A=部材xy平面投影長さ_2, B=2)
expression_16 = Expression(x=division_15, d=angle.Angle, Expression="x/cos(d)")
addition_14 = Addition(A=division_16, B=Slider(1.18, range=0..10))
unit_z_5 = UnitZ(Factor=addition_14)
extend_curve_4 = ExtendCurve(Curve=curve_to_polyline.Polyline, Type=0, Start=expression_16, End=expression_16)
unit_y_10 = UnitY(Factor=1)
xz_plane_3 = XZPlane(Origin=multiple_curves_6.Points)
point_2 = Point(Point(0, 0, 0))
negative_11 = Negative(Value=unit_z_5)
bounding_box_8 = BoundingBox(Content=geometry_14, Plane=PlaneXY(0, 0, 0), UnionBox=True)  # -> Box, Box_2
curve_middle_4 = CurveMiddle(Curve=cull_index)
line_sdl_3 = LineSDL(Start=point_2, Direction=unit_y_10, Length=Slider(10000, range=0..10000))
deconstruct_4 = Deconstruct(Point=move_13.Geometry)  # -> XComponent, YComponent, ZComponent
deconstruct_brep_12 = DeconstructBrep(Brep=bounding_box_8.Box)  # -> Faces, Edges, Vertices
sort_along_curve_2 = SortAlongCurve(Points=curve_middle_4, Curve=line_sdl_3)  # -> Points, Indices
extrude_4 = Extrude(Base=graft(extend_curve_4), Direction=[unit_z_5, negative_11])
list_item_26 = ListItem(List=deconstruct_brep_12.Edges, Index=Slider(1, range=0..3), Wrap=True)  # -> Item, Item1, Item2
yz_plane_2 = YZPlane(Origin=sort_along_curve_2.Points)
unit_y_11 = UnitY(Factor=deconstruct_4.YComponent)
brep_join_2 = BrepJoin(Breps=extrude_4)  # -> Breps, Closed
list_item_27 = ListItem(List=yz_plane_2, Index=0, Wrap=True)  # -> Item, Item1
move_16 = Move(Geometry=xz_plane_3, Motion=unit_y_11)  # -> Geometry, Transform
curve_middle_5 = CurveMiddle(Curve=list_item_26.Item)
curve_middle_6 = CurveMiddle(Curve=list_item_26.Item2)
tree_statistics_6 = TreeStatistics(Tree=brep_join_2.Breps)  # -> Paths, Length, Count
merge_6 = Merge(Data1=curve_middle_5, Data2=curve_middle_6)
list_item_28 = ListItem(List=xz_plane_3, Index=0, Wrap=True)
list_item_29 = ListItem(List=xz_plane_3, Index=0, Wrap=True)
list_item_30 = ListItem(List=move_16.Geometry, Index=0, Wrap=True)
dispatch_9 = Dispatch(List=tree_statistics_6.Paths, DispatchPattern=[True, False])  # -> ListA, ListB
orient_12 = Orient(Geometry=geometry_14, Source=list_item_29, Target=list_item_27.Item)  # -> Geometry, Transform
orient_13 = Orient(Geometry=[construct_plane, construct_plane_2], Source=list_item_30, Target=list_item_27.Item)  # -> Geometry, Transform
orient_14 = Orient(Geometry=merge_6, Source=list_item_28, Target=list_item_27.Item)  # -> Geometry, Transform
orient_15 = Orient(Geometry=xz_plane_3, Source=list_item_28, Target=list_item_27.Item)  # -> Geometry, Transform
tree_branch_9 = TreeBranch(Tree=brep_join_2.Breps, Path=dispatch_9.ListA, MaintainPaths=True)
tree_branch_10 = TreeBranch(Tree=brep_join_2.Breps, Path=dispatch_9.ListB, MaintainPaths=True)
unit_x_4 = UnitX(Factor=1)
project_3 = Project(Curve=orient_12.Geometry, Brep=tree_branch_9, Direction=unit_x_4)
project_4 = Project(Curve=orient_12.Geometry, Brep=tree_branch_10, Direction=unit_x_4)
flip_curve = FlipCurve(Curve=project_3, Guide=line_sdl_3)  # -> Curve, Flag
flip_curve_2 = FlipCurve(Curve=project_4, Guide=line_sdl_3)  # -> Curve, Flag
end_points_2 = EndPoints(Curve=flip_curve_2.Curve)  # -> Start, End
end_points_3 = EndPoints(Curve=flip_curve.Curve)  # -> Start, End
line_6 = Line(StartPoint=end_points_2.End, EndPoint=end_points_3.End)
line_7 = Line(StartPoint=end_points_2.Start, EndPoint=end_points_3.Start)
sweep2 = Sweep2(Rail1=reparameterize(flip_curve_2.Curve), Rail2=reparameterize(flip_curve.Curve), Sections=line_7, SameHeight=False)

merge_7 = Merge(Data1=tree_branch_7, Data2=tree_branch_8)
bounding_box_9 = BoundingBox(Content=flatten(merge_7), Plane=PlaneXY(0, 0, 0), UnionBox=True)  # -> Box, Box_2
area_11 = Area(Geometry=orient_10.Geometry)  # -> Area, Centroid
area_12 = Area(Geometry=bounding_box_9.Box)  # -> Area, Centroid
guid_curve_for_sort = GuidCurveForSort(geometry=orient_10.Geometry)
polyline_5 = PolyLine(Vertices=area_11.Centroid, Closed=False)
xy_plane_5 = XYPlane(Origin=area_12.Centroid)
area_13 = Area(Geometry=surface_from_points_4)  # -> Area, Centroid
group = Group(Objects=flatten(orient_9.Geometry))
flip_plane_4 = FlipPlane(Plane=xy_plane_5, ReverseX=Toggle(False), ReverseY=Toggle(False), SwapAxes=Toggle(True))
stream_filter_3 = StreamFilter(Gate=boolean_toggle, Stream0=guid_curve_for_sort, Stream1=polyline_5)
move_17 = Move(Geometry=group, Motion=unit_y_7)  # -> Geometry, Transform
orient_16 = Orient(Geometry=merge_7, Source=flip_plane_4, Target=area_13.Centroid)  # -> Geometry, Transform
ungroup = Ungroup(Group=move_17.Geometry)

板厚_3 = Panel(板厚_mm)
division_17 = Division(A=板厚_3, B=2)
negative_12 = Negative(Value=division_17)
offset_surface_3 = OffsetSurface(Surface=graft(extrude_2), Distance=[division_17, negative_12], Retrim=True)
deconstruct_brep_13 = DeconstructBrep(Brep=offset_surface_3)  # -> Faces, Edges, Vertices
join_curves_6 = JoinCurves(Curves=deconstruct_brep_13.Edges, Preserve=False)
shift_paths_6 = ShiftPaths(Data=join_curves_6, Offset=-2)
number_slider_15 = Slider(100, range=0..100)
transform = Transform(Geometry=explode_tree_8._0010001, Transform=orient_7.Transform)
loft_3 = Loft(Curves=shift_paths_6, Options={Adjust=False, Closed=False, LoftEnds=0, LoftSimp=0, LoftType=0, Rebuild=10, Refit=0.01})
solid_intersection = SolidIntersection(BrepsA=explode_tree_8._0010000, BrepsB=orient_7.Geometry)
brep_join_3 = BrepJoin(Breps=explode_tree_8._0010000)  # -> Breps, Closed
solid_union = SolidUnion(Breps=[orient_7.Geometry, explode_tree_8._0010000])
deconstruct_plane_2 = DeconstructPlane(Plane=rotate_plane)  # -> Origin, XAxis, YAxis, ZAxis
deconstruct_brep_14 = DeconstructBrep(Brep=loft_3)  # -> Faces, Edges, Vertices
solid_intersection_2 = SolidIntersection(BrepsA=transform, BrepsB=explode_tree_8._0010001)
stream_filter_4 = StreamFilter(Gate=brep_join_3.Closed, Stream0=solid_union, Stream1=solid_intersection)
bounding_box_10 = BoundingBox(Content=flatten(ungroup), Plane=PlaneXY(0, 0, 0), UnionBox=True)  # -> Box, Box_2
amplitude_4 = Amplitude(Vector=deconstruct_plane_2.XAxis, Amplitude=number_slider_15)
amplitude_5 = Amplitude(Vector=pointb_接線ベクトル, Amplitude=number_slider_15)
amplitude_6 = Amplitude(Vector=rotate, Amplitude=接合位置_2)
list_item_31 = ListItem(List=deconstruct_brep_14.Faces, Index=0, Wrap=True)
bounding_box_11 = BoundingBox(Content=solid_intersection_2, Plane=construct_plane, UnionBox=True)  # -> Box, Box_2
volume = Volume(Geometry=bounding_box_11.Box)  # -> Volume, Centroid
bounding_box_12 = BoundingBox(Content=stream_filter_4, Plane=construct_plane_2, UnionBox=True)  # -> Box, Box_2
deconstruct_brep_15 = DeconstructBrep(Brep=bounding_box_10.Box)  # -> Faces, Edges, Vertices
move_18 = Move(Geometry=move_14.Geometry, Motion=amplitude_4)  # -> Geometry, Transform
move_19 = Move(Geometry=move_14.Geometry, Motion=amplitude_5)  # -> Geometry, Transform
deconstruct_5 = Deconstruct(Point=volume.Centroid)  # -> XComponent, YComponent, ZComponent
move_20 = Move(Geometry=construct_point_8, Motion=amplitude_6)  # -> Geometry, Transform
list_item_32 = ListItem(List=flatten(list_item_31), Index=0, Wrap=True)  # -> Item, Item1
number_slider_16 = Slider(100, range=0..100)
orient_17 = Orient(Geometry=bounding_box_12.Box, Source=align_plane.Plane, Target=xz_plane_2)  # -> Geometry, Transform
orient_18 = Orient(Geometry=bounding_box_11.Box, Source=align_plane.Plane, Target=xz_plane_2)  # -> Geometry, Transform
point_b_3 = Point(construct_point_8)
回転軸 = Line(move_10.Geometry)
panel_13 = Panel("""0
3
11""")
region_intersection = RegionIntersection(CurvesA=list_item_32.Item, CurvesB=list_item_32.Item1)
mirror_curve_2 = MirrorCurve(Geometry=point_b_3, Curve=回転軸, Tangent=True)
construct_point_12 = ConstructPoint(XCoordinate=deconstruct_5.XComponent, YCoordinate=0, ZCoordinate=deconstruct_5.ZComponent)
merge_8 = Merge(Data1=move_18.Geometry, Data2=move_14.Geometry, Data3=move_19.Geometry)
merge_9 = Merge(Data1=construct_point_8, Data2=move_20.Geometry, Data3=move_12.Geometry)
list_item_33 = ListItem(List=deconstruct_brep_15.Edges, Index=panel_13, Wrap=True)
deconstruct_brep_16 = DeconstructBrep(Brep=orient_17.Geometry)  # -> Faces, Edges, Vertices
deconstruct_brep_17 = DeconstructBrep(Brep=orient_18.Geometry)  # -> Faces, Edges, Vertices
orient_19 = Orient(Geometry=merge_8, Source=align_plane.Plane, Target=xz_plane_2)  # -> Geometry, Transform
orient_20 = Orient(Geometry=merge_9, Source=align_plane.Plane, Target=xz_plane_2)  # -> Geometry, Transform
number_slider_17 = Slider(88, range=0..100)
list_item_34 = ListItem(List=region_intersection, Index=0, Wrap=True)
line_dimension = LineDimension(Line=list_item_33, Text="{0:0.0}mm", Size=number_slider_16)
orient_21 = Orient(Geometry=[construct_point_12, mirror_curve_2], Source=align_plane.Plane, Target=xz_plane_2)  # -> Geometry, Transform
bounding_box_13 = BoundingBox(Content=list_item_34, Plane=construct_plane)  # -> Box, Box_2
list_item_35 = ListItem(List=deconstruct_brep_16.Edges, Index="6", Wrap=True)
list_item_36 = ListItem(List=deconstruct_brep_17.Edges, Index="6", Wrap=True)
list_item_37 = ListItem(List=orient_19.Geometry, Index=0, Wrap=True)  # -> Item, Item1, Item2
list_item_38 = ListItem(List=orient_20.Geometry, Index=0, Wrap=True)  # -> Item, Item1, Item2
list_item_39 = ListItem(List=flatten(orient_21.Geometry), Index=0, Wrap=True)  # -> Item, Item1
orient_22 = Orient(Geometry=bounding_box_13.Box, Source=align_plane.Plane, Target=xz_plane_2)  # -> Geometry, Transform
angular_dimension = AngularDimension(
    Center=list_item_37.Item1,
    PointA=list_item_37.Item,
    PointB=list_item_37.Item2,
    Reflex=False,
    Text="{0:0.0}°",
    Size=number_slider_17)
angular_dimension_2 = AngularDimension(
    Center=list_item_38.Item,
    PointA=list_item_38.Item1,
    PointB=list_item_38.Item2,
    Reflex=False,
    Text="{0:0.0}°",
    Size=number_slider_17)
line_dimension_2 = LineDimension(Line=list_item_36, Text="{0:0.0}mm", Size=Slider(34, range=0..100))
line_dimension_3 = LineDimension(Line=list_item_35, Text="{0:0.0}mm", Size=Slider(34, range=0..100))
vector_2pt_3 = Vector2Pt(PointA=list_item_39.Item, PointB=list_item_39.Item1, Unitize=False)  # -> Vector, Length
deconstruct_brep_18 = DeconstructBrep(Brep=orient_22.Geometry)  # -> Faces, Edges, Vertices
construct_plane_4 = ConstructPlane(Origin=list_item_39.Item, XAxis=vector_2pt_3.Vector, YAxis=Vector(0, 1, 0))
number_slider_18 = Slider(34, range=0..100)
list_item_40 = ListItem(List=deconstruct_brep_18.Edges, Index="6", Wrap=True)
aligned_dimension = AlignedDimension(
    Plane=construct_plane_4,
    PointA=list_item_39.Item,
    PointB=list_item_39.Item1,
    Offset=1,
    Text="{0:0.00}",
    Size=number_slider_18)
line_dimension_4 = LineDimension(Line=list_item_40, Text="{0:0.0}mm", Size=number_slider_18)

point_in_curve_2 = PointInCurve(Point=orient_16.Geometry, Curve=surface_from_points_4)  # -> Relationship, Point
orient_23 = Orient(Geometry=孔, Source=孔の中心, Target=orient_16.Geometry)  # -> Geometry, Transform
volume_2 = Volume(Geometry=pipe)  # -> Volume, Centroid
equality_3 = Equality(FirstNumber=point_in_curve_2.Relationship, SecondNumber=2)  # -> Equality, Inequality

geometry_15 = Geometry(ungroup)

list_item_41 = ListItem(List=flatten(volume_2.Centroid), Index=0, Wrap=True)  # -> Item, Item1
cull_pattern_2 = CullPattern(List=orient_16.Geometry, CullPattern=equality_3.Equality)
deconstruct_6 = Deconstruct(Point=list_item_41.Item1)  # -> XComponent, YComponent, ZComponent
construct_point_13 = ConstructPoint(XCoordinate=deconstruct_6.XComponent, YCoordinate=0, ZCoordinate=deconstruct_6.ZComponent)

異部材接合角度_3 = Panel(division_9)
同部材接合角度_2 = Panel(同部材接合角度)
高さ_4 = Panel(dimensions.VDimension)
幅_4 = Panel(dimensions.UDimension)
a = Panel(number_slider_6)
b = Panel(number_slider_7)
a_2 = Panel(number_slider_9)
b_2 = Panel(number_slider_8)
format = Format(
    Format="{0}mm {1}mm {2}°　{3}°　{4}/{5}h {6}/{7}w",
    Culture=127,
    Data0=高さ_4,
    Data1=幅_4,
    Data2=同部材接合角度_2,
    Data3=異部材接合角度_3,
    Data4=a,
    Data5=b,
    Data6=a_2,
    Data7=b_2)

孔同士の横方向の距離_w_4 = Panel(孔同士の横方向の距離_w)
孔同士の縦方向の距離_h_5 = Panel(孔同士の縦方向の距離_h)
異部材接合角度_4 = Panel(division_9)
同部材接合角度_3 = Panel(同部材接合角度)
高さ_5 = Panel(dimensions.VDimension)
幅_5 = Panel(dimensions.UDimension)
format_2 = Format(
    Format="{0}mm {1}mm {2}°　{3}°　h:{4}mm w:{5}mm",
    Culture=127,
    Data0=高さ_5,
    Data1=幅_5,
    Data2=同部材接合角度_3,
    Data3=異部材接合角度_4,
    Data4=孔同士の横方向の距離_w_4,
    Data5=孔同士の縦方向の距離_h_5)

panel_14 = Panel(format_2)
flip_matrix_2 = FlipMatrix(Data=orient_10.Geometry)
cull_index_2 = CullIndex(List=flip_matrix_2, Indices=panel_4, Wrap=True)
list_item_42 = ListItem(List=flip_matrix_2, Index=0, Wrap=True)  # -> Item1, Item

panel_15 = Panel(format)
create_modify_layers_2 = CreateModifyLayers(LayerName=format_2, DeleteLayer=Toggle(True), enableFullPath=False)  # -> LayerNames, LayerFullPath
counter = Counter(Trigger=create_modify_layers_2.LayerNames, Reset=Button())
createattributes_2 = CreateAttributes(LayerName=create_modify_layers_2.LayerNames, GroupIndices=counter, enableFullPath=False)
text_tag_3d_4 = TextTag3D(Location=list_item_14, Text=create_modify_layers_2.LayerNames, Size=Slider(10, range=0..10), Justification=7)

distance_2 = Distance(PointA=construct_point_13, PointB=construct_point_12)
region_difference = RegionDifference(CurvesA=boundary_surfaces_3, CurvesB=flatten([list_item_42.Item1, list_item_42.Item]))
boundary_surfaces_5 = BoundarySurfaces(Edges=cull_index_2)
surface_split_2 = SurfaceSplit(Surface=region_difference, Curves=flatten(boundary_surfaces_5))
area_14 = Area(Geometry=surface_split_2)  # -> Area, Centroid
list_length_5 = ListLength(List=surface_split_2)
series_14 = Series(Start=0, Step=1, Count=list_length_5)
sort_list_3 = SortList(Keys=area_14.Area, ValuesValuesA=series_14)  # -> Keys, ValuesValuesA
list_item_43 = ListItem(List=surface_split_2, Index=sort_list_3.ValuesValuesA, Wrap=True)

series_15 = Series(Start=Slider(235, range=0..1000), Step=Slider(178, range=0..1000), Count=Slider(5, range=0..10))
list_item_44 = ListItem(List=list_item_33, Index=0, Wrap=True)
panel_17 = Panel("""異部材接合角度
同部材接合角度""")
同部材接合角度_4 = Panel(同部材接合角度)
異部材接合角度_5 = Panel(異部材接合角度)
panel_18 = Panel("""板厚
切り欠き長さ
板幅""")
merge_10 = Merge(Data1=板厚_mm, Data2=切り欠き長さ_mm, Data3=addition_7)
unit_y_12 = UnitY(Factor=expr("-x", series_15))
curve_middle_7 = CurveMiddle(Curve=list_item_44)
format_3 = Format(Format="{0} {1}°", Culture=127, Data0=panel_17, Data1=[異部材接合角度_5, 同部材接合角度_4])
format_4 = Format(Format="{0} {1:0.0}mm", Culture=127, Data0=panel_18, Data1=merge_10)
move_21 = Move(Geometry=curve_middle_7, Motion=unit_y_12)  # -> Geometry, Transform
text_tag_3d_5 = TextTag3D(Location=move_21.Geometry, Text=[format_3, format_4], Size=number_slider_16, Justification=8)

list_item_45 = ListItem(List=reverse(list_item_43), Index=0, Wrap=True)
brep_wireframe_2 = BrepWireframe(Brep=list_item_45, Density=-1)
distance_3 = Distance(PointA=mirror_curve_2, PointB=construct_point_12)
length = Length(Curve=list_item_40)
length_2 = Length(Curve=list_item_35)

# ----
# 内側部材の切り欠き作成
加工用オフセット = Panel(加工用接合部オフセット)
同部材接合幅_内側 = Panel(length_2)
異部材接合幅 = Panel(length)
bending加工なし長さ_余し_4 = Panel(subtraction_5)
接合位置_内側 = Panel(接合位置_mm_xds)
addition_15 = Addition(A=異部材接合幅, B=加工用オフセット)
addition_16 = Addition(A=同部材接合幅_内側, B=加工用オフセット)
余し_mm = Panel(expression_12)
subtraction_11 = Subtraction(A=bending加工なし長さ_余し_4, B=接合位置_内側)
entwine_9 = Entwine(Branch00=addition_15, Branch01=addition_16, FlattenInputs=True)
unit_y_13 = UnitY(Factor=flatten([余し_mm, subtraction_11]))
expression_17 = Expression(x=entwine_9, Expression="Format(\"{0:0.00}\", x)")
部材幅_2 = Panel(list_item_10.Item1)
move_22 = Move(Geometry=closest_point.ClosestPoint, Motion=unit_y_13)  # -> Geometry, Transform
切り欠き長さ_4 = Panel(切り欠き長さ_mm)
division_18 = Division(A=部材幅_2, B=2)
unit_x_5 = UnitX(Factor=1)
division_19 = Division(A=expression_17, B=2)
merge_11 = Merge(Data1=切り欠き長さ_4, Data2=division_18)  # -> flatten(Result)
negative_13 = Negative(Value=division_19)
line_sdl_4 = LineSDL(Start=move_22.Geometry, Direction=unit_x_5, Length=merge_11)  # -> graft(Line)
unit_y_14 = UnitY(Factor=negative_13)  # -> simplify(UnitVector)
unit_y_15 = UnitY(Factor=expression_17)  # -> simplify(UnitVector)
move_23 = Move(Geometry=line_sdl_4, Motion=unit_y_14)  # -> Geometry, Transform
extrude_5 = Extrude(Base=move_23.Geometry, Direction=unit_y_15)
number_slider_19 = Slider(180, range=0..1000)
area_15 = Area(Geometry=list_item_13)  # -> Area, Centroid
rotate_2 = Rotate(Geometry=extrude_5, Angle=degrees(number_slider_19), Plane=area_15.Centroid)  # -> Geometry, Transform
unit_y_16 = UnitY(Factor=1)
explode_tree_10 = ExplodeTree(Data=extrude_5)  # -> _00100000, _00100001
explode_tree_11 = ExplodeTree(Data=rotate_2.Geometry)  # -> _00100000, _00100001
line_sdl_5 = LineSDL(Start=area_15.Centroid, Direction=unit_y_16, Length=number_slider_19)
mirror_curve_3 = MirrorCurve(Geometry=[explode_tree_10._00100000, explode_tree_11._00100000], Curve=line_sdl_5, Tangent=True)
merge_12 = Merge(
    Data1=explode_tree_10._00100000,
    Data2=explode_tree_10._00100001,
    Data3=mirror_curve_3,
    Data4=explode_tree_11._00100001,
    Data5=explode_tree_11._00100000)  # -> flatten(Result)
region_difference_2 = RegionDifference(CurvesA=boundary_surfaces_4, CurvesB=merge_12)

panel_19 = Panel(expression_17)
length_3 = Length(Curve=list_item_36)

# ----
# 外側部材の切り欠き作成
同部材接合幅_外側 = Panel(length_3)
異部材接合幅_2 = Panel(length)
加工用オフセット_2 = Panel(加工用接合部オフセット)
addition_17 = Addition(A=同部材接合幅_外側, B=加工用オフセット_2)
addition_18 = Addition(A=異部材接合幅_2, B=加工用オフセット_2)
entwine_10 = Entwine(Branch00=addition_17, Branch01=addition_18, FlattenInputs=True)
bending加工なし長さ_余し_5 = Panel(subtraction_5)
接合位置_外側 = Panel(distance_3)
余し_mm_2 = Panel(expression_12)
expression_18 = Expression(x=entwine_10, Expression="Format(\"{0:0.00}\", x)")
subtraction_12 = Subtraction(A=bending加工なし長さ_余し_5, B=接合位置_外側)
unit_y_17 = UnitY(Factor=flatten([余し_mm_2, subtraction_12]))
division_20 = Division(A=expression_18, B=2)
move_24 = Move(Geometry=closest_point.ClosestPoint, Motion=unit_y_17)  # -> Geometry, Transform
negative_14 = Negative(Value=division_20)
line_sdl_6 = LineSDL(Start=move_24.Geometry, Direction=unit_x_5, Length=merge_11)  # -> graft(Line)
unit_y_18 = UnitY(Factor=negative_14)  # -> simplify(UnitVector)
unit_y_19 = UnitY(Factor=expression_18)  # -> simplify(UnitVector)
move_25 = Move(Geometry=line_sdl_6, Motion=unit_y_18)  # -> Geometry, Transform
extrude_6 = Extrude(Base=move_25.Geometry, Direction=unit_y_19)
rotate_3 = Rotate(Geometry=extrude_6, Angle=degrees(number_slider_19), Plane=area_15.Centroid)  # -> Geometry, Transform
explode_tree_12 = ExplodeTree(Data=extrude_6)  # -> _00100000, _00100001
explode_tree_13 = ExplodeTree(Data=rotate_3.Geometry)  # -> _00100000, _00100001
mirror_curve_4 = MirrorCurve(Geometry=[explode_tree_12._00100000, explode_tree_13._00100000], Curve=line_sdl_5, Tangent=True)
merge_13 = Merge(
    Data1=explode_tree_12._00100000,
    Data2=explode_tree_12._00100001,
    Data3=mirror_curve_4,
    Data4=explode_tree_13._00100001,
    Data5=explode_tree_13._00100000)  # -> flatten(Result)
region_difference_3 = RegionDifference(CurvesA=boundary_surfaces_4, CurvesB=merge_13)
stream_filter_5 = StreamFilter(Gate=Toggle(False), Stream0=region_difference_2, Stream1=region_difference_3)
boundary_surfaces_6 = BoundarySurfaces(Edges=stream_filter_5)
extrude_7 = Extrude(Base=list_item_45, Direction=unit_z_3)
join_curves_7 = JoinCurves(Curves=brep_wireframe_2, Preserve=False)
area_16 = Area(Geometry=join_curves_7)  # -> Area, Centroid
sort_along_curve_3 = SortAlongCurve(Points=area_16.Centroid, Curve=stream_filter_3)  # -> Points, Indices
list_item_46 = ListItem(List=join_curves_7, Index=sort_along_curve_3.Indices, Wrap=True)
bake_geometry = BakeGeometry(Bake=Button(), Geometry=extrude_7, Attributes=createattributes_2, DeleteOldBakes=False, PreserveTrees=False)

# ----
# 加工データ
geometry_16 = Geometry(list_item_46)

# ----
# レーザー加工用データ
number_slider_20 = Slider(6, range=0..10)
division_21 = Division(A="1", B=number_slider_20)
negative_15 = Negative(Value=Slider(392, range=0..2000))
scale = Scale(Geometry=flatten(geometry_16), Center=Point(0, 0, 0), Factor=division_21)  # -> Geometry, Transform
unit_x_6 = UnitX(Factor=negative_15)
move_26 = Move(Geometry=scale.Geometry, Motion=unit_x_6)  # -> Geometry, Transform
geometry_17 = Geometry(move_26.Geometry)

pointa_接線ベクトル_4 = Vector(rotate)
deconstruct_vector_2 = DeconstructVector(Vector=pointa_接線ベクトル_4)  # -> XComponent, YComponent, ZComponent
同部材接合位置_内側 = Panel(distance_3)
negative_16 = Negative(Value=deconstruct_vector_2.ZComponent)
mirror_curve_5 = MirrorCurve(Geometry=[point_a, point_b], Curve=move_10.Geometry, Tangent=True)
vector_xyz_9 = VectorXYZ(XComponent=deconstruct_vector_2.XComponent, YComponent=0, ZComponent=negative_16)  # -> Vector, Length
list_item_47 = ListItem(List=mirror_curve_5, Index=0, Wrap=True)  # -> Item, Item1
pointa_接線ベクトル_5 = Vector(rotate)
addition_19 = Addition(A=同部材接合位置_内側, B=Slider(0, range=0..3))
amplitude_7 = Amplitude(Vector=expr("-x", pointa_接線ベクトル_5), Amplitude=addition_19)
amplitude_8 = Amplitude(Vector=vector_xyz_9.Vector, Amplitude=addition_19)
negative_17 = Negative(Value=amplitude_8)
negative_18 = Negative(Value=amplitude_7)
point_b_4 = Point(list_item_47.Item)
point_a_3 = Point(list_item_47.Item1)
move_27 = Move(Geometry=point_a_3, Motion=negative_18)  # -> Geometry, Transform
move_28 = Move(Geometry=point_b_4, Motion=negative_17)  # -> Geometry, Transform
板厚方向ベクトル_2 = Vector(vector_xyz_5.Vector)
division_22 = Division(A=板厚方向ベクトル_2, B=2)
move_29 = Move(Geometry=move_27.Geometry, Motion=division_22)  # -> Geometry, Transform
move_30 = Move(Geometry=move_28.Geometry, Motion=division_22)  # -> Geometry, Transform
pointb_接線ベクトル_2 = Vector(amplitude_3)
pointa_接線ベクトル_6 = Vector(rotate)
construct_plane_5 = ConstructPlane(Origin=move_29.Geometry, XAxis=pointa_接線ベクトル_6, YAxis=unit_z)
construct_plane_6 = ConstructPlane(Origin=move_30.Geometry, XAxis=pointb_接線ベクトル_2, YAxis=unit_z)

loft_4 = Loft(
    Curves=[flip_curve.Curve, project_4],
    Options={Adjust=False, Closed=False, LoftEnds=0, LoftSimp=0, LoftType=0, Rebuild=10, Refit=0.01})

余し = Slider(0, range=0..3)
orient_24 = Orient(Geometry=[construct_plane_5, construct_plane_6], Source=list_item_30, Target=list_item_27.Item)  # -> Geometry, Transform
同部材接合部幅_外側 = Panel(length_3)
同部材接合部幅_内側 = Panel(length_2)
data_8 = Data(orient_24.Geometry)
expression_19 = Expression(w=同部材接合部幅_外側, rem=余し, Expression="(w+rem)/2")
data_9 = Data(orient_13.Geometry)
expression_20 = Expression(w=同部材接合部幅_内側, rem=余し, Expression="(w+rem)/2")
deconstruct_plane_3 = DeconstructPlane(Plane=data_8)  # -> Origin, XAxis, YAxis, ZAxis
deconstruct_plane_4 = DeconstructPlane(Plane=data_9)  # -> Origin, XAxis, YAxis, ZAxis
amplitude_9 = Amplitude(Vector=deconstruct_plane_3.XAxis, Amplitude=expression_19)
amplitude_10 = Amplitude(Vector=deconstruct_plane_4.XAxis, Amplitude=expression_20)
negative_19 = Negative(Value=amplitude_9)
length_4 = Length(Curve=deconstruct_brep_10.Edges)
negative_20 = Negative(Value=amplitude_10)
move_31 = Move(Geometry=data_8, Motion=negative_19)  # -> Geometry, Transform
move_32 = Move(Geometry=data_8, Motion=amplitude_9)  # -> Geometry, Transform
move_33 = Move(Geometry=data_9, Motion=negative_20)  # -> Geometry, Transform
move_34 = Move(Geometry=data_9, Motion=amplitude_10)  # -> Geometry, Transform
sort_list_4 = SortList(Keys=length_4)  # -> Keys, ValuesValuesA
unit_x_7 = UnitX(Factor=1)
negative_21 = Negative(Value=unit_x_7)
list_item_48 = ListItem(List=reverse(sort_list_4.Keys), Index=0, Wrap=True)
merge_14 = Merge(Data1=move_34.Geometry, Data2=move_33.Geometry)
merge_15 = Merge(Data1=move_32.Geometry, Data2=move_31.Geometry)
longest_list_2 = LongestList(ListListA=merge_15, ListListB=[unit_x_7, negative_21], PaddingMode=4)  # -> ListListA, ListListB
division_23 = Division(A=list_item_48, B=1.8)
line_sdl_7 = LineSDL(Start=merge_15, Direction=reverse(longest_list_2.ListListB), Length=division_23)
line_sdl_8 = LineSDL(Start=merge_14, Direction=longest_list_2.ListListB, Length=division_23)
dispatch_10 = Dispatch(List=line_sdl_7, DispatchPattern=[True, False])  # -> ListA, ListB
dispatch_11 = Dispatch(List=line_sdl_8, DispatchPattern=[True, False])  # -> ListA, ListB
entwine_11 = Entwine(Branch0X=dispatch_10.ListA, Branch1X=dispatch_10.ListB, FlattenInputs=False)
entwine_12 = Entwine(Branch0X=dispatch_11.ListA, Branch1X=dispatch_11.ListB, FlattenInputs=False)
construct_point_14 = ConstructPoint(XCoordinate="0.5", YCoordinate="0.5", ZCoordinate=0)
loft_5 = Loft(Curves=entwine_11, Options={Adjust=False, Closed=False, LoftEnds=0, LoftSimp=0, LoftType=0, Rebuild=10, Refit=0.01})
construct_point_15 = ConstructPoint(XCoordinate="0.5", YCoordinate="0.5", ZCoordinate=0)
loft_6 = Loft(Curves=entwine_12, Options={Adjust=False, Closed=False, LoftEnds=0, LoftSimp=0, LoftType=0, Rebuild=10, Refit=0.01})
evaluate_surface = EvaluateSurface(Surface=reparameterize(loft_5), Point=construct_point_14)  # -> Point, Normal, UDirection, VDirection, Frame
evaluate_surface_2 = EvaluateSurface(Surface=reparameterize(loft_6), Point=construct_point_15)  # -> Point, Normal, UDirection, VDirection, Frame
data_10 = Data(loft_4)
negative_22 = Negative(Value=evaluate_surface.Normal)
negative_23 = Negative(Value=evaluate_surface_2.Normal)
move_35 = Move(Geometry=loft_5, Motion=negative_22)  # -> Geometry, Transform
amplitude_11 = Amplitude(Vector=evaluate_surface.Normal, Amplitude="2")
tree_statistics_7 = TreeStatistics(Tree=data_10)  # -> Paths, Length, Count
move_36 = Move(Geometry=loft_6, Motion=negative_23)  # -> Geometry, Transform
amplitude_12 = Amplitude(Vector=evaluate_surface_2.Normal, Amplitude="2")
dispatch_12 = Dispatch(List=tree_statistics_7.Paths, DispatchPattern=[True, False])  # -> ListA, ListB
extrude_8 = Extrude(Base=move_35.Geometry, Direction=amplitude_11)
extrude_9 = Extrude(Base=move_36.Geometry, Direction=amplitude_12)
tree_branch_11 = TreeBranch(Tree=data_10, Path=dispatch_12.ListB, MaintainPaths=True)
shift_paths_7 = ShiftPaths(Data=extrude_8, Offset=Slider(1, range=0..1))
tree_branch_12 = TreeBranch(Tree=data_10, Path=dispatch_12.ListA, MaintainPaths=True)
shift_paths_8 = ShiftPaths(Data=extrude_9, Offset=Slider(1, range=0..1))
trim_solid_2 = TrimSolid(Shape=tree_branch_11, Cutters=shift_paths_7)
trim_solid_3 = TrimSolid(Shape=tree_branch_12, Cutters=shift_paths_8)
merge_16 = Merge(Data1=trim_solid_2, Data2=trim_solid_3)

list_item_49 = ListItem(List=orient_13.Geometry, Index=0, Wrap=True)  # -> Item, Item1
boolean_toggle_3 = BooleanToggle(False)
tree_statistics_8 = TreeStatistics(Tree=list_item_49.Item)  # -> Paths, Length, Count
tree_statistics_9 = TreeStatistics(Tree=list_item_49.Item)  # -> Paths, Length, Count
shift_list = ShiftList(List=tree_statistics_8.Paths, Shift="-1", Wrap=boolean_toggle_3)
shift_list_2 = ShiftList(List=tree_statistics_9.Paths, Shift=1, Wrap=boolean_toggle_3)
tree_branch_13 = TreeBranch(Tree=list_item_49.Item1, Path=shift_list, MaintainPaths=False)
tree_branch_14 = TreeBranch(Tree=list_item_49.Item, Path=shift_list_2, MaintainPaths=False)
flip_plane_5 = FlipPlane(Plane=tree_branch_13, ReverseX=Toggle(False), ReverseY=Toggle(False), SwapAxes=Toggle(False))
flip_plane_6 = FlipPlane(Plane=tree_branch_14, ReverseX=Toggle(False), ReverseY=Toggle(True), SwapAxes=Toggle(True))
部材接合角度_2 = Panel(同部材接合角度)
subtraction_13 = Subtraction(A=90, B=部材接合角度_2)
negative_24 = Negative(Value=subtraction_13)
rotate_plane_2 = RotatePlane(Plane=flip_plane_5, Angle=degrees(negative_24))

plane_3 = Plane(flip_plane_6)
plane_4 = Plane(rotate_plane_2)

ghpython_script = GhPythonScript(Geometry=simplify(orient_14.Geometry), Source=flatten(flip_plane_6), Target=flatten(rotate_plane_2))  # -> out, Geometry, Target, Source; inputs Geometry: tree of Point3d, Source: list, Target: list
# ---------- ghpython_script: Python ----------
__author__ = "Owner"
__version__ = "2021.12.04"

import rhinoscriptsyntax as rs
import ghpythonlib.treehelpers as th
import ghpythonlib.components as ghc

Geometry = th.tree_to_list(Geometry,None)

for i, init_p in enumerate(Source):
    a = ghc.Orient(geometry=Geometry[i+1],source=init_p,target=Target[i])
    Geometry[i+1] = a['geometry']
    if i < len(Source)-1:
        b = ghc.Orient(geometry=Target[i+1],source=init_p,target=Target[i])
        Target[i+1] = b['geometry']

Geometry = th.list_to_tree(Geometry,None)
Target = th.list_to_tree(Target,None)
Source = th.list_to_tree(Source,None)
# ---------- end ghpython_script ----------
tree_statistics_10 = TreeStatistics(Tree=ghpython_script.Geometry)  # -> Paths, Length, Count
panel_20 = Panel("""0
-1""")
list_item_50 = ListItem(List=tree_statistics_10.Paths, Index=panel_20, Wrap=True)
tree_branch_15 = TreeBranch(Tree=ghpython_script.Geometry, Path=list_item_50, MaintainPaths=True)
panel_21 = Panel("""1
0""")
list_item_51 = ListItem(List=tree_branch_15, Index=graft(panel_21), Wrap=True)
list_item_52 = ListItem(List=flatten(list_item_51), Index=0, Wrap=True)  # -> Item, Item1
line_8 = Line(StartPoint=list_item_52.Item, EndPoint=list_item_52.Item1)
construct_plane_7 = ConstructPlane(Origin=list_item_52.Item, XAxis=line_8, YAxis=Vector(0, 1, 0))
shift_paths_9 = ShiftPaths(Data=line_6, Offset=-1)
shift_paths_10 = ShiftPaths(Data=line_7, Offset=-1)
list_item_53 = ListItem(List=shift_paths_9, Index=0, Wrap=True)
list_item_54 = ListItem(List=shift_paths_10, Index=0, Wrap=True)
xz_plane_4 = XZPlane(Origin=Point(0, 0, 0))
list_item_55 = ListItem(List=flatten(list_item_53), Index=0, Wrap=True)  # -> Item1, Item
list_item_56 = ListItem(List=flatten(list_item_54), Index=0, Wrap=True)
flip_plane_7 = FlipPlane(Plane=construct_plane_7, ReverseX=Toggle(False), ReverseY=Toggle(False), SwapAxes=Toggle(False))
merge_17 = Merge(Data1=list_item_56, Data2=list_item_55.Item1)
orient_25 = Orient(Geometry=simplify([list_item_52.Item, list_item_52.Item1]), Source=flatten(flip_plane_7), Target=flatten(xz_plane_4))  # -> Geometry, Transform
unit_y_20 = UnitY(Factor=1)
length_5 = Length(Curve=merge_17)
negative_25 = Negative(Value=unit_y_20)
division_24 = Division(A=length_5, B=2)
line_sdl_9 = LineSDL(Start=orient_25.Geometry, Direction=graft([unit_y_20, negative_25]), Length=division_24)  # -> flatten(Line)

merge_18 = Merge(Data1=tree_branch_11, Data2=tree_branch_12)

offset_surface_4 = OffsetSurface(Surface=merge_16, Distance=flatten([division_6, negative_3]), Retrim=True)  # -> simplify(Surface)
deconstruct_brep_19 = DeconstructBrep(Brep=offset_surface_4)  # -> Faces, Edges, Vertices
join_curves_8 = JoinCurves(Curves=deconstruct_brep_19.Edges, Preserve=False)
shift_paths_11 = ShiftPaths(Data=join_curves_8, Offset=-2)
loft_7 = Loft(Curves=shift_paths_11, Options={Adjust=False, Closed=False, LoftEnds=0, LoftSimp=0, LoftType=0, Rebuild=10, Refit=0.01})
brep_join_4 = BrepJoin(Breps=[loft_7, offset_surface_4])  # -> Breps, Closed
shift_paths_12 = ShiftPaths(Data=brep_join_4.Breps, Offset=-1)
ghpython_script_2 = GhPythonScript(Geometry=simplify(shift_paths_12), Source=flatten(flip_plane_6), Target=flatten(rotate_plane_2))  # -> out, Geometry, Target, Source; inputs Geometry: tree of Brep, Source: list, Target: list
# ---------- ghpython_script_2: Python ----------
__author__ = "Owner"
__version__ = "2021.12.04"

import rhinoscriptsyntax as rs
import ghpythonlib.treehelpers as th
import ghpythonlib.components as ghc

Geometry = th.tree_to_list(Geometry,None)

for i, init_p in enumerate(Source):
    a = ghc.Orient(geometry=Geometry[i+1],source=init_p,target=Target[i])
    Geometry[i+1] = a['geometry']
    print(Geometry[i+1])
    if i < len(Source)-1:
        b = ghc.Orient(geometry=Target[i+1],source=init_p,target=Target[i])
        Target[i+1] = b['geometry']
print(Geometry)
Geometry = th.list_to_tree(Geometry,None)
Target = th.list_to_tree(Target,None)
Source = th.list_to_tree(Source,None)
# ---------- end ghpython_script_2 ----------

offset_surface_5 = OffsetSurface(Surface=merge_18, Distance=flatten([division_7, negative_4]), Retrim=True)  # -> simplify(Surface)
deconstruct_brep_20 = DeconstructBrep(Brep=offset_surface_5)  # -> Faces, Edges, Vertices
join_curves_9 = JoinCurves(Curves=deconstruct_brep_20.Edges, Preserve=False)
shift_paths_13 = ShiftPaths(Data=join_curves_9, Offset=-2)
loft_8 = Loft(Curves=shift_paths_13, Options={Adjust=False, Closed=False, LoftEnds=0, LoftSimp=0, LoftType=0, Rebuild=10, Refit=0.01})
brep_join_5 = BrepJoin(Breps=[loft_8, offset_surface_5])  # -> Breps, Closed
shift_paths_14 = ShiftPaths(Data=brep_join_5.Breps, Offset=-1)
ghpython_script_3 = GhPythonScript(Geometry=simplify(shift_paths_14), Source=flatten(flip_plane_6), Target=flatten(rotate_plane_2))  # -> out, Geometry, Target, Source; inputs Geometry: tree of Brep, Source: list, Target: list; same code as ghpython_script_2

geometry_18 = Geometry(brep_join_4.Breps)

shift_paths_15 = ShiftPaths(Data=simplify(merge_16), Offset=-1)
ghpython_script_4 = GhPythonScript(Geometry=simplify(shift_paths_15), Source=flatten(flip_plane_6), Target=flatten(rotate_plane_2))  # -> out, Geometry, Target, Source; inputs Geometry: tree of Brep, Source: list, Target: list; same code as ghpython_script_2
orient_26 = Orient(Geometry=simplify(ghpython_script_4.Geometry), Source=flatten(flip_plane_7), Target=flatten(xz_plane_4))  # -> Geometry, Transform
list_item_57 = ListItem(List=orient_26.Geometry, Index=0, Wrap=True)  # -> Item, Item1

orient_27 = Orient(Geometry=simplify(ghpython_script_3.Geometry), Source=flatten(flip_plane_7), Target=flatten(xz_plane_4))  # -> Geometry, Transform
orient_28 = Orient(Geometry=simplify(ghpython_script_2.Geometry), Source=flatten(flip_plane_7), Target=flatten(xz_plane_4))  # -> Geometry, Transform
data_11 = Data(orient_28.Geometry)
list_item_58 = ListItem(List=orient_27.Geometry, Index=0, Wrap=True)  # -> Item, Item1
list_item_59 = ListItem(List=orient_28.Geometry, Index=0, Wrap=True)  # -> Item, Item1
data_12 = Data(line_sdl_9)

join_curves_10 = JoinCurves(Curves=line_sdl_9, Preserve=False)
list_item_60 = ListItem(List=join_curves_10, Index=0, Wrap=True)  # -> Item, Item1
number_slider_21 = Slider(27, range=0..100)
boolean_toggle_4 = BooleanToggle(False)
flip_curve_3 = FlipCurve(Curve=list_item_60.Item)  # -> Curve, Flag
flip_curve_4 = FlipCurve(Curve=list_item_60.Item1)  # -> Curve, Flag
evaluate_length = EvaluateLength(Curve=[list_item_60.Item, flip_curve_3.Curve], Length=number_slider_21, Normalized=boolean_toggle_4)  # -> Point, Tangent, Parameter
evaluate_length_2 = EvaluateLength(Curve=[list_item_60.Item1, flip_curve_4.Curve], Length=number_slider_21, Normalized=boolean_toggle_4)  # -> Point, Tangent, Parameter
list_item_61 = ListItem(List=evaluate_length.Point, Index=0, Wrap=True)  # -> Item, Item1
list_item_62 = ListItem(List=evaluate_length_2.Point, Index=0, Wrap=True)  # -> Item, Item1
vector_2pt_4 = Vector2Pt(PointA=list_item_62.Item1, PointB=list_item_61.Item1, Unitize=False)  # -> Vector, Length
vector_2pt_5 = Vector2Pt(PointA=list_item_62.Item, PointB=list_item_61.Item, Unitize=False)  # -> Vector, Length
number_slider_22 = Slider(0, range=-1..1)
construct_plane_8 = ConstructPlane(Origin=list_item_62.Item1, XAxis=vector_2pt_4.Vector, YAxis=Vector(0, 1, 0))
construct_plane_9 = ConstructPlane(Origin=list_item_62.Item, XAxis=vector_2pt_5.Vector, YAxis=Vector(0, 1, 0))
negative_26 = Negative(Value=number_slider_22)
number_slider_23 = Slider(12, range=0..20)
rotate_plane_3 = RotatePlane(Plane=construct_plane_8, Angle=degrees(negative_26))
rotate_plane_4 = RotatePlane(Plane=construct_plane_9, Angle=degrees(number_slider_22))
addition_20 = Addition(A=number_slider_23, B=1)
duplicate_data = DuplicateData(Data=list_item_60.Item, Number=addition_20, Order=True)
duplicate_data_2 = DuplicateData(Data=rotate_plane_4, Number=number_slider_23, Order=True)
duplicate_data_3 = DuplicateData(Data=rotate_plane_3, Number=number_slider_23, Order=True)
ghpython_script_5 = GhPythonScript(Geometry=simplify(graft(duplicate_data)), Source=flatten(duplicate_data_2), Target=flatten(duplicate_data_3))  # -> out, Geometry, Target, Source; inputs Geometry: tree of Line, Source: list, Target: list
# ---------- ghpython_script_5: Python ----------
__author__ = "Owner"
__version__ = "2021.12.04"

import rhinoscriptsyntax as rs
import ghpythonlib.treehelpers as th
import ghpythonlib.components as ghc

Geometry = th.tree_to_list(Geometry,None)

for i, init_p in enumerate(Source):
    a = ghc.Orient(geometry=Geometry[i+1],source=init_p,target=Target[i])
    Geometry[i+1] = a['geometry']
    print(Geometry[i+1])
    if i < len(Source)-1:
        b = ghc.Orient(geometry=Target[i+1],source=init_p,target=Target[i])
        Target[i+1] = b['geometry']
print(Geometry)
Geometry = th.list_to_tree(Geometry)
Target = th.list_to_tree(Target,None)
Source = th.list_to_tree(Source,None)
# ---------- end ghpython_script_5 ----------
dispatch_13 = Dispatch(List=ghpython_script_5.Target, DispatchPattern=[True, False])  # -> ListA, ListB

duplicate_data_4 = DuplicateData(Data=list_item_60.Item1, Number=addition_20, Order=True)

list_item_63 = ListItem(List=dispatch_13.ListA, Index=0, Wrap=True)
orient_29 = Orient(Geometry=list_item_59.Item1, Source=construct_plane_9, Target=dispatch_13.ListB)  # -> Geometry, Transform
orient_30 = Orient(Geometry=list_item_59.Item, Source=construct_plane_9, Target=dispatch_13.ListA)  # -> Geometry, Transform
orient_31 = Orient(Geometry=list_item_57.Item1, Source=construct_plane_9, Target=dispatch_13.ListB)  # -> Geometry, Transform
orient_32 = Orient(Geometry=list_item_57.Item, Source=construct_plane_9, Target=list_item_63)  # -> Geometry, Transform
merge_19 = Merge(Data1=list_item_59.Item1, Data2=simplify(orient_29.Geometry))
brep_brep = BrepBrep(BrepA=orient_32.Geometry, BrepB=merge_19)  # -> Curves, Points
brep_brep_2 = BrepBrep(BrepA=orient_31.Geometry, BrepB=orient_30.Geometry)  # -> Curves, Points
explode_2 = Explode(Curve=brep_brep.Curves, Recursive=True)  # -> Segments, Vertices
explode_3 = Explode(Curve=brep_brep_2.Curves, Recursive=True)  # -> Segments, Vertices
panel_22 = Panel("""0
-1""")
panel_23 = Panel("""0
-1""")
list_item_64 = ListItem(List=explode_3.Vertices, Index=0, Wrap=True)  # -> Item, Item1, Item2, Item3
list_item_65 = ListItem(List=explode_2.Vertices, Index=0, Wrap=True)  # -> Item, Item1, Item2, Item3
list_item_66 = ListItem(List=explode_3.Segments, Index=panel_23, Wrap=True)  # -> Item, Item1
list_item_67 = ListItem(List=explode_2.Segments, Index=panel_22, Wrap=True)  # -> Item, Item1
curve_middle_8 = CurveMiddle(Curve=list_item_66.Item)
curve_middle_9 = CurveMiddle(Curve=list_item_67.Item)
polyline_6 = PolyLine(Vertices=[list_item_65.Item, curve_middle_9, list_item_65.Item3], Closed=False)
polyline_7 = PolyLine(Vertices=[list_item_64.Item, curve_middle_8, list_item_64.Item3], Closed=False)
shift_paths_16 = ShiftPaths(Data=polyline_6, Offset=-2)
shift_paths_17 = ShiftPaths(Data=polyline_7, Offset=-2)
surface_split_3 = SurfaceSplit(Surface=orient_32.Geometry, Curves=shift_paths_16)
surface_split_4 = SurfaceSplit(Surface=orient_31.Geometry, Curves=shift_paths_17)
list_item_68 = ListItem(List=surface_split_3, Index=0, Wrap=True)
list_item_69 = ListItem(List=surface_split_4, Index=0, Wrap=True)

orient_33 = Orient(Geometry=list_item_59.Item1, Source=construct_plane_9, Target=dispatch_13.ListB)  # -> Geometry, Transform
list_item_70 = ListItem(List=orient_30.Geometry, Index=0, Wrap=True)
list_item_71 = ListItem(List=orient_29.Geometry, Index=0, Wrap=True)

# ----
# 寸法表示
geometry_19 = Geometry(orient_28.Geometry)
bounding_box_14 = BoundingBox(Content=flatten(geometry_19), Plane=PlaneXY(0, 0, 0), UnionBox=True)  # -> Box, Box_2
bounding_box_15 = BoundingBox(Content=geometry_19, Plane=PlaneXY(0, 0, 0), UnionBox=True)  # -> Box, Box_2
unit_y_21 = UnitY(Factor=1)
xz_plane_5 = XZPlane(Origin=Point(0, 0, 0))
project_along = ProjectAlong(Geometry=bounding_box_14.Box, Plane=xz_plane_5, Direction=unit_y_21)  # -> Geometry, Transform
project_along_2 = ProjectAlong(Geometry=bounding_box_15.Box, Plane=xz_plane_5, Direction=unit_y_21)  # -> Geometry, Transform
brep_wireframe_3 = BrepWireframe(Brep=project_along.Geometry, Density=-1)
brep_wireframe_4 = BrepWireframe(Brep=project_along_2.Geometry, Density=-1)
clean_tree = CleanTree(RemoveNulls=True, RemoveInvalid=True, RemoveEmpty=False, Tree=brep_wireframe_3)
explode_4 = Explode(Curve=brep_wireframe_4, Recursive=True)  # -> Segments, Vertices
removeduplicatelines_2 = RemoveDuplicateLines(Lines=clean_tree, Tolerance=0.01)
shift_paths_18 = ShiftPaths(Data=explode_4.Segments, Offset=-1)
clean_tree_2 = CleanTree(RemoveNulls=True, RemoveInvalid=True, RemoveEmpty=False, Tree=shift_paths_18)
join_curves_11 = JoinCurves(Curves=removeduplicatelines_2, Preserve=False)
removeduplicatelines_3 = RemoveDuplicateLines(Lines=clean_tree_2, Tolerance=0.01)
join_curves_12 = JoinCurves(Curves=removeduplicatelines_3, Preserve=False)
region_union = RegionUnion(Curves=flatten(join_curves_12))
region_difference_4 = RegionDifference(CurvesA=join_curves_11, CurvesB=region_union)
area_17 = Area(Geometry=region_difference_4)  # -> Area, Centroid
sort_list_5 = SortList(Keys=area_17.Area, ValuesValuesA=region_difference_4)  # -> Keys, ValuesValuesA
list_item_72 = ListItem(List=reverse(sort_list_5.ValuesValuesA), Index=0, Wrap=True)
control_points = ControlPoints(Curve=list_item_72)  # -> Points, Weights, Knots
panel_24 = Panel("""0
1""")
cull_pattern_3 = CullPattern(List=control_points.Points, CullPattern=panel_24)
deconstruct_7 = Deconstruct(Point=cull_pattern_3)  # -> XComponent, YComponent, ZComponent

panel_25 = Panel(number_slider_21)

data_dam = DataDam(DataDataA=vector_2pt_4.Vector, BufferDelay=10000000, BufferMode=0)
data_dam_2 = DataDam(DataDataA=vector_2pt_5.Vector, BufferDelay=10000000, BufferMode=0)
data_dam_3 = DataDam(DataDataA=panel_25, BufferDelay=10000000, BufferMode=0)

# ----
# 形状全体寸法
deconstruct_brep_21 = DeconstructBrep(Brep=bounding_box_14.Box)  # -> Faces, Edges, Vertices
panel_26 = Panel("""0
3
11""")
list_item_73 = ListItem(List=deconstruct_brep_21.Edges, Index=panel_26, Wrap=True)
line_dimension_5 = LineDimension(Line=list_item_73, Text="{0:0.0}mm", Size=Slider(52, range=0..100))

# ----
# ShopBot加工用データ 作成
unroll_brep = UnrollBrep(Brep=list_item_68, JoinUnrolled=False)
unroll_brep_2 = UnrollBrep(Brep=list_item_69, JoinUnrolled=False)
entwine_13 = Entwine(Branch0X=unroll_brep, Branch1X=unroll_brep_2, FlattenInputs=False)
brep_wireframe_5 = BrepWireframe(Brep=entwine_13, Density=-1)
xy_plane_6 = XYPlane(Origin=Point(0, 0, 0))
is_planar = IsPlanar(Surface=entwine_13, Interior=True)  # -> Planar, Plane
flip_plane_8 = FlipPlane(Plane=xy_plane_6, ReverseX=Toggle(False), ReverseY=Toggle(False), SwapAxes=Toggle(False))
join_curves_13 = JoinCurves(Curves=brep_wireframe_5, Preserve=False)
orient_34 = Orient(Geometry=join_curves_13, Source=is_planar.Plane, Target=flip_plane_8)  # -> Geometry, Transform

# ----
# フィレットの作成
hull = Hull(Brep=orient_34.Geometry)  # -> Geo, Projected, Hull, Plane, Plane_2
brep_wireframe_6 = BrepWireframe(Brep=orient_34.Geometry, Density=-1)
area_18 = Area(Geometry=hull.Hull)  # -> Area, Centroid
scale_2 = Scale(Geometry=hull.Hull, Center=area_18.Centroid, Factor=Slider(0.97, range=0..1))  # -> Geometry, Transform
curve_middle_10 = CurveMiddle(Curve=brep_wireframe_6)
point_in_curve_3 = PointInCurve(Point=simplify(curve_middle_10), Curve=simplify(scale_2.Geometry))  # -> Relationship, Point
equality_4 = Equality(FirstNumber=point_in_curve_3.Relationship, SecondNumber=Slider(2, range=0..2))  # -> Equality, Inequality
mill径 = Slider(6.35, range=0..30)
dispatch_14 = Dispatch(List=brep_wireframe_6, DispatchPattern=equality_4.Equality)  # -> ListA, simplify(ListB)
division_25 = Division(A=mill径, B=2)
join_curves_14 = JoinCurves(Curves=dispatch_14.ListA, Preserve=False)
fillet = Fillet(Curve=join_curves_14, Radius=division_25)  # -> simplify(Curve)
join_curves_15 = JoinCurves(Curves=[dispatch_14.ListB, fillet], Preserve=False)

# ----
# 孔形状の配置
許容値 = Slider(100, range=0..100)
geometry_20 = Geometry(orient_8.Geometry)
bounding_box_16 = BoundingBox(Content=geometry_20, Plane=PlaneXY(0, 0, 0), UnionBox=True)  # -> Box, Box_2
addition_21 = Addition(A=板幅_mm_2, B=許容値)
division_26 = Division(A=addition_21, B=2)
division_27 = Division(A=部材縦幅_bending加工, B=2)
area_19 = Area(Geometry=bounding_box_16.Box)  # -> Area, Centroid
negative_27 = Negative(Value=division_26)
negative_28 = Negative(Value=division_27)
orient_35 = Orient(Geometry=geometry_20, Source=area_19.Centroid, Target=xy_plane_6)  # -> simplify(Geometry), Transform
construct_domain_2 = ConstructDomain(DomainStart=negative_27, DomainEnd=division_26)
construct_domain_3 = ConstructDomain(DomainStart=negative_28, DomainEnd=division_27)
area_20 = Area(Geometry=orient_35.Geometry)  # -> Area, Centroid
rectangle_3 = Rectangle(Plane=xy_plane_6, XSize=construct_domain_2, YSize=construct_domain_3, Radius=0)  # -> Rectangle, Length
point_in_curve_4 = PointInCurve(Point=area_20.Centroid, Curve=rectangle_3.Rectangle)  # -> Relationship, Point
equality_5 = Equality(FirstNumber=point_in_curve_4.Relationship, SecondNumber=Slider(2, range=0..10))  # -> Equality, Inequality
cull_pattern_4 = CullPattern(List=orient_35.Geometry, CullPattern=equality_5.Equality)

data_dam_4 = DataDam(DataDataA=orient_34.Geometry, BufferDelay=10000000, BufferMode=0)

# ----
# Tボーンの作成
angle_2 = Angle(VectorA=data_dam, VectorB=data_dam_2)  # -> Angle, Reflex
bounding_box_17 = BoundingBox(Content=data_dam_4, Plane=PlaneXY(0, 0, 0), UnionBox=True)  # -> Box, Box_2
dimensions_7 = Dimensions(Surface=bounding_box_17.Box)  # -> UDimension, VDimension
expression_21 = Expression(L=data_dam_3, r=angle_2.Angle, Expression="L*cos(r)")
addition_22 = Addition(A=expression_21, B=Slider(26.17, range=-10..50))
construct_domain_4 = ConstructDomain(DomainStart=0, DomainEnd=dimensions_7.UDimension)
panel_27 = Panel(expression_21)
subtraction_14 = Subtraction(A=dimensions_7.UDimension, B=addition_22)
remap_numbers_2 = RemapNumbers(Value=subtraction_14, Source=construct_domain_4, Target=Domain(0, 1))  # -> Mapped, Clipped
area_21 = Area(Geometry=bounding_box_17.Box)  # -> Area, Centroid
scale_nu_2 = ScaleNU(
    Geometry=bounding_box_17.Box,
    Plane=area_21.Centroid,
    ScaleX=remap_numbers_2.Mapped,
    ScaleY=Slider(0.87, range=0..1),
    ScaleZ=1)  # -> Geometry, Transform
brep_wireframe_7 = BrepWireframe(Brep=scale_nu_2.Geometry, Density=-1)
discontinuity_4 = Discontinuity(Curve=data_dam_4, Level=1)  # -> Points, Parameters
join_curves_16 = JoinCurves(Curves=brep_wireframe_7, Preserve=False)
point_in_curve_5 = PointInCurve(Point=discontinuity_4.Points, Curve=join_curves_16)  # -> Relationship, Point
equality_6 = Equality(FirstNumber=point_in_curve_5.Relationship, SecondNumber=Slider(2, range=0..2))  # -> Equality, Inequality
cull_pattern_5 = CullPattern(List=discontinuity_4.Points, CullPattern=equality_6.Equality)
closest_points = ClosestPoints(Point=cull_pattern_5, Cloud=cull_pattern_5, Count=Slider(2, range=0..10))  # -> ClosestPoint, CPIndex, Distance
list_item_74 = ListItem(List=closest_points.ClosestPoint, Index="1", Wrap=True)
shift_paths_19 = ShiftPaths(Data=list_item_74, Offset=-1)
line_9 = Line(StartPoint=cull_pattern_5, EndPoint=shift_paths_19)
removeduplicatelines_4 = RemoveDuplicateLines(Lines=line_9, Tolerance=0.01)
brep_wireframe_8 = BrepWireframe(Brep=data_dam_4, Density=-1)
curve_middle_11 = CurveMiddle(Curve=removeduplicatelines_4)  # -> simplify(Midpoint)
curve_middle_12 = CurveMiddle(Curve=brep_wireframe_8)
mill径_2 = Slider(6.35, range=0..30)
closest_point_4 = ClosestPoint(Point=curve_middle_11, Cloud=simplify(curve_middle_12))  # -> ClosestPoint, CPIndex, Distance
division_28 = Division(A=mill径_2, B=2)
list_item_75 = ListItem(List=brep_wireframe_8, Index=closest_point_4.CPIndex, Wrap=True)
circle_2 = Circle(Plane=cull_pattern_5, Radius=division_28)
evaluate_curve_2 = EvaluateCurve(Curve=reparameterize(list_item_75), Parameter="0")  # -> Point, Tangent, Angle
evaluate_curve_3 = EvaluateCurve(Curve=reparameterize(list_item_75), Parameter="1")  # -> Point, Tangent, Angle
closest_point_5 = ClosestPoint(Point=evaluate_curve_2.Point, Cloud=simplify(cull_pattern_5))  # -> ClosestPoint, CPIndex, Distance
closest_point_6 = ClosestPoint(Point=evaluate_curve_3.Point, Cloud=simplify(cull_pattern_5))  # -> ClosestPoint, CPIndex, Distance
negative_29 = Negative(Value=evaluate_curve_3.Tangent)
multiplication_6 = Multiplication(A=evaluate_curve_2.Tangent, B=division_28)
multiplication_7 = Multiplication(A=negative_29, B=division_28)
list_item_76 = ListItem(List=circle_2, Index=closest_point_6.CPIndex, Wrap=True)
list_item_77 = ListItem(List=circle_2, Index=closest_point_5.CPIndex, Wrap=True)
move_37 = Move(Geometry=list_item_77, Motion=multiplication_6)  # -> Geometry, Transform
move_38 = Move(Geometry=list_item_76, Motion=multiplication_7)  # -> Geometry, Transform
region_union_2 = RegionUnion(Curves=[move_37.Geometry, move_38.Geometry])
surface_split_5 = SurfaceSplit(Surface=data_dam_4, Curves=region_union_2)
list_length_6 = ListLength(List=surface_split_5)
area_22 = Area(Geometry=surface_split_5)  # -> Area, Centroid
series_16 = Series(Start=0, Step=1, Count=list_length_6)
sort_list_6 = SortList(Keys=area_22.Area, ValuesValuesA=series_16)  # -> Keys, ValuesValuesA
list_item_78 = ListItem(List=reverse(sort_list_6.ValuesValuesA), Index=0, Wrap=True)
list_item_79 = ListItem(List=surface_split_5, Index=list_item_78, Wrap=True)

shift_paths_20 = ShiftPaths(Data=join_curves_15, Offset="-2")
explode_tree_14 = ExplodeTree(Data=shift_paths_20)  # -> graft(Branch0), graft(Branch1)
surface_split_6 = SurfaceSplit(Surface=explode_tree_14.Branch0, Curves=cull_pattern_4)
surface_split_7 = SurfaceSplit(Surface=explode_tree_14.Branch1, Curves=cull_pattern_4)
merge_20 = Merge(Data1=surface_split_6, Data2=surface_split_7)
list_length_7 = ListLength(List=merge_20)
area_23 = Area(Geometry=merge_20)  # -> Area, Centroid
series_17 = Series(Start=0, Step=1, Count=list_length_7)
sort_list_7 = SortList(Keys=area_23.Area, ValuesValuesA=series_17)  # -> Keys, ValuesValuesA
list_item_80 = ListItem(List=merge_20, Index=reverse(sort_list_7.ValuesValuesA), Wrap=True)
list_item_81 = ListItem(List=list_item_80, Index=0, Wrap=True)

# ----
# レーザー加工用データ　sort ガイド線
area_24 = Area(Geometry=cull_pattern_4)  # -> Area, Centroid
polyline_8 = PolyLine(Vertices=area_24.Centroid, Closed=False)
path_mapper_2 = PathMapper(polyline_8, source=["{i}", "{i}"], target=["{0;i}", "{1;i}"])

# ----
# 部材重量計算(一列あたり)
area_25 = Area(Geometry=list_item_81)  # -> Area, Centroid
shift_paths_21 = ShiftPaths(Data=simplify(area_25.Area), Offset=-1)
mass_addition = MassAddition(Input=shift_paths_21)  # -> flatten(Result), PartialResults
power_of_10 = PowerOf10(Value=Slider(-6, range=-10..10))
板厚_mm_6 = Panel(板厚_mm)
multiplication_8 = Multiplication(A=mass_addition.Result, B=板厚_mm_6, C=Slider(0.53, range=0..1), D=power_of_10)
panel_28 = Panel(multiplication_8)

brep_wireframe_9 = BrepWireframe(Brep=list_item_81, Density=-1)
join_curves_17 = JoinCurves(Curves=brep_wireframe_9, Preserve=False)
area_26 = Area(Geometry=join_curves_17)  # -> Area, Centroid
sort_along_curve_4 = SortAlongCurve(Points=simplify(area_26.Centroid), Curve=path_mapper_2)  # -> Points, Indices
list_item_82 = ListItem(List=join_curves_17, Index=sort_along_curve_4.Indices, Wrap=True)

group_2 = Group(Objects=list_item_82)  # -> simplify(Group)

# ----
# レーザー加工用データ
number_slider_24 = Slider(3, range=0..10)
division_29 = Division(A="1", B=number_slider_24)
negative_30 = Negative(Value=Slider(392, range=0..2000))
scale_3 = Scale(Geometry=list_item_82, Center=Point(0, 0, 0), Factor=division_29)  # -> Geometry, Transform
unit_x_8 = UnitX(Factor=negative_30)
move_39 = Move(Geometry=scale_3.Geometry, Motion=unit_x_8)  # -> Geometry, Transform

shift_paths_22 = ShiftPaths(Data=group_2, Offset=-1)
explode_tree_15 = ExplodeTree(Data=shift_paths_22)  # -> Branch0, Branch1
list_item_83 = ListItem(List=explode_tree_15.Branch0, Index=Slider(8, range=0..10), Wrap=True)
orient_36 = Orient(Geometry=list_item_83, Source=xy_plane_6, Target=PlaneXY(0, 0, 0))  # -> Geometry, Transform
ungroup_2 = Ungroup(Group=orient_36.Geometry)

# ----
# レーザー加工用データ Layout for sheet
control_points_2 = ControlPoints(Curve=move_39.Geometry)  # -> Points, Weights, Knots
shift_paths_23 = ShiftPaths(Data=control_points_2.Points, Offset=-1)
convex_hull = ConvexHull(Points=shift_paths_23, Plane=PlaneXY(0, 0, 0))  # -> flatten(Hull), HullZ, Indices
hull_2 = Hull(Brep=flatten(convex_hull.Hull))  # -> Geo, Projected, Hull, Plane, Plane_2
number_slider_25 = Slider(0, range=0..10)
number_slider_26 = Slider(100, range=0..100)
number_slider_27 = Slider(10, range=0..100)
rectangle_4 = Rectangle(Plane=PlaneXY(0, 0, 0), XSize=Slider(458, range=0..1000), YSize=Slider(305, range=0..1000), Radius=0)  # -> Rectangle, Length
pack_objects = PackObjects(Geo=flatten(hull_2.Hull), Plane=flatten(hull_2.Plane), X=1, Y=1, Tolerabce=0)  # -> Geo, Transformation
sheet_size = Geometry(rectangle_4.Rectangle)
opennest = OpenNest(
    Sheets=sheet_size,
    Geo=pack_objects.Geo,
    Spacing=Slider(5, range=0..50),
    Placement=Slider(0, range=0..2),
    Tolerance=0.1,
    Rotations=4,
    Iterations=1,
    Seed=1,
    Reset=Button(),
    Run=Toggle(False))  # -> Sheets, Geo, ID, Transform, IDS
scale_4 = Scale(Geometry=list_item_81, Center=Point(0, 0, 0), Factor=division_29)  # -> Geometry, Transform
transform_2 = Transform(Geometry=flatten(scale_4.Geometry), Transform=pack_objects.Transformation)
data_dam_5 = DataDam(DataDataA=opennest.Transform, BufferDelay=10000000, BufferMode=0)
transform_3 = Transform(Geometry=flatten(transform_2), Transform=data_dam_5)

bake_geometry_2 = BakeGeometry(Bake=Button(), Geometry=ungroup_2, Attributes=createattributes, DeleteOldBakes=False, PreserveTrees=False)
geometry_21 = Geometry(orient_34.Geometry)

# ----
# 高さ寸法
sort_list_8 = SortList(Keys=deconstruct_7.ZComponent, ValuesValuesA=cull_pattern_3)  # -> Keys, ValuesValuesA
shift_list_3 = ShiftList(List=sort_list_8.ValuesValuesA, Shift=1, Wrap=False)
list_item_84 = ListItem(List=sort_list_8.Keys, Index=0, Wrap=True)
deconstruct_8 = Deconstruct(Point=shift_list_3)  # -> XComponent, YComponent, ZComponent
construct_point_16 = ConstructPoint(XCoordinate=deconstruct_8.XComponent, YCoordinate=deconstruct_8.YComponent, ZCoordinate=list_item_84)
xz_plane_6 = XZPlane(Origin=Point(0, 0, 0))

# ----
# 水平方向寸法
sort_list_9 = SortList(Keys=deconstruct_7.XComponent, ValuesValuesA=cull_pattern_3)  # -> Keys, ValuesValuesA
shift_list_4 = ShiftList(List=sort_list_9.ValuesValuesA, Shift=1, Wrap=False)
list_item_85 = ListItem(List=sort_list_8.ValuesValuesA, Index=0, Wrap=True)
number_slider_28 = Slider(60, range=0..100)
xy_plane_7 = XYPlane(Origin=list_item_85)
shortest_list = ShortestList(ListListA=sort_list_9.ValuesValuesA, ListListB=shift_list_4, TrimMode=2)  # -> ListListA, ListListB
aligned_dimension_2 = AlignedDimension(
    Plane=xy_plane_7,
    PointA=shortest_list.ListListA,
    PointB=shortest_list.ListListB,
    Offset=1,
    Text="{0:0.00}",
    Size=number_slider_28)

aligned_dimension_3 = AlignedDimension(Plane=xz_plane_6, PointA=shift_list_3, PointB=construct_point_16, Offset=1, Text="{0:0.00}", Size=number_slider_28)

# ----
# To create a signal for pices
縁からの距離_mm = Slider(10, range=0..100)
縁からの距離_mm_2 = Slider(10, range=0..100)
multiplication_9 = Multiplication(A=縁からの距離_mm, B=2)
multiplication_10 = Multiplication(A=縁からの距離_mm_2, B=2)
bounding_box_18 = BoundingBox(Content=flatten(square.Cells), Plane=PlaneXY(0, 0, 0), UnionBox=True)  # -> Box, Box_2
deconstruct_brep_22 = DeconstructBrep(Brep=bounding_box_18.Box)  # -> Faces, Edges, Vertices
box_properties = BoxProperties(Box=bounding_box_18.Box)  # -> Center, Diagonal, Area, Volume, Degeneracy
list_item_86 = ListItem(List=deconstruct_brep_22.Vertices, Index=0, Wrap=True)  # -> Item, Item1
yz_plane_3 = YZPlane(Origin=box_properties.Center)
mirror_3 = Mirror(Geometry=path_mapper, Plane=yz_plane_3)  # -> Geometry, Transform

# ----
# Layout for sheet
control_points_3 = ControlPoints(Curve=list_item_82)  # -> Points, Weights, Knots
shift_paths_24 = ShiftPaths(Data=control_points_3.Points, Offset=-1)
number_slider_29 = Slider(3, range=0..10)
convex_hull_2 = ConvexHull(Points=shift_paths_24, Plane=PlaneXY(0, 0, 0))  # -> Hull, HullZ, Indices
duplicate_data_5 = DuplicateData(Data=flatten(convex_hull_2.Hull), Number=number_slider_29, Order=True)
hull_3 = Hull(Brep=flatten(duplicate_data_5))  # -> Geo, Projected, Hull, Plane, Plane_2
number_slider_30 = Slider(0, range=0..10)
number_slider_31 = Slider(100, range=0..100)
pack_objects_2 = PackObjects(Geo=flatten(hull_3.Hull), Plane=flatten(hull_3.Plane), X=1, Y=1, Tolerabce=0)  # -> Geo, Transformation
geometry_22 = Geometry(list_item_81)
sheet_size_for_cutting_area = Geometry(surface_from_points_2)
sheet_size_2 = Geometry(rectangle_2.Rectangle)
duplicate_data_6 = DuplicateData(Data=flatten(geometry_22), Number=number_slider_29, Order=True)
opennest_2 = OpenNest(
    Sheets=sheet_size_for_cutting_area,
    Geo=pack_objects_2.Geo,
    Spacing=Slider(25, range=0..50),
    Placement=Slider(0, range=0..2),
    Tolerance=0.1,
    Rotations=4,
    Iterations=1,
    Seed=Slider(10, range=0..100),
    Reset=Button(),
    Run=Toggle(False))  # -> Sheets, Geo, ID, Transform, IDS
transform_4 = Transform(Geometry=flatten(duplicate_data_6), Transform=pack_objects_2.Transformation)
transform_5 = Transform(Geometry=flatten(transform_4), Transform=opennest_2.Transform)

dimensions_8 = Dimensions(Surface=convex_hull_2.Hull)  # -> UDimension, VDimension
construct_domain_5 = ConstructDomain(DomainStart=0, DomainEnd=dimensions_8.UDimension)
construct_domain_6 = ConstructDomain(DomainStart=0, DomainEnd=dimensions_8.VDimension)
remap_numbers_3 = RemapNumbers(Value=multiplication_9, Source=construct_domain_5, Target=Domain(0, 1))  # -> Mapped, Clipped
remap_numbers_4 = RemapNumbers(Value=multiplication_10, Source=construct_domain_6, Target=Domain(0, 1))  # -> Mapped, Clipped
subtraction_15 = Subtraction(A=1, B=remap_numbers_3.Mapped)
subtraction_16 = Subtraction(A=1, B=remap_numbers_4.Mapped)
scale_nu_3 = ScaleNU(Geometry=convex_hull_2.Hull, Plane=PlaneXY(0, 0, 0), ScaleX=subtraction_15, ScaleY=subtraction_16, ScaleZ=1)  # -> Geometry, Transform
discontinuity_5 = Discontinuity(Curve=scale_nu_3.Geometry, Level=1)  # -> simplify(Points), Parameters
split_tree = SplitTree(Data=discontinuity_5.Points, Masks=flatten("{0;*}"))  # -> Positive, Negative
list_item_87 = ListItem(List=split_tree.Positive, Index=Slider(4, range=0..4), Wrap=True)
list_item_88 = ListItem(List=split_tree.Negative, Index=Slider(3, range=0..4), Wrap=True)
orient_37 = Orient(Geometry=simplify(mirror_3.Geometry), Source=list_item_86.Item1, Target=simplify(list_item_87))  # -> Geometry, Transform
orient_38 = Orient(Geometry=simplify(path_mapper), Source=list_item_86.Item, Target=simplify(list_item_88))  # -> Geometry, Transform
entwine_14 = Entwine(Branch0X=orient_37.Geometry, Branch1X=orient_38.Geometry, FlattenInputs=False)
group_3 = Group(Objects=entwine_14)

duplicate_data_7 = DuplicateData(Data=flatten(geometry_21), Number=number_slider_29, Order=True)

duplicate_data_8 = DuplicateData(Data=flatten(group_3), Number=number_slider_29, Order=True)
transform_6 = Transform(Geometry=flatten(duplicate_data_8), Transform=pack_objects_2.Transformation)
transform_7 = Transform(Geometry=flatten(transform_6), Transform=opennest_2.Transform)

transform_8 = Transform(Geometry=flatten(duplicate_data_7), Transform=pack_objects_2.Transformation)
list_item_89 = ListItem(List=flatten(geometry_22), Index=[Slider(0, range=0..100), Slider(9, range=0..10)], Wrap=True)
duplicate_data_9 = DuplicateData(Data=flatten(geometry_22), Number=number_slider_13, Order=True)
duplicate_data_10 = DuplicateData(Data=flatten(group_3), Number=number_slider_13, Order=True)
mirror_4 = Mirror(Geometry=duplicate_data_9, Plane=PlaneYZ(0, 0, 0))  # -> Geometry, Transform
list_length_8 = ListLength(List=duplicate_data_10)
list_length_9 = ListLength(List=mirror_4.Geometry)
flip = Flip(Surface=mirror_4.Geometry, Guide=flip_plane.Flipped)  # -> Surface, Result
division_30 = Division(A=list_length_8, B=2)
division_31 = Division(A=list_length_9, B=2)
data_13 = Data(mirror_4.Geometry)
partition_list_4 = PartitionList(List=duplicate_data_10, Size=division_30)
partition_list_5 = PartitionList(List=mirror_4.Geometry, Size=division_31)
explode_tree_16 = ExplodeTree(Data=partition_list_4)  # -> Branch0, Branch1
explode_tree_17 = ExplodeTree(Data=partition_list_5)  # -> Branch0, Branch1
bounding_box_19 = BoundingBox(Content=explode_tree_17.Branch1, Plane=PlaneXY(0, 0, 0))  # -> Box, Box_2
bounding_box_20 = BoundingBox(Content=explode_tree_17.Branch0, Plane=PlaneXY(0, 0, 0))  # -> Box, Box_2
dimensions_9 = Dimensions(Surface=bounding_box_19.Box)  # -> UDimension, VDimension
dimensions_10 = Dimensions(Surface=bounding_box_20.Box)  # -> UDimension, VDimension
addition_23 = Addition(A=dimensions_9.UDimension, B=Slider(40, range=0..200))
addition_24 = Addition(A=dimensions_10.UDimension, B=Slider(40, range=0..200))
addition_25 = Addition(A=dimensions_10.VDimension, B=Slider(131.16, range=0..200))
mass_addition_2 = MassAddition(Input=addition_23)  # -> Result, PartialResults
mass_addition_3 = MassAddition(Input=addition_24)  # -> Result, PartialResults
vector_xyz_10 = VectorXYZ(XComponent=mass_addition_2.PartialResults, YComponent=0, ZComponent=0)  # -> Vector, Length
vector_xyz_11 = VectorXYZ(XComponent=mass_addition_3.PartialResults, YComponent=addition_25, ZComponent=0)  # -> Vector, Length
series_18 = Series(Start="1", Step=1, Count=division_31)
move_40 = Move(Geometry=explode_tree_17.Branch0, Motion=vector_xyz_11.Vector)  # -> Geometry, Transform
move_41 = Move(Geometry=explode_tree_17.Branch1, Motion=vector_xyz_10.Vector)  # -> Geometry, Transform
expression_22 = Expression(x=graft(panel_5), y=series_18, Expression="Format(\"{0}-{1}\", x, y)")
transform_9 = Transform(Geometry=explode_tree_16.Branch1, Transform=move_41.Transform)
transform_10 = Transform(Geometry=explode_tree_16.Branch0, Transform=move_40.Transform)
merge_21 = Merge(Data1=move_40.Geometry, Data2=transform_10)
merge_22 = Merge(Data1=move_41.Geometry, Data2=transform_9)
explode_tree_18 = ExplodeTree(Data=expression_22)  # -> Branch0, Branch1
transform_11 = Transform(Geometry=construct_point_6, Transform=move_40.Transform)
transform_12 = Transform(Geometry=construct_point_6, Transform=move_41.Transform)
text_tag_3d_6 = TextTag3D(Location=transform_11, Text=explode_tree_18.Branch1, Size=number_slider_14, Justification=8)
text_tag_3d_7 = TextTag3D(Location=transform_12, Text=explode_tree_18.Branch0, Size=number_slider_14, Justification=8)

# ==== cluster GuidCurveForSort
geometry = ClusterInput()
area = Area(Geometry=geometry)  # -> Area, Centroid
flip_matrix = FlipMatrix(Data=area.Centroid)
tree_statistics = TreeStatistics(Tree=flip_matrix)  # -> Paths, Length, Count
dispatch = Dispatch(List=tree_statistics.Paths, DispatchPattern=[True, False])  # -> ListA, ListB
tree_branch = TreeBranch(Tree=flip_matrix, Path=dispatch.ListB, MaintainPaths=True)  # -> reverse(Branch)
tree_branch_2 = TreeBranch(Tree=flip_matrix, Path=dispatch.ListA, MaintainPaths=True)
merge = Merge(Data1=tree_branch_2, Data2=tree_branch)
polyline = PolyLine(Vertices=flatten(merge), Closed=False)
polyline_2 = ClusterOutput(polyline)

# ==== cluster NarrowWave
target = ClusterInput()
N = ClusterInput()
wa = ClusterInput()
wb = ClusterInput()
ha = ClusterInput()
hb = ClusterInput()
hc = ClusterInput()
division = Division(A=N, B="3")
construct_domain = ConstructDomain(DomainStart=0, DomainEnd="180")
construct_domain_2 = ConstructDomain(DomainStart=0, DomainEnd="360")
round = Round(Number=division)  # -> Nearest, Floor, Ceiling
range = Range(Domain=construct_domain, Steps=round.Floor)
range_2 = Range(Domain=construct_domain_2, Steps=N)
expression = Expression(x=range, Hc=hc, Expression="Hc/8*cos(x°)")
expression_2 = Expression(x=range_2, Ha=ha, Expression="Ha/2*cos(x°)")
expression_3 = Expression(x=range, Wb=wb, Expression="(x/360)*Wb")
expression_4 = Expression(Hb=hb, Hc=hc, Expression="(Hb+Hc/2)/2")
expression_5 = Expression(x=range_2, Wa=wa, Expression="(x/360)*Wa")
negative = Negative(Value=expression_3)
pt = PointXYZ(XComponent=expression_5, YComponent=expression_2, ZComponent=0)
entwine = Entwine(Branch00=negative, Branch01=expression_3, FlattenInputs=True)
pt_2 = PointXYZ(XComponent=entwine, YComponent=expression, ZComponent=0)
panel = Panel("""0
-1""")
list_item = ListItem(List=pt_2, Index=0, Wrap=True)
list_item_2 = ListItem(List=pt, Index=0, Wrap=True)
list_item_3 = ListItem(List=pt, Index=panel, Wrap=True)
orient = Orient(Geometry=pt_2, Source=list_item, Target=graft(list_item_3))  # -> Geometry, Transform
unit_y = UnitY(Factor=expr("x/2", hb))
geometry = Geometry(flatten([pt, orient.Geometry]))
move = Move(Geometry=list_item_2, Motion=unit_y)  # -> Geometry, Transform
sort_points = SortPoints(Points=geometry)  # -> Points, Indices
removeduplicatepts = RemoveDuplicatePts(Points=sort_points.Points, Tolerance=0.01)
xz_plane = XZPlane(Origin=move.Geometry)
interpolate = Interpolate(Vertices=removeduplicatepts, Degree=3, Periodic=False, KnotStyle=1)  # -> Curve, Length, Domain
mirror = Mirror(Geometry=interpolate.Curve, Plane=xz_plane)  # -> Geometry, Transform
end_points = EndPoints(Curve=interpolate.Curve)  # -> Start, End
end_points_2 = EndPoints(Curve=mirror.Geometry)  # -> Start, End
line = Line(StartPoint=end_points_2.Start, EndPoint=end_points.Start)
line_2 = Line(StartPoint=end_points_2.End, EndPoint=end_points.End)
panel_2 = Panel(expression_3)
entwine_2 = Entwine(Branch00=line, Branch01=line_2, FlattenInputs=True)
curve_middle = CurveMiddle(Curve=entwine_2)
list_item_4 = ListItem(List=panel_2, Index=0, Wrap=True)  # -> Item1, Item
panel_3 = Panel(expression_4)
ellipse = Ellipse(Plane=curve_middle, Radius1=list_item_4.Item1, Radius2=panel_3)  # -> Ellipse, Focus1, Focus2
yz_plane = YZPlane(Origin=curve_middle)
panel_4 = Panel(expression_4)
negative_2 = Negative(Value=panel_4)
construct_domain_3 = ConstructDomain(DomainStart=negative_2, DomainEnd=panel_4)
plane_surface = PlaneSurface(Plane=yz_plane, XSize=construct_domain_3, YSize=construct_domain_3)
split_with_brep = SplitWithBrep(Curve=ellipse.Ellipse, Brep=plane_surface)  # -> Curve, Points
panel_5 = Panel("""0
1""")
list_item_5 = ListItem(List=split_with_brep.Curve, Index=graft(panel_5), Wrap=True)
join_curves = JoinCurves(Curves=flatten([mirror.Geometry, list_item_5, interpolate.Curve]), Preserve=False)
area = Area(Geometry=join_curves)  # -> Area, Centroid
orient_2 = Orient(Geometry=join_curves, Source=area.Centroid, Target=target)  # -> Geometry, Transform
geometry_2 = ClusterOutput(orient_2.Geometry)

# ==== cluster Wave
target = ClusterInput()
N = ClusterInput()
W = ClusterInput()
H = ClusterInput()
construct_domain = ConstructDomain(DomainStart=0, DomainEnd="360")
range = Range(Domain=construct_domain, Steps=N)
expression = Expression(x=range, H=H, Expression="H/4*cos(x°)")
expression_2 = Expression(x=range, W=W, Expression="(x/360)*W")
pt = PointXYZ(XComponent=expression_2, YComponent=expression, ZComponent=0)
list_item = ListItem(List=pt, Index=0, Wrap=True)
interpolate = Interpolate(Vertices=pt, Degree=3, Periodic=False, KnotStyle=1)  # -> Curve, Length, Domain
xz_plane = XZPlane(Origin=list_item)
mirror = Mirror(Geometry=interpolate.Curve, Plane=xz_plane)  # -> Geometry, Transform
join_curves = JoinCurves(Curves=flatten([interpolate.Curve, mirror.Geometry]), Preserve=False)
area = Area(Geometry=join_curves)  # -> Area, Centroid
orient = Orient(Geometry=join_curves, Source=area.Centroid, Target=target)  # -> Geometry, Transform
geometry = ClusterOutput(orient.Geometry)

# ==== cluster Rhombus
radius = ClusterInput()
terget = ClusterInput()
W = ClusterInput()
H = ClusterInput()
expression = Expression(W=W, Expression="W/2")
expression_2 = Expression(H=H, Expression="H/2")
unit_x = UnitX(Factor=expression)
unit_y = UnitY(Factor=expression_2)
negative = Negative(Value=unit_x)
entwine = Entwine(Branch00=unit_x, Branch01=negative, Branch02=unit_y, FlattenInputs=True)
move = Move(Geometry=terget, Motion=entwine)  # -> Geometry, Transform
explode_tree = ExplodeTree(Data=move.Geometry)  # -> Branch0, Branch1, Branch2
line = Line(StartPoint=explode_tree.Branch0, EndPoint=explode_tree.Branch2)
line_2 = Line(StartPoint=explode_tree.Branch1, EndPoint=explode_tree.Branch2)
xz_plane = XZPlane(Origin=terget)
relay = Relay([line, line_2])
mirror = Mirror(Geometry=relay, Plane=xz_plane)  # -> Geometry, Transform
join_curves = JoinCurves(Curves=flatten([mirror.Geometry, relay]), Preserve=False)
fillet = Fillet(Curve=join_curves, Radius=radius)
curve = ClusterOutput(fillet)

# ==== cluster Arc
radius = ClusterInput()
target = ClusterInput()
W = ClusterInput()
H = ClusterInput()
maximum = Maximum(A=W, B=H)
expression = Expression(H=H, Expression="H/2")
expression_2 = Expression(x=maximum, Expression="x/2")
unit_x = UnitX(Factor=expression_2)
unit_y = UnitY(Factor=expression)
negative = Negative(Value=unit_x)
entwine = Entwine(Branch00=unit_x, Branch01=negative, Branch02=unit_y, FlattenInputs=True)
move = Move(Geometry=target, Motion=entwine)  # -> Geometry, Transform
explode_tree = ExplodeTree(Data=move.Geometry)  # -> Branch0, Branch1, Branch2
arc_3pt = Arc3Pt(PointA=explode_tree.Branch0, PointB=explode_tree.Branch2, PointC=explode_tree.Branch1)  # -> Arc, Plane, Radius
xz_plane = XZPlane(Origin=target)
mirror = Mirror(Geometry=arc_3pt.Arc, Plane=xz_plane)  # -> Geometry, Transform
join_curves = JoinCurves(Curves=flatten([arc_3pt.Arc, mirror.Geometry]), Preserve=False)
fillet = Fillet(Curve=join_curves, Radius=radius)
curve = ClusterOutput(fillet)

# ==== cluster Line
target = ClusterInput()
W = ClusterInput()
radius = ClusterInput()
subtraction = Subtraction(A=W, B=radius)
unit_x = UnitX(Factor=expr("x/2", subtraction))
negative = Negative(Value=unit_x)
entwine = Entwine(Branch00=negative, Branch01=unit_x, FlattenInputs=True)
move = Move(Geometry=target, Motion=entwine)  # -> Geometry, Transform
arc = Arc(Plane=move.Geometry, Radius=expr("x/2", radius), Angle=Domain(0, 3.141592654))  # -> Arc, Length
panel = Panel("""90
-90""")
rotate = Rotate(Geometry=arc.Arc, Angle=graft(degrees(panel)), Plane=move.Geometry)  # -> Geometry, Transform
end_points = EndPoints(Curve=rotate.Geometry)  # -> Start, End
explode_tree = ExplodeTree(Data=end_points.Start)  # -> Branch0, Branch1
explode_tree_2 = ExplodeTree(Data=end_points.End)  # -> Branch0, Branch1
line = Line(StartPoint=explode_tree.Branch0, EndPoint=explode_tree_2.Branch1)
line_2 = Line(StartPoint=explode_tree.Branch1, EndPoint=explode_tree_2.Branch0)
join_curves = JoinCurves(Curves=flatten([rotate.Geometry, line, line_2]), Preserve=False)
curves = ClusterOutput(join_curves)

# ==== cluster Cluster
A = ClusterInput()
B = ClusterInput()
division = Division(A=A, B=B)
round = Round(Number=division)  # -> Nearest, Floor, Ceiling
division_2 = Division(A=round.Ceiling, B=2)
integer = Integer(division_2)
equality = Equality(FirstNumber=division_2, SecondNumber=integer)  # -> Equality, Inequality
addition = Addition(A=round.Ceiling, B="1")
stream_filter = StreamFilter(Gate=equality.Equality, Stream0=addition, Stream1=round.Ceiling)
s_0 = ClusterOutput(stream_filter)

# ==== cluster Cluster_2
A = ClusterInput()
B = ClusterInput()
division = Division(A=A, B=B)
round = Round(Number=division)  # -> Nearest, Floor, Ceiling
division_2 = Division(A=round.Ceiling, B=2)
integer = Integer(division_2)
equality = Equality(FirstNumber=division_2, SecondNumber=integer)  # -> Equality, Inequality
addition = Addition(A=round.Ceiling, B="1")
stream_filter = StreamFilter(Gate=equality.Equality, Stream0=addition, Stream1=round.Ceiling)
s_1 = ClusterOutput(stream_filter)

# ==== cluster Cluster_3
A = ClusterInput()
B = ClusterInput()
division = Division(A=A, B=B)
round = Round(Number=division)  # -> Nearest, Floor, Ceiling
division_2 = Division(A=round.Ceiling, B=2)
integer = Integer(division_2)
equality = Equality(FirstNumber=division_2, SecondNumber=integer)  # -> Equality, Inequality
addition = Addition(A=round.Ceiling, B="1")
stream_filter = StreamFilter(Gate=equality.Equality, Stream0=addition, Stream1=round.Ceiling)
stream = ClusterOutput(stream_filter)

# ==== cluster ToClassifyEdges

# ---- group: Cluster Input
curve = ClusterInput()

# ----
explode = Explode(Curve=curve, Recursive=True)  # -> Segments, Vertices
deconstruct_vector = DeconstructVector(Vector=explode.Segments)  # -> XComponent, YComponent, ZComponent
# 長方形のEdgeの方向による分類
# {0;0}：X方向　線分
# {0;1}：Y方向　線分
round = Round(Number=deconstruct_vector.YComponent)  # -> Nearest, Floor, Ceiling
equality = Equality(FirstNumber=round.Nearest, SecondNumber="0")  # -> Equality, Inequality
dispatch = Dispatch(List=explode.Segments, DispatchPattern=equality.Equality)  # -> ListA, ListB
entwine = Entwine(Branch00=dispatch.ListA, Branch01=dispatch.ListB, FlattenInputs=True)
result = ClusterOutput(entwine)  # {0;0}：Lines for X-axis {0;1}：Lines for Y-axis
