# Grasshopper definition 全体形状+加工データ作成.gh (Grasshopper 1.0.7)
# plug-ins: Aggregations, LunchBox, MetaHopper, Human, OpenNest, Bifocals

document_info = DocumentInfo(AutoUpdate=False, Recursive=False)  # -> DocumentName, DocumentFilePath, Components, Params, _3rdPartyAssemblies
panel = Panel(document_info._3rdPartyAssemblies)
font_table = FontTable()
panel_2 = Panel(font_table)
set_panel_properties = SetPanelProperties(Panel="Grasshopper.Kernel.Types.GH_ObjectWrapper", Font="Times New Roman", Stream=Toggle(True))
set_group_properties = SetGroupProperties(Style=Slider(1, range=0..2))
set_scribble_properties = SetScribbleProperties(ScribbleSize=Slider(30, range=0..100), ScribbleFont="Times New Roman")
control_wire_display = ControlWireDisplay(WireDisplay=Slider(1, range=0..2))

# ----
# 04-ナローウェーブ　パラメータ
# 幅＝Wa+2*Wb
# 高さ＝2*Ha+Hb
# 04-ナローウェーブ
# パラメータ（高さ、幅）
wa = Slider(50, range=0..100)
ha = Slider(10, range=0..30)
hc = Slider(12.7, range=0..30)
wb = Slider(25.4, range=0..30)
hb = Slider(12.7, range=0..20)
expression = Expression(Wa=wa, Wb=wb, Expression="Wb*2+Wa")
expression_2 = Expression(Ha=ha, Hb=hb, Expression="Ha*2+Hb")

# ----
# オフセット値(shopbotの加工範囲制限・パネル間)
オフセット値_パネルごとの幅 = Slider(25, range=0..30)
長軸方向のオフセット = Slider(18, range=0..300)
短軸方向のオフセット = Slider(18, range=0..300)

# ----
# 00,01,02-ウェーブ,ひし形,円弧 パラメータ
高さ = Slider(20, range=0..30)
radius = Slider(12.7, range=0..20)
幅 = Slider(105, range=0..200)

# ----
# 3-直線
高さ_2 = Slider(6.35, range=0..30)
幅_2 = Slider(65, range=0..200)

bending加工部分_長さ_mm_xb = Slider(440, range=0..2000)

# ----
# 相欠きオフセット値
加工用接合部オフセット = Slider(0.1, range=0..300)

bending加工なし_長さ_mm_xss = Slider(10, range=0..500)

# ----
# 基準板のサイズ
短辺長さ = Slider(910, range=0..2000)
長辺長さ = Slider(1820, range=0..10000)

# ----
# 孔同士の距離
# ※最終的な数値と誤差有
孔同士の横方向の距離_w = Slider(16.25, range=0..30)
孔同士の縦方向の距離_h = Slider(9, range=-10..30)

control_wire_display_2 = ControlWireDisplay(WireDisplay=1)
外側部材_α_mm = Slider(0, range=0..500)
接合位置_mm_xds = Slider(120, range=0..500)
アーチ方向_部材数 = Slider(9, range=0..50)
同部材接合角度 = Slider(73.125, range=0..90)
異部材接合角度 = Slider(85, range=0..90)
切り欠き長さ_mm = Slider(30, range=0..300)
板幅_mm = Slider(450, range=0..1000)
板厚_mm = Slider(12, range=0..100)

# ----
# CNC加工時の平板を分割
# (shopbotの加工範囲制限を考慮)
# サブロク板を基準としている（1820mm x 910mm）
短辺長さ_2 = Panel(短辺長さ)
長辺長さ_2 = Panel(長辺長さ)
rectangle = Rectangle(Plane=PlaneXY(0, 0, 0), XSize=短辺長さ_2, YSize=長辺長さ_2, Radius=0)  # -> Rectangle, Length
短軸方向のオフセット_2 = Panel(長軸方向のオフセット)
長軸方向のオフセット_2 = Panel(短軸方向のオフセット)
to_classify_edges = ToClassifyEdges(curve=rectangle.Rectangle)
entwine = Entwine(Branch00=短軸方向のオフセット_2, Branch01=長軸方向のオフセット_2, FlattenInputs=True)
offset_on_srf = OffsetOnSrf(Curve=to_classify_edges, Distance=entwine, Surface=rectangle.Rectangle)
multiple_curves = MultipleCurves(Curves=flatten(offset_on_srf))  # -> Points, IndexA, IndexB, ParamA, ParamB
surface_from_points = SurfaceFromPoints(Points=multiple_curves.Points, UCount="2", Interpolate=False)
divide_surface = DivideSurface(Surface=surface_from_points, UCount=Slider(2, range=0..10), VCount=Slider(1, range=0..10))  # -> Points, Normals, Parameters
tree_statistics = TreeStatistics(Tree=divide_surface.Points)  # -> Paths, Length, Count
list_item = ListItem(List=tree_statistics.Paths, Index=Slider(1, range=0..10), Wrap=True)
tree_branch = TreeBranch(Tree=divide_surface.Points, Path=list_item, MaintainPaths=True)
外側部材_α = Panel(外側部材_α_mm)
unit_y = UnitY(Factor=expr("-2*x", 外側部材_α))
polyline = PolyLine(Vertices=tree_branch, Closed=False)
move = Move(Geometry=polyline, Motion=unit_y)  # -> Geometry, Transform
# 長方形部材の場合、配置を決定
# 台形部材の場合は部材の縦方向の長さを決定するために使用
surface_split = SurfaceSplit(Surface=surface_from_points, Curves=move.Geometry)
boundary_surfaces = BoundarySurfaces(Edges=surface_split)
divide_domain² = DivideDomain²(Domain=boundary_surfaces, UCount=Slider(3, range=0..10), VCount=Slider(1, range=0..1))
isotrim = Isotrim(Surface=graft(boundary_surfaces), Domain=divide_domain²)

division = Division(A=異部材接合角度, B=2)
addition = Addition(A=bending加工なし_長さ_mm_xss, B=板厚_mm)
radians = Radians(Degrees=division)

# ----
# 04-ナローウェーブ
分割数 = Slider(50, range=0..50)
construct_point = ConstructPoint(XCoordinate=0, YCoordinate=0, ZCoordinate=0)
narrow_wave = NarrowWave(N=分割数, wa=wa, wb=wb, ha=ha, hb=hb, hc=hc, target=construct_point)

maximum = Maximum(A=addition, B=接合位置_mm_xds)
expression_3 = Expression(x=radians, L=bending加工部分_長さ_mm_xb, Expression="(L*sin(x))/x")

# ----
# 孔形状の作成・決定
# 0-ウェーブ
wave = Wave(N=分割数, W=幅, H=高さ, target=construct_point)

# ----
# 2-円弧
arc = Arc(W=幅, H=高さ, radius=radius, target=construct_point)

# ----
# 3-直線
line = Line(W=幅_2, radius=高さ_2, target=construct_point)

# ----
# 1-菱形
rhombus = Rhombus(W=幅, H=高さ, radius=radius, terget=construct_point)

# ----
# Number Sliderで孔の選択
# ※0-ウェーブ
#    1-菱形
#    2-円弧
#    3-直線
#    4-ナローウェーブ
number_slider = Slider(3, range=0..4)
stream_filter = StreamFilter(Gate=number_slider, Stream0=wave, Stream1=rhombus, Stream2=arc, Stream3=line, Stream4=narrow_wave)

# ----
# 基準形状の範囲の算出
bounding_box = BoundingBox(Content=stream_filter, Plane=PlaneXY(0, 0, 0))  # -> Box, Box_2
dimensions = Dimensions(Surface=bounding_box.Box)  # -> UDimension, VDimension

孔の幅 = Panel(dimensions.UDimension)
孔の高さ = Panel(dimensions.VDimension)
expression_4 = Expression(x=孔の幅, a=Slider(1, range=0..5), b=Slider(4, range=0..10), Expression="a*x/b")
expression_5 = Expression(x=孔の高さ, a=Slider(1, range=0..5), b=Slider(4, range=0..10), Expression="a*x/b")

# ----
# 1部材サイズの算定
オフセット値_パネルごとの幅_2 = Panel(オフセット値_パネルごとの幅)
explode_tree = ExplodeTree(Data=isotrim)  # -> _00100, _00101
negative = Negative(Value=オフセット値_パネルごとの幅_2)
list_item_2 = ListItem(List=explode_tree._00100, Index=0, Wrap=True)
offset_curve = OffsetCurve(Curve=list_item_2, Distance=negative, Corners=1)
dimensions_2 = Dimensions(Surface=offset_curve)  # -> UDimension, VDimension
sort_list = SortList(Keys=[dimensions_2.VDimension, dimensions_2.UDimension])  # -> Keys, ValuesValuesA
list_item_3 = ListItem(List=sort_list.Keys, Index=0, Wrap=True)  # -> Item, Item1

部材幅 = Panel(list_item_3.Item)
data = Data(部材幅)
部材長さ = Panel(list_item_3.Item1)
data_2 = Data(部材長さ)
panel_3 = Panel(data_2)
expression_6 = Expression(Lx=部材長さ, Xb=bending加工部分_長さ_mm_xb, Xss=bending加工なし_長さ_mm_xss, Expression="(Lx - Xb)/2 - Xss")
addition_2 = Addition(A=bending加工なし_長さ_mm_xss, B=expression_6)

# ----
# 孔加工範囲の指定
長軸方向のオフセット_3 = Slider(169, range=0..300)
短軸方向のオフセット_3 = Slider(0, range=0..100)
bending加工なし長さ_余し = Panel(addition_2)

# ----
# 加工範囲から部材サイズの決定
addition_3 = Addition(A=板幅_mm, B=短軸方向のオフセット_3)
minimum = Minimum(A=addition_2, B=maximum)

# ----
# 基準パーツの作成（長方形）
panel_4 = Panel("1")
vector_xyz = VectorXYZ(XComponent=panel_4, YComponent=0, ZComponent=panel_4)  # -> Vector, Length
vector_xyz_2 = VectorXYZ(XComponent=0, YComponent=panel_4, ZComponent=0)  # -> Vector, Length
expression_7 = Expression(x=異部材接合角度, Expression="(90-x)/2")
construct_point_2 = ConstructPoint(XCoordinate=0, YCoordinate=0, ZCoordinate=0)
construct_point_3 = ConstructPoint(XCoordinate=expression_3, YCoordinate=0, ZCoordinate=0)
rotate = Rotate(Vector=vector_xyz.Vector, Axis=vector_xyz_2.Vector, Angle=degrees(expression_7))
arc_sed = ArcSED(Start=construct_point_2, End=construct_point_3, Direction=rotate)  # -> Arc, Plane, Radius
bending加工なし長さ_xss = Panel(bending加工なし_長さ_mm_xss)
異部材接合角度_2 = Panel(division)
expression_8 = Expression(x=異部材接合角度_2, Xss=bending加工なし長さ_xss, Expression="Xss*sin(x°)")
negative_2 = Negative(Value=expression_8)
point_a = Point(construct_point_2)
point_b = Point(construct_point_3)
vector_xyz_3 = VectorXYZ(XComponent=0, YComponent=0, ZComponent=negative_2)  # -> Vector, Length
line_2 = Line(StartPoint=point_a, EndPoint=point_b)
bending加工なし長さ_余し_2 = Panel(addition_2)
line_type = Panel("0")
move_2 = Move(Geometry=line_2, Motion=vector_xyz_3.Vector)  # -> Geometry, Transform
extend_curve = ExtendCurve(Curve=arc_sed.Arc, Type=line_type, Start=bending加工なし長さ_余し_2, End=bending加工なし長さ_余し_2)
mirror_curve = MirrorCurve(Geometry=extend_curve, Curve=move_2.Geometry, Tangent=True)
外側部材_α_2 = Panel(外側部材_α_mm)
negative_3 = Negative(Value=外側部材_α_2)
line_type_2 = Panel("0")
extend_curve_2 = ExtendCurve(Curve=extend_curve, Type=line_type_2, Start=negative_3, End=negative_3)
extend_curve_3 = ExtendCurve(Curve=mirror_curve, Type=line_type_2, Start=外側部材_α_2, End=外側部材_α_2)
merge = Merge(Data1=extend_curve_2, Data2=extend_curve_3)
板幅 = Panel(addition_3)
bounding_box_2 = BoundingBox(Content=merge, Plane=PlaneXY(0, 0, 0), UnionBox=True)  # -> Box, Box_2
vector_xyz_4 = VectorXYZ(XComponent=0, YComponent=板幅, ZComponent=0)  # -> Vector, Length
dimensions_3 = Dimensions(Surface=bounding_box_2.Box)  # -> UDimension, VDimension
extrude = Extrude(Base=merge, Direction=vector_xyz_4.Vector)

# ----
# 1部材あたりの孔加工範囲の指定
bending加工なし長さ_余し_3 = Panel(addition_2)
外側部材_α_3 = Panel(外側部材_α_mm)
短軸方向のオフセット_孔加工 = Panel(短軸方向のオフセット_3)
subtraction = Subtraction(A=bending加工なし長さ_余し_3, B=外側部材_α_3)
boundary_surfaces_2 = BoundarySurfaces(Edges=offset_curve)
to_classify_edges_2 = ToClassifyEdges(curve=offset_curve)
entwine_2 = Entwine(Branch00=subtraction, Branch01=短軸方向のオフセット_孔加工, FlattenInputs=True)
offset_on_srf_2 = OffsetOnSrf(Curve=to_classify_edges_2, Distance=entwine_2, Surface=boundary_surfaces_2)
multiple_curves_2 = MultipleCurves(Curves=flatten(offset_on_srf_2))  # -> Points, IndexA, IndexB, ParamA, ParamB
surface_from_points_2 = SurfaceFromPoints(Points=multiple_curves_2.Points, UCount="2", Interpolate=False)
dimensions_4 = Dimensions(Surface=surface_from_points_2)  # -> UDimension, VDimension

geometry = Geometry(merge)
deconstruct_brep = DeconstructBrep(Brep=extrude)  # -> Faces, Edges, Vertices

板厚 = Panel(板厚_mm)
division_2 = Division(A=板厚, B=2)
negative_4 = Negative(Value=division_2)
offset_surface = OffsetSurface(Surface=graft(extrude), Distance=[division_2, negative_4], Retrim=True)
deconstruct_brep_2 = DeconstructBrep(Brep=offset_surface)  # -> Faces, Edges, Vertices
join_curves = JoinCurves(Curves=deconstruct_brep_2.Edges, Preserve=False)
shift_paths = ShiftPaths(Data=join_curves, Offset=-2)
loft = Loft(Curves=shift_paths, Options={Adjust=False, Closed=False, LoftEnds=0, LoftSimp=0, LoftType=0, Rebuild=10, Refit=0.01})
brep_join = BrepJoin(Breps=[loft, offset_surface])  # -> Breps, Closed

multiple_curves_3 = MultipleCurves(Curves=geometry)  # -> Points, IndexA, IndexB, ParamA, ParamB

pointa_接線ベクトル = Vector(rotate)
deconstruct_vector = DeconstructVector(Vector=pointa_接線ベクトル)  # -> XComponent, YComponent, ZComponent
negative_5 = Negative(Value=deconstruct_vector.ZComponent)
vector_xyz_5 = VectorXYZ(XComponent=deconstruct_vector.XComponent, YComponent=0, ZComponent=negative_5)  # -> Vector, Length
pointa_接線ベクトル_2 = Vector(rotate)
接合位置 = Panel(minimum)
接合位置_2 = Panel(minimum)
amplitude = Amplitude(Vector=expr("-x", pointa_接線ベクトル_2), Amplitude=接合位置)
amplitude_2 = Amplitude(Vector=vector_xyz_5.Vector, Amplitude=接合位置_2)
point_a_2 = Point(construct_point_2)
point_b_2 = Point(construct_point_3)
move_3 = Move(Geometry=point_a_2, Motion=amplitude)  # -> Geometry, Transform
move_4 = Move(Geometry=point_b_2, Motion=amplitude_2)  # -> Geometry, Transform

join_curves_2 = JoinCurves(Curves=deconstruct_brep.Edges, Preserve=False)
list_item_4 = ListItem(List=multiple_curves_3.Points, Index=0, Wrap=True)  # -> Item, Item1

# ----
# 部材配置用基点を取得
construct_point_4 = ConstructPoint(XCoordinate=0, YCoordinate=0, ZCoordinate=0)
discontinuity = Discontinuity(Curve=offset_curve, Level=1)  # -> Points, Parameters
discontinuity_2 = Discontinuity(Curve=list_item_2, Level=1)  # -> Points, Parameters
discontinuity_3 = Discontinuity(Curve=isotrim, Level=1)  # -> Points, Parameters
closest_point = ClosestPoint(Point=construct_point_4, Cloud=discontinuity.Points)  # -> ClosestPoint, CPIndex, Distance
closest_point_2 = ClosestPoint(Point=construct_point_4, Cloud=discontinuity_2.Points)  # -> ClosestPoint, CPIndex, Distance
closest_point_3 = ClosestPoint(Point=construct_point_4, Cloud=discontinuity_3.Points)  # -> ClosestPoint, CPIndex, Distance
orient = Orient(Geometry=closest_point.ClosestPoint, Source=closest_point_2.ClosestPoint, Target=closest_point_3.ClosestPoint)  # -> Geometry, Transform

multiple_curves_4 = MultipleCurves(Curves=flatten(join_curves_2))  # -> Points, IndexA, IndexB, ParamA, ParamB
distance = Distance(PointA=list_item_4.Item, PointB=list_item_4.Item1)

# ----
# 長軸方向のターゲット
# 部材毎での長軸方向の孔間隔の変更
孔間隔の下限値 = Slider(8.5, range=0..10)
孔間隔の上限値 = Slider(12, range=0..20)
アーチ方向_部材数_2 = Panel(アーチ方向_部材数)
subtraction_2 = Subtraction(A=アーチ方向_部材数_2, B=1)
construct_domain = ConstructDomain(DomainStart=孔間隔の下限値, DomainEnd=孔間隔の上限値)
range = Range(Domain=Domain(0, 1), Steps=subtraction_2)
remap_numbers = RemapNumbers(Value=range, Source=Domain(0, 1), Target=construct_domain)  # -> Mapped, Clipped
部材縦幅_bending加工 = Panel(dimensions_4.UDimension)
孔高さ_h = Panel(dimensions.VDimension)
addition_4 = Addition(A=孔高さ_h, B=remap_numbers.Mapped)
cluster = Cluster_2(A=部材縦幅_bending加工, B=addition_4)
addition_5 = Addition(A=cluster, B=1)
series = Series(Start=0, Step=addition_4, Count=addition_5)

孔同士の縦方向の距離_h_2 = Panel(孔同士の縦方向の距離_h)

板厚方向ベクトル = Vector(vector_xyz_4.Vector)
division_3 = Division(A=板厚方向ベクトル, B=2)
unit_z = UnitZ(Factor=1)
move_5 = Move(Geometry=move_3.Geometry, Motion=division_3)  # -> Geometry, Transform
move_6 = Move(Geometry=move_4.Geometry, Motion=division_3)  # -> Geometry, Transform
pointb_接線ベクトル = Vector(amplitude_2)
pointa_接線ベクトル_3 = Vector(rotate)
construct_plane = ConstructPlane(Origin=move_5.Geometry, XAxis=pointa_接線ベクトル_3, YAxis=unit_z)
construct_plane_2 = ConstructPlane(Origin=move_6.Geometry, XAxis=pointb_接線ベクトル, YAxis=unit_z)
部材接合角度 = Panel(同部材接合角度)
explode_tree_2 = ExplodeTree(Data=brep_join.Breps)  # -> _0010000, _0010001
rotate_plane = RotatePlane(Plane=construct_plane_2, Angle=degrees(部材接合角度))
orient_2 = Orient(Geometry=explode_tree_2._0010000, Source=construct_plane, Target=rotate_plane)  # -> Geometry, Transform

# ----
# 短軸方向のターゲット
孔同士の横方向の距離_w_2 = Panel(孔同士の横方向の距離_w)
孔幅_w = Panel(dimensions.UDimension)
板幅_mm_2 = Panel(板幅_mm)
expression_9 = Expression(x=孔幅_w, y=孔同士の横方向の距離_w_2, Expression="(x+y)/2")
cluster_2 = Cluster(A=板幅_mm_2, B=expression_9)
addition_6 = Addition(A=cluster_2, B=1)
series_2 = Series(Start=0, Step=expression_9, Count=addition_6)

# ----
# ターゲットの抽出（間隔修正なし）
cross_reference = CrossReference(ListListA=series, ListListB=series_2, CrossMode=1)  # -> ListListA, ListListB
construct_point_5 = ConstructPoint(XCoordinate=cross_reference.ListListA, YCoordinate=cross_reference.ListListB, ZCoordinate=0)
partition_list = PartitionList(List=construct_point_5, Size=graft(addition_5))
dispatch = Dispatch(List=partition_list, DispatchPattern=[True, False])  # -> ListA, ListB
tree_statistics_2 = TreeStatistics(Tree=partition_list)  # -> Paths, Length, Count
dispatch_2 = Dispatch(List=tree_statistics_2.Paths, DispatchPattern=[True, False])  # -> ListA, ListB
tree_branch_2 = TreeBranch(Tree=dispatch.ListB, Path=dispatch_2.ListB, MaintainPaths=True)
tree_branch_3 = TreeBranch(Tree=dispatch.ListA, Path=dispatch_2.ListA, MaintainPaths=True)
merge_2 = Merge(Data1=tree_branch_3, Data2=tree_branch_2)
shift_paths_2 = ShiftPaths(Data=merge_2, Offset=-1)
bounding_box_3 = BoundingBox(Content=shift_paths_2, Plane=PlaneXY(0, 0, 0), UnionBox=True)  # -> Box, Box_2
area = Area(Geometry=bounding_box_3.Box)  # -> Area, Centroid
xy_plane = XYPlane(Origin=area.Centroid)
area_2 = Area(Geometry=surface_from_points_2)  # -> Area, Centroid
flip_plane = FlipPlane(Plane=xy_plane, ReverseX=Toggle(False), ReverseY=Toggle(False), SwapAxes=Toggle(True))
orient_3 = Orient(Geometry=shift_paths_2, Source=flip_plane, Target=area_2.Centroid)  # -> Geometry, Transform

transform = Transform(Geometry=explode_tree_2._0010001, Transform=orient_2.Transform)
solid_intersection = SolidIntersection(BrepsA=explode_tree_2._0010000, BrepsB=orient_2.Geometry)
brep_join_2 = BrepJoin(Breps=explode_tree_2._0010000)  # -> Breps, Closed
solid_union = SolidUnion(Breps=[orient_2.Geometry, explode_tree_2._0010000])
data_3 = Data(multiple_curves_4.Points)
list_item_5 = ListItem(List=data_3, Index=0, Wrap=True)  # -> Item, Item1, Item2, Item3
solid_intersection_2 = SolidIntersection(BrepsA=transform, BrepsB=explode_tree_2._0010001)
stream_filter_2 = StreamFilter(Gate=brep_join_2.Closed, Stream0=solid_union, Stream1=solid_intersection)
line_3 = Line(StartPoint=list_item_5.Item1, EndPoint=list_item_5.Item2)
line_4 = Line(StartPoint=list_item_5.Item, EndPoint=list_item_5.Item3)
アーチ方向_部材数_3 = Panel(アーチ方向_部材数)
bounding_box_4 = BoundingBox(Content=stream_filter_2, Plane=construct_plane_2, UnionBox=True)  # -> Box, Box_2
bounding_box_5 = BoundingBox(Content=solid_intersection_2, Plane=construct_plane, UnionBox=True)  # -> Box, Box_2
curve_middle = CurveMiddle(Curve=[line_4, line_3])
deconstruct_brep_3 = DeconstructBrep(Brep=bounding_box_4.Box)  # -> Faces, Edges, Vertices
deconstruct_brep_4 = DeconstructBrep(Brep=bounding_box_5.Box)  # -> Faces, Edges, Vertices
subtraction_3 = Subtraction(A=アーチ方向_部材数_3, B=2)
volume = Volume(Geometry=bounding_box_5.Box)  # -> Volume, Centroid
linear_t = LinearT(Geometry=curve_middle, Transform=orient_2.Transform, Num=subtraction_3)
deconstruct = Deconstruct(Point=volume.Centroid)  # -> XComponent, YComponent, ZComponent
list_item_6 = ListItem(List=deconstruct_brep_3.Edges, Index="6", Wrap=True)
list_item_7 = ListItem(List=deconstruct_brep_4.Edges, Index="6", Wrap=True)
point_b_3 = Point(construct_point_3)
回転軸 = Line(move_2.Geometry)
explode_tree_3 = ExplodeTree(Data=linear_t)  # -> _00100000, _00100001
length = Length(Curve=list_item_6)
length_2 = Length(Curve=list_item_7)
mirror_curve_2 = MirrorCurve(Geometry=point_b_3, Curve=回転軸, Tangent=True)
construct_point_6 = ConstructPoint(XCoordinate=deconstruct.XComponent, YCoordinate=0, ZCoordinate=deconstruct.ZComponent)
construct_plane_3 = ConstructPlane(Origin=linear_t, XAxis=Vector(1, 0, 0), YAxis=Vector(0, 1, 0))
list_item_8 = ListItem(List=explode_tree_3._00100001, Index=0, Wrap=True)  # -> Item1, Item
list_item_9 = ListItem(List=explode_tree_3._00100000, Index=0, Wrap=True)
distance_2 = Distance(PointA=mirror_curve_2, PointB=construct_point_6)
vector_2pt = Vector2Pt(PointA=list_item_9, PointB=list_item_8.Item1, Unitize=False)  # -> Vector, Length
xz_plane = XZPlane(Origin=Point(0, 0, 0))
align_plane = AlignPlane(Plane=xz_plane, Direction=vector_2pt.Vector)  # -> Plane, Angle
orient_4 = Orient(Geometry=construct_plane_3, Source=align_plane.Plane, Target=xz_plane)  # -> Geometry, Transform
sort_points = SortPoints(Points=flatten(orient_4.Geometry))  # -> Points, Indices
polyline_2 = PolyLine(Vertices=sort_points.Points, Closed=False)
bounding_box_6 = BoundingBox(Content=polyline_2, Plane=PlaneXY(0, 0, 0))  # -> Box, Box_2
unit_y_2 = UnitY(Factor=1)
孔 = Geometry(stream_filter)
孔の中心 = Point(construct_point)
orient_5 = Orient(Geometry=孔, Source=孔の中心, Target=orient_3.Geometry)  # -> Geometry, Transform
deconstruct_brep_5 = DeconstructBrep(Brep=bounding_box_6.Box)  # -> Faces, Edges, Vertices
negative_6 = Negative(Value=unit_y_2)
merge_3 = Merge(Data1=Slider(200, range=0..1000), Data2=Slider(450, range=0..1000))
panel_5 = Panel("""0
1""")
dimensions_5 = Dimensions(Surface=deconstruct_brep_5.Faces)  # -> UDimension, VDimension
perp_frame = PerpFrame(Curve=reparameterize(polyline_2), Parameter=panel_5)
division_4 = Division(A=merge_3, B=2)
entwine_3 = Entwine(Branch00=unit_y_2, Branch01=negative_6, FlattenInputs=True)
unit_z_2 = UnitZ(Factor=dimensions_5.VDimension)
amplitude_3 = Amplitude(Vector=entwine_3, Amplitude=division_4)
move_7 = Move(Geometry=perp_frame, Motion=amplitude_3)  # -> Geometry, Transform
polyline_3 = PolyLine(Vertices=move_7.Geometry, Closed=False)
extrude_2 = Extrude(Base=polyline_3, Direction=unit_z_2)
unit_y_3 = UnitY(Factor=1)
project = Project(Curve=polyline_2, Brep=extrude_2, Direction=unit_y_3)
explode_tree_4 = ExplodeTree(Data=project)  # -> _0000, _0010
edge_surface = EdgeSurface(CurveA=explode_tree_4._0000, CurveB=explode_tree_4._0010)
unroll_brep = UnrollBrep(Brep=edge_surface, JoinUnrolled=False)
area_3 = Area(Geometry=unroll_brep)  # -> Area, Centroid
list_length = ListLength(List=area_3.Centroid)
deconstruct_2 = Deconstruct(Point=area_3.Centroid)  # -> XComponent, YComponent, ZComponent
series_3 = Series(Start=0, Step=1, Count=list_length)
sort_list_2 = SortList(Keys=deconstruct_2.YComponent, ValuesValuesA=series_3)  # -> Keys, ValuesValuesA
list_item_10 = ListItem(List=unroll_brep, Index=sort_list_2.ValuesValuesA, Wrap=True)
dispatch_3 = Dispatch(List=list_item_10, DispatchPattern=[True, False])  # -> ListA, ListB
unit_x = UnitX(Factor=1)
edges_from_directions = EdgesFromDirections(Brep=dispatch_3.ListA, Directions=unit_x, Reflex=True, Angle=0)  # -> Edges, Indices, Map
deconstruct_brep_6 = DeconstructBrep(Brep=dispatch_3.ListA)  # -> Faces, Edges, Vertices
cull_index = CullIndex(List=deconstruct_brep_6.Edges, Indices=edges_from_directions.Indices, Wrap=True)
curve_middle_2 = CurveMiddle(Curve=cull_index)
sort_points_2 = SortPoints(Points=curve_middle_2)  # -> Points, Indices
list_item_11 = ListItem(List=cull_index, Index=sort_points_2.Indices, Wrap=True)
curve_to_polyline = CurveToPolyline(Curve=list_item_11, ToleranceDistance=0, ToleranceAngle=0)  # -> Polyline, Segments
list_item_12 = ListItem(List=curve_to_polyline.Polyline, Index=0, Wrap=True)
部材xy平面投影長さ = Panel(dimensions_3.UDimension)
接合点までの長さ = Panel(distance)
部材xy平面投影長さ_2 = Panel(dimensions_3.VDimension)
unit_y_4 = UnitY(Factor=1)
xy_plane_2 = XYPlane(Origin=Point(0, 0, 0))
unit_vector = UnitVector(Vector=list_item_12)
subtraction_4 = Subtraction(A=部材xy平面投影長さ, B=接合点までの長さ)
division_5 = Division(A=部材xy平面投影長さ_2, B=2)
angle = Angle(VectorA=unit_vector, VectorB=unit_y_4, Plane=xy_plane_2)  # -> Angle, Reflex
division_6 = Division(A=subtraction_4, B=2)
addition_7 = Addition(A=division_5, B=Slider(1.18, range=0..10))
unit_z_3 = UnitZ(Factor=addition_7)
expression_10 = Expression(x=division_6, d=angle.Angle, Expression="Abs(x/cos(d))")
negative_7 = Negative(Value=unit_z_3)
extend_curve_4 = ExtendCurve(Curve=curve_to_polyline.Polyline, Type=0, Start=expression_10, End=expression_10)
pointa_接線ベクトル_4 = Vector(rotate)
curve_middle_3 = CurveMiddle(Curve=edges_from_directions.Edges)
deconstruct_vector_2 = DeconstructVector(Vector=pointa_接線ベクトル_4)  # -> XComponent, YComponent, ZComponent
extrude_3 = Extrude(Base=graft(extend_curve_4), Direction=[unit_z_3, negative_7])
list_length_2 = ListLength(List=curve_middle_3)
deconstruct_3 = Deconstruct(Point=curve_middle_3)  # -> XComponent, YComponent, ZComponent
negative_8 = Negative(Value=deconstruct_vector_2.ZComponent)
brep_join_3 = BrepJoin(Breps=extrude_3)  # -> Breps, Closed
同部材接合位置_内側 = Panel(distance_2)
series_4 = Series(Start=0, Step=1, Count=list_length_2)
vector_xyz_6 = VectorXYZ(XComponent=deconstruct_vector_2.XComponent, YComponent=0, ZComponent=negative_8)  # -> Vector, Length
tree_statistics_3 = TreeStatistics(Tree=brep_join_3.Breps)  # -> Paths, Length, Count
sort_list_3 = SortList(Keys=deconstruct_3.YComponent, ValuesValuesA=series_4)  # -> Keys, ValuesValuesA
mirror_curve_3 = MirrorCurve(Geometry=[point_a, point_b], Curve=move_2.Geometry, Tangent=True)
addition_8 = Addition(A=同部材接合位置_内側, B=Slider(0, range=0..3))
pointa_接線ベクトル_5 = Vector(rotate)
dispatch_4 = Dispatch(List=tree_statistics_3.Paths, DispatchPattern=[True, False])  # -> ListA, ListB
amplitude_4 = Amplitude(Vector=expr("-x", pointa_接線ベクトル_5), Amplitude=addition_8)
list_item_13 = ListItem(List=curve_middle_3, Index=sort_list_3.ValuesValuesA, Wrap=True)
amplitude_5 = Amplitude(Vector=vector_xyz_6.Vector, Amplitude=addition_8)
list_item_14 = ListItem(List=mirror_curve_3, Index=0, Wrap=True)  # -> Item, Item1
yz_plane = YZPlane(Origin=list_item_13)
tree_branch_4 = TreeBranch(Tree=brep_join_3.Breps, Path=dispatch_4.ListA, MaintainPaths=True)
tree_branch_5 = TreeBranch(Tree=brep_join_3.Breps, Path=dispatch_4.ListB, MaintainPaths=True)
negative_9 = Negative(Value=amplitude_5)
negative_10 = Negative(Value=amplitude_4)
deconstruct_4 = Deconstruct(Point=move_5.Geometry)  # -> XComponent, YComponent, ZComponent
point_b_4 = Point(list_item_14.Item)
point_a_3 = Point(list_item_14.Item1)
xz_plane_2 = XZPlane(Origin=multiple_curves_3.Points)
list_item_15 = ListItem(List=yz_plane, Index=0, Wrap=True)  # -> Item, Item1
move_8 = Move(Geometry=point_b_4, Motion=negative_9)  # -> Geometry, Transform
move_9 = Move(Geometry=point_a_3, Motion=negative_10)  # -> Geometry, Transform
unit_y_5 = UnitY(Factor=deconstruct_4.YComponent)
板厚方向ベクトル_2 = Vector(vector_xyz_4.Vector)
move_10 = Move(Geometry=xz_plane_2, Motion=unit_y_5)  # -> Geometry, Transform
division_7 = Division(A=板厚方向ベクトル_2, B=2)
list_item_16 = ListItem(List=xz_plane_2, Index=0, Wrap=True)
move_11 = Move(Geometry=move_8.Geometry, Motion=division_7)  # -> Geometry, Transform
move_12 = Move(Geometry=move_9.Geometry, Motion=division_7)  # -> Geometry, Transform
pointb_接線ベクトル_2 = Vector(amplitude_2)
pointa_接線ベクトル_6 = Vector(rotate)
vector = Vector(unit_z)
orient_6 = Orient(Geometry=geometry, Source=list_item_16, Target=list_item_15.Item)  # -> Geometry, Transform
unit_x_2 = UnitX(Factor=1)
list_item_17 = ListItem(List=move_10.Geometry, Index=0, Wrap=True)
construct_plane_4 = ConstructPlane(Origin=move_11.Geometry, XAxis=pointb_接線ベクトル_2, YAxis=vector)
construct_plane_5 = ConstructPlane(Origin=move_12.Geometry, XAxis=pointa_接線ベクトル_6, YAxis=vector)
project_2 = Project(Curve=orient_6.Geometry, Brep=tree_branch_5, Direction=unit_x_2)
project_3 = Project(Curve=orient_6.Geometry, Brep=tree_branch_4, Direction=unit_x_2)
end_points = EndPoints(Curve=orient_6.Geometry)  # -> Start, End
flip_curve = FlipCurve(Curve=project_3)  # -> Curve, Flag
end_points_2 = EndPoints(Curve=project_2)  # -> Start, End
orient_7 = Orient(Geometry=[construct_plane, construct_plane_2], Source=list_item_17, Target=list_item_15.Item)  # -> Geometry, Transform
orient_8 = Orient(Geometry=[construct_plane_5, construct_plane_4], Source=list_item_17, Target=list_item_15.Item)  # -> Geometry, Transform
average = Average(Input=end_points.End)
average_2 = Average(Input=end_points.Start)
end_points_3 = EndPoints(Curve=flip_curve.Curve)  # -> Start, End
merge_4 = Merge(Data1=simplify(project_2), Data2=simplify(flip_curve.Curve))
line_5 = Line(StartPoint=end_points_2.Start, EndPoint=end_points_3.Start)
line_6 = Line(StartPoint=end_points_2.End, EndPoint=end_points_3.End)
merge_5 = Merge(Data1=average_2, Data2=average)
余し = Slider(0, range=0..3)
loft_2 = Loft(Curves=merge_4, Options={Adjust=False, Closed=False, LoftEnds=0, LoftSimp=0, LoftType=0, Rebuild=10, Refit=0.01})
同部材接合部幅_外側 = Panel(length_2)
同部材接合部幅_内側 = Panel(length)
expression_11 = Expression(w=同部材接合部幅_外側, rem=余し, Expression="(w+rem)/2")
expression_12 = Expression(w=同部材接合部幅_内側, rem=余し, Expression="(w+rem)/2")
deconstruct_plane = DeconstructPlane(Plane=orient_8.Geometry)  # -> Origin, XAxis, YAxis, ZAxis
deconstruct_plane_2 = DeconstructPlane(Plane=orient_7.Geometry)  # -> Origin, XAxis, YAxis, ZAxis
amplitude_6 = Amplitude(Vector=deconstruct_plane.XAxis, Amplitude=expression_11)
amplitude_7 = Amplitude(Vector=deconstruct_plane_2.XAxis, Amplitude=expression_12)
negative_11 = Negative(Value=amplitude_6)
length_3 = Length(Curve=edges_from_directions.Edges)
negative_12 = Negative(Value=amplitude_7)
move_13 = Move(Geometry=orient_8.Geometry, Motion=negative_11)  # -> Geometry, Transform
move_14 = Move(Geometry=orient_8.Geometry, Motion=amplitude_6)  # -> Geometry, Transform
move_15 = Move(Geometry=orient_7.Geometry, Motion=negative_12)  # -> Geometry, Transform
move_16 = Move(Geometry=orient_7.Geometry, Motion=amplitude_7)  # -> Geometry, Transform
sort_list_4 = SortList(Keys=length_3)  # -> Keys, ValuesValuesA
unit_x_3 = UnitX(Factor=1)
negative_13 = Negative(Value=unit_x_3)
list_item_18 = ListItem(List=reverse(sort_list_4.Keys), Index=0, Wrap=True)
merge_6 = Merge(Data1=move_16.Geometry, Data2=move_15.Geometry)
merge_7 = Merge(Data1=move_14.Geometry, Data2=move_13.Geometry)
longest_list = LongestList(ListListA=merge_7, ListListB=[unit_x_3, negative_13], PaddingMode=4)  # -> ListListA, ListListB
division_8 = Division(A=list_item_18, B=1.8)
line_sdl = LineSDL(Start=merge_7, Direction=reverse(longest_list.ListListB), Length=division_8)
line_sdl_2 = LineSDL(Start=merge_6, Direction=longest_list.ListListB, Length=division_8)
dispatch_5 = Dispatch(List=line_sdl, DispatchPattern=[True, False])  # -> ListA, ListB
dispatch_6 = Dispatch(List=line_sdl_2, DispatchPattern=[True, False])  # -> ListA, ListB

list_item_19 = ListItem(List=orient_7.Geometry, Index=0, Wrap=True)  # -> Item, Item1
boolean_toggle = BooleanToggle(False)
tree_statistics_4 = TreeStatistics(Tree=list_item_19.Item)  # -> Paths, Length, Count
tree_statistics_5 = TreeStatistics(Tree=list_item_19.Item)  # -> Paths, Length, Count
shift_list = ShiftList(List=tree_statistics_4.Paths, Shift="-1", Wrap=boolean_toggle)
shift_list_2 = ShiftList(List=tree_statistics_5.Paths, Shift=1, Wrap=boolean_toggle)
tree_branch_6 = TreeBranch(Tree=list_item_19.Item1, Path=shift_list, MaintainPaths=False)
tree_branch_7 = TreeBranch(Tree=list_item_19.Item, Path=shift_list_2, MaintainPaths=False)
flip_plane_2 = FlipPlane(Plane=tree_branch_6, ReverseX=Toggle(False), ReverseY=Toggle(False), SwapAxes=Toggle(False))
flip_plane_3 = FlipPlane(Plane=tree_branch_7, ReverseX=Toggle(False), ReverseY=Toggle(True), SwapAxes=Toggle(True))
部材接合角度_2 = Panel(同部材接合角度)
subtraction_5 = Subtraction(A=90, B=部材接合角度_2)
negative_14 = Negative(Value=subtraction_5)
rotate_plane_2 = RotatePlane(Plane=flip_plane_2, Angle=degrees(negative_14))

entwine_4 = Entwine(Branch0X=dispatch_5.ListA, Branch1X=dispatch_5.ListB, FlattenInputs=False)
entwine_5 = Entwine(Branch0X=dispatch_6.ListA, Branch1X=dispatch_6.ListB, FlattenInputs=False)
construct_point_7 = ConstructPoint(XCoordinate="0.5", YCoordinate="0.5", ZCoordinate=0)
loft_3 = Loft(Curves=entwine_4, Options={Adjust=False, Closed=False, LoftEnds=0, LoftSimp=0, LoftType=0, Rebuild=10, Refit=0.01})
construct_point_8 = ConstructPoint(XCoordinate="0.5", YCoordinate="0.5", ZCoordinate=0)
loft_4 = Loft(Curves=entwine_5, Options={Adjust=False, Closed=False, LoftEnds=0, LoftSimp=0, LoftType=0, Rebuild=10, Refit=0.01})
evaluate_surface = EvaluateSurface(Surface=reparameterize(loft_3), Point=construct_point_7)  # -> Point, Normal, UDirection, VDirection, Frame
evaluate_surface_2 = EvaluateSurface(Surface=reparameterize(loft_4), Point=construct_point_8)  # -> Point, Normal, UDirection, VDirection, Frame
data_4 = Data(loft_2)
negative_15 = Negative(Value=evaluate_surface.Normal)
negative_16 = Negative(Value=evaluate_surface_2.Normal)
move_17 = Move(Geometry=loft_3, Motion=negative_15)  # -> Geometry, Transform
amplitude_8 = Amplitude(Vector=evaluate_surface.Normal, Amplitude="2")
tree_statistics_6 = TreeStatistics(Tree=data_4)  # -> Paths, Length, Count
move_18 = Move(Geometry=loft_4, Motion=negative_16)  # -> Geometry, Transform
amplitude_9 = Amplitude(Vector=evaluate_surface_2.Normal, Amplitude="2")
dispatch_7 = Dispatch(List=tree_statistics_6.Paths, DispatchPattern=[True, False])  # -> ListA, ListB
extrude_4 = Extrude(Base=move_17.Geometry, Direction=amplitude_8)
extrude_5 = Extrude(Base=move_18.Geometry, Direction=amplitude_9)
tree_branch_8 = TreeBranch(Tree=data_4, Path=dispatch_7.ListB, MaintainPaths=True)
shift_paths_3 = ShiftPaths(Data=extrude_4, Offset=Slider(1, range=0..1))
tree_branch_9 = TreeBranch(Tree=data_4, Path=dispatch_7.ListA, MaintainPaths=True)
shift_paths_4 = ShiftPaths(Data=extrude_5, Offset=Slider(1, range=0..1))
trim_solid = TrimSolid(Shape=tree_branch_8, Cutters=shift_paths_3)
trim_solid_2 = TrimSolid(Shape=tree_branch_9, Cutters=shift_paths_4)
merge_8 = Merge(Data1=trim_solid, Data2=trim_solid_2)

ghpython_script = GhPythonScript(Geometry=simplify(merge_5), Source=flatten(flip_plane_3), Target=flatten(rotate_plane_2))  # -> out, Geometry, Target, Source; inputs Geometry: tree of Point3d, Source: list, Target: list
# ---------- ghpython_script: Python ----------
__author__ = "Owner"
__version__ = "2021.12.04"

import rhinoscriptsyntax as rs
import ghpythonlib.treehelpers as th
import ghpythonlib.components as ghc

Geometry = th.tree_to_list(Geometry,None)

for i, init_p in enumerate(Source):
    a = ghc.Orient(geometry=Geometry[i+1],source=init_p,target=Target[i])
    Geometry[i+1] = a['geometry']
    if i < len(Source)-1:
        b = ghc.Orient(geometry=Target[i+1],source=init_p,target=Target[i])
        Target[i+1] = b['geometry']

Geometry = th.list_to_tree(Geometry,None)
Target = th.list_to_tree(Target,None)
Source = th.list_to_tree(Source,None)
# ---------- end ghpython_script ----------
tree_statistics_7 = TreeStatistics(Tree=ghpython_script.Geometry)  # -> Paths, Length, Count
panel_6 = Panel("""0
-1""")
list_item_20 = ListItem(List=tree_statistics_7.Paths, Index=panel_6, Wrap=True)
tree_branch_10 = TreeBranch(Tree=ghpython_script.Geometry, Path=list_item_20, MaintainPaths=True)
panel_7 = Panel("""1
0""")
list_item_21 = ListItem(List=tree_branch_10, Index=graft(panel_7), Wrap=True)
list_item_22 = ListItem(List=flatten(list_item_21), Index=0, Wrap=True)  # -> Item, Item1
line_7 = Line(StartPoint=list_item_22.Item, EndPoint=list_item_22.Item1)
construct_plane_6 = ConstructPlane(Origin=list_item_22.Item, XAxis=line_7, YAxis=Vector(0, 1, 0))
shift_paths_5 = ShiftPaths(Data=line_6, Offset=-1)
shift_paths_6 = ShiftPaths(Data=line_5, Offset=-1)
list_item_23 = ListItem(List=shift_paths_5, Index=0, Wrap=True)
list_item_24 = ListItem(List=shift_paths_6, Index=0, Wrap=True)
xz_plane_3 = XZPlane(Origin=Point(0, 0, 0))
list_item_25 = ListItem(List=flatten(list_item_23), Index=0, Wrap=True)  # -> Item1, Item
list_item_26 = ListItem(List=flatten(list_item_24), Index=0, Wrap=True)
flip_plane_4 = FlipPlane(Plane=construct_plane_6, ReverseX=Toggle(False), ReverseY=Toggle(False), SwapAxes=Toggle(False))
merge_9 = Merge(Data1=list_item_26, Data2=list_item_25.Item1)
orient_9 = Orient(Geometry=simplify([list_item_22.Item, list_item_22.Item1]), Source=flatten(flip_plane_4), Target=flatten(xz_plane_3))  # -> Geometry, Transform
unit_y_6 = UnitY(Factor=1)
length_4 = Length(Curve=merge_9)
negative_17 = Negative(Value=unit_y_6)
division_9 = Division(A=length_4, B=2)
line_sdl_3 = LineSDL(Start=orient_9.Geometry, Direction=graft([unit_y_6, negative_17]), Length=division_9)  # -> flatten(Line)

板厚_mm_2 = Panel(板厚_mm)
division_10 = Division(A=Slider(13, range=0..100), B=2)
negative_18 = Negative(Value=division_10)

offset_surface_2 = OffsetSurface(Surface=graft(merge_8), Distance=flatten([division_10, negative_18]), Retrim=True)  # -> simplify(Surface)
deconstruct_brep_7 = DeconstructBrep(Brep=offset_surface_2)  # -> Faces, Edges, Vertices
join_curves_3 = JoinCurves(Curves=deconstruct_brep_7.Edges, Preserve=False)
shift_paths_7 = ShiftPaths(Data=join_curves_3, Offset=-2)
loft_5 = Loft(Curves=shift_paths_7, Options={Adjust=False, Closed=False, LoftEnds=0, LoftSimp=0, LoftType=0, Rebuild=10, Refit=0.01})
brep_join_4 = BrepJoin(Breps=[loft_5, offset_surface_2])  # -> Breps, Closed
shift_paths_8 = ShiftPaths(Data=brep_join_4.Breps, Offset=-1)
ghpython_script_2 = GhPythonScript(Geometry=simplify(shift_paths_8), Source=flatten(flip_plane_3), Target=flatten(rotate_plane_2))  # -> out, Geometry, Target, Source; inputs Geometry: tree of Brep, Source: list, Target: list
# ---------- ghpython_script_2: Python ----------
__author__ = "Owner"
__version__ = "2021.12.04"

import rhinoscriptsyntax as rs
import ghpythonlib.treehelpers as th
import ghpythonlib.components as ghc

Geometry = th.tree_to_list(Geometry,None)

for i, init_p in enumerate(Source):
    a = ghc.Orient(geometry=Geometry[i+1],source=init_p,target=Target[i])
    Geometry[i+1] = a['geometry']
    print(Geometry[i+1])
    if i < len(Source)-1:
        b = ghc.Orient(geometry=Target[i+1],source=init_p,target=Target[i])
        Target[i+1] = b['geometry']
print(Geometry)
Geometry = th.list_to_tree(Geometry,None)
Target = th.list_to_tree(Target,None)
Source = th.list_to_tree(Source,None)
# ---------- end ghpython_script_2 ----------

ghpython_script_3 = GhPythonScript(Geometry=simplify(merge_8), Source=flatten(flip_plane_3), Target=flatten(rotate_plane_2))  # -> out, Geometry, Target, Source; inputs Geometry: tree of Brep, Source: list, Target: list; same code as ghpython_script_2
orient_10 = Orient(Geometry=simplify(ghpython_script_3.Geometry), Source=flatten(flip_plane_4), Target=flatten(xz_plane_3))  # -> Geometry, Transform
list_item_27 = ListItem(List=orient_10.Geometry, Index=0, Wrap=True)  # -> Item, Item1

orient_11 = Orient(Geometry=simplify(ghpython_script_2.Geometry), Source=flatten(flip_plane_4), Target=flatten(xz_plane_3))  # -> Geometry, Transform

join_curves_4 = JoinCurves(Curves=line_sdl_3, Preserve=False)
list_item_28 = ListItem(List=join_curves_4, Index=0, Wrap=True)  # -> Item, Item1
number_slider_2 = Slider(27, range=0..100)
boolean_toggle_2 = BooleanToggle(False)
flip_curve_2 = FlipCurve(Curve=list_item_28.Item)  # -> Curve, Flag
flip_curve_3 = FlipCurve(Curve=list_item_28.Item1)  # -> Curve, Flag
evaluate_length = EvaluateLength(Curve=[list_item_28.Item, flip_curve_2.Curve], Length=number_slider_2, Normalized=boolean_toggle_2)  # -> Point, Tangent, Parameter
evaluate_length_2 = EvaluateLength(Curve=[list_item_28.Item1, flip_curve_3.Curve], Length=number_slider_2, Normalized=boolean_toggle_2)  # -> Point, Tangent, Parameter
list_item_29 = ListItem(List=evaluate_length.Point, Index=0, Wrap=True)  # -> Item, Item1
list_item_30 = ListItem(List=evaluate_length_2.Point, Index=0, Wrap=True)  # -> Item, Item1
vector_2pt_2 = Vector2Pt(PointA=list_item_30.Item1, PointB=list_item_29.Item1, Unitize=False)  # -> Vector, Length
vector_2pt_3 = Vector2Pt(PointA=list_item_30.Item, PointB=list_item_29.Item, Unitize=False)  # -> Vector, Length
number_slider_3 = Slider(0, range=-1..1)
construct_plane_7 = ConstructPlane(Origin=list_item_30.Item1, XAxis=vector_2pt_2.Vector, YAxis=Vector(0, 1, 0))
construct_plane_8 = ConstructPlane(Origin=list_item_30.Item, XAxis=vector_2pt_3.Vector, YAxis=Vector(0, 1, 0))
negative_19 = Negative(Value=number_slider_3)
number_slider_4 = Slider(3, range=0..20)
rotate_plane_3 = RotatePlane(Plane=construct_plane_7, Angle=degrees(negative_19))
rotate_plane_4 = RotatePlane(Plane=construct_plane_8, Angle=degrees(number_slider_3))
addition_9 = Addition(A=number_slider_4, B=1)
duplicate_data = DuplicateData(Data=list_item_28.Item, Number=addition_9, Order=True)
duplicate_data_2 = DuplicateData(Data=rotate_plane_4, Number=number_slider_4, Order=True)
duplicate_data_3 = DuplicateData(Data=rotate_plane_3, Number=number_slider_4, Order=True)
ghpython_script_4 = GhPythonScript(Geometry=simplify(graft(duplicate_data)), Source=flatten(duplicate_data_2), Target=flatten(duplicate_data_3))  # -> out, Geometry, Target, Source; inputs Geometry: tree of Line, Source: list, Target: list
# ---------- ghpython_script_4: Python ----------
__author__ = "Owner"
__version__ = "2021.12.04"

import rhinoscriptsyntax as rs
import ghpythonlib.treehelpers as th
import ghpythonlib.components as ghc

Geometry = th.tree_to_list(Geometry,None)

for i, init_p in enumerate(Source):
    a = ghc.Orient(geometry=Geometry[i+1],source=init_p,target=Target[i])
    Geometry[i+1] = a['geometry']
    print(Geometry[i+1])
    if i < len(Source)-1:
        b = ghc.Orient(geometry=Target[i+1],source=init_p,target=Target[i])
        Target[i+1] = b['geometry']
print(Geometry)
Geometry = th.list_to_tree(Geometry)
Target = th.list_to_tree(Target,None)
Source = th.list_to_tree(Source,None)
# ---------- end ghpython_script_4 ----------
dispatch_8 = Dispatch(List=ghpython_script_4.Target, DispatchPattern=[True, False])  # -> ListA, ListB

list_item_31 = ListItem(List=orient_11.Geometry, Index=0, Wrap=True)  # -> Item, Item1

list_item_32 = ListItem(List=dispatch_8.ListA, Index=0, Wrap=True)
orient_12 = Orient(Geometry=list_item_31.Item1, Source=construct_plane_8, Target=dispatch_8.ListB)  # -> Geometry, Transform
orient_13 = Orient(Geometry=list_item_31.Item, Source=construct_plane_8, Target=dispatch_8.ListA)  # -> Geometry, Transform
orient_14 = Orient(Geometry=list_item_27.Item1, Source=construct_plane_8, Target=dispatch_8.ListB)  # -> Geometry, Transform
orient_15 = Orient(Geometry=list_item_27.Item, Source=construct_plane_8, Target=list_item_32)  # -> Geometry, Transform
merge_10 = Merge(Data1=list_item_31.Item1, Data2=simplify(orient_12.Geometry))
brep_brep = BrepBrep(BrepA=orient_15.Geometry, BrepB=merge_10)  # -> Curves, Points
brep_brep_2 = BrepBrep(BrepA=orient_14.Geometry, BrepB=orient_13.Geometry)  # -> Curves, Points
explode = Explode(Curve=brep_brep.Curves, Recursive=True)  # -> Segments, Vertices
explode_2 = Explode(Curve=brep_brep_2.Curves, Recursive=True)  # -> Segments, Vertices
panel_8 = Panel("""0
-1""")
panel_9 = Panel("""0
-1""")
list_item_33 = ListItem(List=explode_2.Vertices, Index=0, Wrap=True)  # -> Item, Item1, Item2, Item3
list_item_34 = ListItem(List=explode.Vertices, Index=0, Wrap=True)  # -> Item, Item1, Item2, Item3
list_item_35 = ListItem(List=explode_2.Segments, Index=panel_9, Wrap=True)  # -> Item, Item1
list_item_36 = ListItem(List=explode.Segments, Index=panel_8, Wrap=True)  # -> Item, Item1
curve_middle_4 = CurveMiddle(Curve=list_item_35.Item)
curve_middle_5 = CurveMiddle(Curve=list_item_36.Item)
polyline_4 = PolyLine(Vertices=[list_item_34.Item, curve_middle_5, list_item_34.Item3], Closed=False)
polyline_5 = PolyLine(Vertices=[list_item_33.Item, curve_middle_4, list_item_33.Item3], Closed=False)
shift_paths_9 = ShiftPaths(Data=polyline_4, Offset=-2)
shift_paths_10 = ShiftPaths(Data=polyline_5, Offset=-2)
surface_split_2 = SurfaceSplit(Surface=orient_15.Geometry, Curves=shift_paths_9)
surface_split_3 = SurfaceSplit(Surface=orient_14.Geometry, Curves=shift_paths_10)
list_item_37 = ListItem(List=surface_split_2, Index=0, Wrap=True)
list_item_38 = ListItem(List=surface_split_3, Index=0, Wrap=True)

# ----
# ShopBot(CNC)加工用データ 作成
unroll_brep_2 = UnrollBrep(Brep=list_item_37, JoinUnrolled=False)
unroll_brep_3 = UnrollBrep(Brep=list_item_38, JoinUnrolled=False)
entwine_6 = Entwine(Branch0X=unroll_brep_2, Branch1X=unroll_brep_3, FlattenInputs=False)
brep_wireframe = BrepWireframe(Brep=entwine_6, Density=-1)
xy_plane_3 = XYPlane(Origin=Point(0, 0, 0))
is_planar = IsPlanar(Surface=entwine_6, Interior=True)  # -> Planar, Plane
flip_plane_5 = FlipPlane(Plane=xy_plane_3, ReverseX=Toggle(False), ReverseY=Toggle(False), SwapAxes=Toggle(False))
join_curves_5 = JoinCurves(Curves=brep_wireframe, Preserve=False)
orient_16 = Orient(Geometry=join_curves_5, Source=is_planar.Plane, Target=flip_plane_5)  # -> Geometry, Transform

# ----
# フィレットの作成
hull = Hull(Brep=orient_16.Geometry)  # -> Geo, Projected, Hull, Plane, Plane_2
brep_wireframe_2 = BrepWireframe(Brep=orient_16.Geometry, Density=-1)
area_4 = Area(Geometry=hull.Hull)  # -> Area, Centroid
scale = Scale(Geometry=hull.Hull, Center=area_4.Centroid, Factor=Slider(0.97, range=0..1))  # -> Geometry, Transform
curve_middle_6 = CurveMiddle(Curve=brep_wireframe_2)
point_in_curve = PointInCurve(Point=simplify(curve_middle_6), Curve=simplify(scale.Geometry))  # -> Relationship, Point
equality = Equality(FirstNumber=point_in_curve.Relationship, SecondNumber=Slider(2, range=0..2))  # -> Equality, Inequality
mill径 = Slider(6.35, range=0..30)
dispatch_9 = Dispatch(List=brep_wireframe_2, DispatchPattern=equality.Equality)  # -> ListA, simplify(ListB)
division_11 = Division(A=mill径, B=2)
join_curves_6 = JoinCurves(Curves=dispatch_9.ListA, Preserve=False)
fillet = Fillet(Curve=join_curves_6, Radius=division_11)  # -> simplify(Curve)
join_curves_7 = JoinCurves(Curves=[dispatch_9.ListB, fillet], Preserve=False)

# ----
# 孔形状の配置
許容値 = Slider(100, range=0..100)
geometry_2 = Geometry(orient_5.Geometry)
bounding_box_7 = BoundingBox(Content=geometry_2, Plane=PlaneXY(0, 0, 0), UnionBox=True)  # -> Box, Box_2
addition_10 = Addition(A=板幅_mm_2, B=許容値)
division_12 = Division(A=addition_10, B=2)
division_13 = Division(A=部材縦幅_bending加工, B=2)
area_5 = Area(Geometry=bounding_box_7.Box)  # -> Area, Centroid
negative_20 = Negative(Value=division_12)
negative_21 = Negative(Value=division_13)
orient_17 = Orient(Geometry=geometry_2, Source=area_5.Centroid, Target=xy_plane_3)  # -> simplify(Geometry), Transform
construct_domain_2 = ConstructDomain(DomainStart=negative_20, DomainEnd=division_12)
construct_domain_3 = ConstructDomain(DomainStart=negative_21, DomainEnd=division_13)
area_6 = Area(Geometry=orient_17.Geometry)  # -> Area, Centroid
rectangle_2 = Rectangle(Plane=xy_plane_3, XSize=construct_domain_2, YSize=construct_domain_3, Radius=0)  # -> Rectangle, Length
point_in_curve_2 = PointInCurve(Point=area_6.Centroid, Curve=rectangle_2.Rectangle)  # -> Relationship, Point
equality_2 = Equality(FirstNumber=point_in_curve_2.Relationship, SecondNumber=Slider(2, range=0..10))  # -> Equality, Inequality
cull_pattern = CullPattern(List=orient_17.Geometry, CullPattern=equality_2.Equality)

shift_paths_11 = ShiftPaths(Data=join_curves_7, Offset="-2")
explode_tree_5 = ExplodeTree(Data=shift_paths_11)  # -> graft(Branch0), graft(Branch1)
surface_split_4 = SurfaceSplit(Surface=explode_tree_5.Branch0, Curves=cull_pattern)
surface_split_5 = SurfaceSplit(Surface=explode_tree_5.Branch1, Curves=cull_pattern)
merge_11 = Merge(Data1=surface_split_4, Data2=surface_split_5)
list_length_3 = ListLength(List=merge_11)
area_7 = Area(Geometry=merge_11)  # -> Area, Centroid
series_5 = Series(Start=0, Step=1, Count=list_length_3)
sort_list_5 = SortList(Keys=area_7.Area, ValuesValuesA=series_5)  # -> Keys, ValuesValuesA
list_item_39 = ListItem(List=merge_11, Index=reverse(sort_list_5.ValuesValuesA), Wrap=True)
list_item_40 = ListItem(List=list_item_39, Index=0, Wrap=True)

# ----
# レーザー加工用データ　sort ガイド線
area_8 = Area(Geometry=cull_pattern)  # -> Area, Centroid
polyline_6 = PolyLine(Vertices=area_8.Centroid, Closed=False)
path_mapper = PathMapper(polyline_6, source=["{i}", "{i}"], target=["{0;i}", "{1;i}"])

brep_wireframe_3 = BrepWireframe(Brep=list_item_40, Density=-1)

# ----
# 部材重量計算(一列あたり)
area_9 = Area(Geometry=list_item_40)  # -> Area, Centroid
shift_paths_12 = ShiftPaths(Data=simplify(area_9.Area), Offset=-1)
mass_addition = MassAddition(Input=shift_paths_12)  # -> flatten(Result), PartialResults
power_of_10 = PowerOf10(Value=Slider(-6, range=-10..10))
板厚_mm_3 = Panel(板厚_mm)
multiplication = Multiplication(A=mass_addition.Result, B=板厚_mm_3, C=Slider(0.53, range=0..1), D=power_of_10)
panel_10 = Panel(multiplication)

join_curves_8 = JoinCurves(Curves=brep_wireframe_3, Preserve=False)

# ----
# 記号の作成
number_slider_5 = Slider(9, range=0..10)
series_6 = Series(Start=0, Step=1, Count=number_slider_5)
square = Square(Plane=PlaneXY(0, 0, 0), Size=Slider(8.5, range=0..10), ExtentX=Slider(5, range=0..10), ExtentY=Slider(2, range=0..10))  # -> Cells, Points
addition_11 = Addition(A=series_6, B=1)
shift_paths_13 = ShiftPaths(Data=square.Cells, Offset=-1)
series_7 = Series(Start=0, Step=1, Count=addition_11)
list_item_41 = ListItem(List=shift_paths_13, Index=series_7, Wrap=True)
area_10 = Area(Geometry=list_item_41)  # -> Area, Centroid
division_14 = Division(A=Slider(7.5, range=0..10), B=2)
circle = Circle(Plane=area_10.Centroid, Radius=division_14)  # -> simplify(Circle)
path_mapper_2 = PathMapper(circle, source="{i}", target="{8-i}")

area_11 = Area(Geometry=join_curves_8)  # -> Area, Centroid
sort_along_curve = SortAlongCurve(Points=simplify(area_11.Centroid), Curve=path_mapper)  # -> Points, Indices
list_item_42 = ListItem(List=join_curves_8, Index=sort_along_curve.Indices, Wrap=True)
panel_11 = Panel("Test データ")  # disabled
panel_12 = Panel("6.35mm切削")  # disabled
group = Group(Objects=list_item_42)  # -> simplify(Group); disabled
panel_13 = Panel("::")  # disabled
boolean_toggle_3 = BooleanToggle(False)  # disabled
text_join = TextJoin(Text=[panel_11, panel_12], Join=panel_13)  # disabled
shift_paths_14 = ShiftPaths(Data=group, Offset=-1)  # disabled
number_slider_6 = Slider(8, range=0..10)  # disabled
create_modify_layers = CreateModifyLayers(LayerName=text_join, DeleteLayer=boolean_toggle_3, enableFullPath=True)  # -> LayerNames, LayerFullPath; disabled
number_slider_7 = Slider(7, range=0..10)  # disabled
explode_tree_6 = ExplodeTree(Data=shift_paths_14)  # -> Branch0, Branch1; disabled
list_item_43 = ListItem(List=explode_tree_6.Branch0, Index=number_slider_6, Wrap=True)  # disabled
orient_18 = Orient(Geometry=list_item_43, Source=xy_plane_3, Target=PlaneXY(0, 0, 0))  # -> Geometry, Transform; disabled

# ----
# レーザー加工用データ
number_slider_8 = Slider(3, range=0..10)
division_15 = Division(A="1", B=number_slider_8)
negative_22 = Negative(Value=Slider(392, range=0..2000))
scale_2 = Scale(Geometry=list_item_42, Center=Point(0, 0, 0), Factor=division_15)  # -> Geometry, Transform
unit_x_4 = UnitX(Factor=negative_22)
move_19 = Move(Geometry=scale_2.Geometry, Motion=unit_x_4)  # -> Geometry, Transform

createattributes = CreateAttributes(LayerName=create_modify_layers.LayerNames, GroupIndices=number_slider_7, enableFullPath=False)  # disabled
button = Button()  # disabled
ungroup = Ungroup(Group=orient_18.Geometry)  # disabled
bake_geometry = BakeGeometry(Bake=button, Geometry=ungroup, Attributes=createattributes, DeleteOldBakes=False, PreserveTrees=False)  # disabled

# ----
# レーザー加工用データ Layout for sheet
control_points = ControlPoints(Curve=move_19.Geometry)  # -> Points, Weights, Knots
shift_paths_15 = ShiftPaths(Data=control_points.Points, Offset=-1)
convex_hull = ConvexHull(Points=shift_paths_15, Plane=PlaneXY(0, 0, 0))  # -> flatten(Hull), HullZ, Indices
hull_2 = Hull(Brep=flatten(convex_hull.Hull))  # -> Geo, Projected, Hull, Plane, Plane_2
number_slider_9 = Slider(0, range=0..10)
number_slider_10 = Slider(100, range=0..100)
number_slider_11 = Slider(10, range=0..100)
rectangle_3 = Rectangle(Plane=PlaneXY(0, 0, 0), XSize=Slider(458, range=0..1000), YSize=Slider(305, range=0..1000), Radius=0)  # -> Rectangle, Length
pack_objects = PackObjects(Geo=flatten(hull_2.Hull), Plane=flatten(hull_2.Plane), X=1, Y=1, Tolerabce=0)  # -> Geo, Transformation
sheet_size = Geometry(rectangle_3.Rectangle)
opennest = OpenNest(
    Sheets=sheet_size,
    Geo=pack_objects.Geo,
    Spacing=Slider(5, range=0..50),
    Placement=Slider(0, range=0..2),
    Tolerance=0.1,
    Rotations=4,
    Iterations=1,
    Seed=1,
    Reset=Button(),
    Run=Toggle(False))  # -> Sheets, Geo, ID, Transform, IDS
scale_3 = Scale(Geometry=list_item_40, Center=Point(0, 0, 0), Factor=division_15)  # -> Geometry, Transform
transform_2 = Transform(Geometry=flatten(scale_3.Geometry), Transform=pack_objects.Transformation)
data_dam = DataDam(DataDataA=opennest.Transform, BufferDelay=10000000, BufferMode=0)
transform_3 = Transform(Geometry=flatten(transform_2), Transform=data_dam)

# ----
# To create a signal for pices
縁からの距離_mm = Slider(10, range=0..100)
縁からの距離_mm_2 = Slider(10, range=0..100)
multiplication_2 = Multiplication(A=縁からの距離_mm, B=2)
multiplication_3 = Multiplication(A=縁からの距離_mm_2, B=2)
bounding_box_8 = BoundingBox(Content=flatten(square.Cells), Plane=PlaneXY(0, 0, 0), UnionBox=True)  # -> Box, Box_2
deconstruct_brep_8 = DeconstructBrep(Brep=bounding_box_8.Box)  # -> Faces, Edges, Vertices
box_properties = BoxProperties(Box=bounding_box_8.Box)  # -> Center, Diagonal, Area, Volume, Degeneracy
list_item_44 = ListItem(List=deconstruct_brep_8.Vertices, Index=0, Wrap=True)  # -> Item, Item1
yz_plane_2 = YZPlane(Origin=box_properties.Center)
mirror = Mirror(Geometry=path_mapper_2, Plane=yz_plane_2)  # -> Geometry, Transform

# ----
# Layout for sheet
control_points_2 = ControlPoints(Curve=list_item_42)  # -> Points, Weights, Knots
shift_paths_16 = ShiftPaths(Data=control_points_2.Points, Offset=-1)
number_slider_12 = Slider(3, range=0..10)
convex_hull_2 = ConvexHull(Points=shift_paths_16, Plane=PlaneXY(0, 0, 0))  # -> Hull, HullZ, Indices
duplicate_data_4 = DuplicateData(Data=flatten(convex_hull_2.Hull), Number=number_slider_12, Order=True)
hull_3 = Hull(Brep=flatten(duplicate_data_4))  # -> Geo, Projected, Hull, Plane, Plane_2
number_slider_13 = Slider(0, range=0..10)
number_slider_14 = Slider(100, range=0..100)
pack_objects_2 = PackObjects(Geo=flatten(hull_3.Hull), Plane=flatten(hull_3.Plane), X=1, Y=1, Tolerabce=0)  # -> Geo, Transformation
geometry_3 = Geometry(orient_16.Geometry)
geometry_4 = Geometry(list_item_40)
sheet_size_for_cutting_area = Geometry(surface_from_points)
sheet_size_2 = Geometry(rectangle.Rectangle)
duplicate_data_5 = DuplicateData(Data=flatten(geometry_4), Number=number_slider_12, Order=True)
duplicate_data_6 = DuplicateData(Data=flatten(geometry_3), Number=number_slider_12, Order=True)
opennest_2 = OpenNest(
    Sheets=sheet_size_for_cutting_area,
    Geo=pack_objects_2.Geo,
    Spacing=Slider(25, range=0..50),
    Placement=Slider(0, range=0..2),
    Tolerance=0.1,
    Rotations=4,
    Iterations=1,
    Seed=Slider(10, range=0..100),
    Reset=Button(),
    Run=Toggle(False))  # -> Sheets, Geo, ID, Transform, IDS
transform_4 = Transform(Geometry=flatten(duplicate_data_5), Transform=pack_objects_2.Transformation)
transform_5 = Transform(Geometry=flatten(duplicate_data_6), Transform=pack_objects_2.Transformation)
transform_6 = Transform(Geometry=flatten(transform_4), Transform=opennest_2.Transform)

dimensions_6 = Dimensions(Surface=convex_hull_2.Hull)  # -> UDimension, VDimension
construct_domain_4 = ConstructDomain(DomainStart=0, DomainEnd=dimensions_6.UDimension)
construct_domain_5 = ConstructDomain(DomainStart=0, DomainEnd=dimensions_6.VDimension)
remap_numbers_2 = RemapNumbers(Value=multiplication_2, Source=construct_domain_4, Target=Domain(0, 1))  # -> Mapped, Clipped
remap_numbers_3 = RemapNumbers(Value=multiplication_3, Source=construct_domain_5, Target=Domain(0, 1))  # -> Mapped, Clipped
subtraction_6 = Subtraction(A=1, B=remap_numbers_2.Mapped)
subtraction_7 = Subtraction(A=1, B=remap_numbers_3.Mapped)
scale_nu = ScaleNU(Geometry=convex_hull_2.Hull, Plane=PlaneXY(0, 0, 0), ScaleX=subtraction_6, ScaleY=subtraction_7, ScaleZ=1)  # -> Geometry, Transform
discontinuity_4 = Discontinuity(Curve=scale_nu.Geometry, Level=1)  # -> simplify(Points), Parameters
split_tree = SplitTree(Data=discontinuity_4.Points, Masks=flatten("{0;*}"))  # -> Positive, Negative
list_item_45 = ListItem(List=split_tree.Positive, Index=Slider(4, range=0..4), Wrap=True)
list_item_46 = ListItem(List=split_tree.Negative, Index=Slider(3, range=0..4), Wrap=True)
orient_19 = Orient(Geometry=simplify(mirror.Geometry), Source=list_item_44.Item1, Target=simplify(list_item_45))  # -> Geometry, Transform
orient_20 = Orient(Geometry=simplify(path_mapper_2), Source=list_item_44.Item, Target=simplify(list_item_46))  # -> Geometry, Transform
entwine_7 = Entwine(Branch0X=orient_19.Geometry, Branch1X=orient_20.Geometry, FlattenInputs=False)
group_2 = Group(Objects=entwine_7)

duplicate_data_7 = DuplicateData(Data=flatten(group_2), Number=number_slider_12, Order=True)
transform_7 = Transform(Geometry=flatten(duplicate_data_7), Transform=pack_objects_2.Transformation)
transform_8 = Transform(Geometry=flatten(transform_7), Transform=opennest_2.Transform)

# ==== cluster NarrowWave
target = ClusterInput()
N = ClusterInput()
wa = ClusterInput()
wb = ClusterInput()
ha = ClusterInput()
hb = ClusterInput()
hc = ClusterInput()
division = Division(A=N, B="3")
construct_domain = ConstructDomain(DomainStart=0, DomainEnd="180")
construct_domain_2 = ConstructDomain(DomainStart=0, DomainEnd="360")
round = Round(Number=division)  # -> Nearest, Floor, Ceiling
range = Range(Domain=construct_domain, Steps=round.Floor)
range_2 = Range(Domain=construct_domain_2, Steps=N)
expression = Expression(x=range, Hc=hc, Expression="Hc/8*cos(x°)")
expression_2 = Expression(x=range_2, Ha=ha, Expression="Ha/2*cos(x°)")
expression_3 = Expression(x=range, Wb=wb, Expression="(x/360)*Wb")
expression_4 = Expression(Hb=hb, Hc=hc, Expression="(Hb+Hc/2)/2")
expression_5 = Expression(x=range_2, Wa=wa, Expression="(x/360)*Wa")
negative = Negative(Value=expression_3)
pt = PointXYZ(XComponent=expression_5, YComponent=expression_2, ZComponent=0)
entwine = Entwine(Branch00=negative, Branch01=expression_3, FlattenInputs=True)
pt_2 = PointXYZ(XComponent=entwine, YComponent=expression, ZComponent=0)
panel = Panel("""0
-1""")
list_item = ListItem(List=pt_2, Index=0, Wrap=True)
list_item_2 = ListItem(List=pt, Index=0, Wrap=True)
list_item_3 = ListItem(List=pt, Index=panel, Wrap=True)
orient = Orient(Geometry=pt_2, Source=list_item, Target=graft(list_item_3))  # -> Geometry, Transform
unit_y = UnitY(Factor=expr("x/2", hb))
geometry = Geometry(flatten([pt, orient.Geometry]))
move = Move(Geometry=list_item_2, Motion=unit_y)  # -> Geometry, Transform
sort_points = SortPoints(Points=geometry)  # -> Points, Indices
removeduplicatepts = RemoveDuplicatePts(Points=sort_points.Points, Tolerance=0.01)
xz_plane = XZPlane(Origin=move.Geometry)
interpolate = Interpolate(Vertices=removeduplicatepts, Degree=3, Periodic=False, KnotStyle=1)  # -> Curve, Length, Domain
mirror = Mirror(Geometry=interpolate.Curve, Plane=xz_plane)  # -> Geometry, Transform
end_points = EndPoints(Curve=interpolate.Curve)  # -> Start, End
end_points_2 = EndPoints(Curve=mirror.Geometry)  # -> Start, End
line = Line(StartPoint=end_points_2.Start, EndPoint=end_points.Start)
line_2 = Line(StartPoint=end_points_2.End, EndPoint=end_points.End)
panel_2 = Panel(expression_3)
entwine_2 = Entwine(Branch00=line, Branch01=line_2, FlattenInputs=True)
curve_middle = CurveMiddle(Curve=entwine_2)
list_item_4 = ListItem(List=panel_2, Index=0, Wrap=True)  # -> Item1, Item
panel_3 = Panel(expression_4)
ellipse = Ellipse(Plane=curve_middle, Radius1=list_item_4.Item1, Radius2=panel_3)  # -> Ellipse, Focus1, Focus2
yz_plane = YZPlane(Origin=curve_middle)
panel_4 = Panel(expression_4)
negative_2 = Negative(Value=panel_4)
construct_domain_3 = ConstructDomain(DomainStart=negative_2, DomainEnd=panel_4)
plane_surface = PlaneSurface(Plane=yz_plane, XSize=construct_domain_3, YSize=construct_domain_3)
split_with_brep = SplitWithBrep(Curve=ellipse.Ellipse, Brep=plane_surface)  # -> Curve, Points
panel_5 = Panel("""0
1""")
list_item_5 = ListItem(List=split_with_brep.Curve, Index=graft(panel_5), Wrap=True)
join_curves = JoinCurves(Curves=flatten([mirror.Geometry, list_item_5, interpolate.Curve]), Preserve=False)
area = Area(Geometry=join_curves)  # -> Area, Centroid
orient_2 = Orient(Geometry=join_curves, Source=area.Centroid, Target=target)  # -> Geometry, Transform
geometry_2 = ClusterOutput(orient_2.Geometry)

# ==== cluster Wave
target = ClusterInput()
N = ClusterInput()
W = ClusterInput()
H = ClusterInput()
construct_domain = ConstructDomain(DomainStart=0, DomainEnd="360")
range = Range(Domain=construct_domain, Steps=N)
expression = Expression(x=range, H=H, Expression="H/4*cos(x°)")
expression_2 = Expression(x=range, W=W, Expression="(x/360)*W")
pt = PointXYZ(XComponent=expression_2, YComponent=expression, ZComponent=0)
list_item = ListItem(List=pt, Index=0, Wrap=True)
interpolate = Interpolate(Vertices=pt, Degree=3, Periodic=False, KnotStyle=1)  # -> Curve, Length, Domain
xz_plane = XZPlane(Origin=list_item)
mirror = Mirror(Geometry=interpolate.Curve, Plane=xz_plane)  # -> Geometry, Transform
join_curves = JoinCurves(Curves=flatten([interpolate.Curve, mirror.Geometry]), Preserve=False)
area = Area(Geometry=join_curves)  # -> Area, Centroid
orient = Orient(Geometry=join_curves, Source=area.Centroid, Target=target)  # -> Geometry, Transform
geometry = ClusterOutput(orient.Geometry)

# ==== cluster Rhombus
radius = ClusterInput()
terget = ClusterInput()
W = ClusterInput()
H = ClusterInput()
expression = Expression(W=W, Expression="W/2")
expression_2 = Expression(H=H, Expression="H/2")
unit_x = UnitX(Factor=expression)
unit_y = UnitY(Factor=expression_2)
negative = Negative(Value=unit_x)
entwine = Entwine(Branch00=unit_x, Branch01=negative, Branch02=unit_y, FlattenInputs=True)
move = Move(Geometry=terget, Motion=entwine)  # -> Geometry, Transform
explode_tree = ExplodeTree(Data=move.Geometry)  # -> Branch0, Branch1, Branch2
line = Line(StartPoint=explode_tree.Branch0, EndPoint=explode_tree.Branch2)
line_2 = Line(StartPoint=explode_tree.Branch1, EndPoint=explode_tree.Branch2)
xz_plane = XZPlane(Origin=terget)
relay = Relay([line, line_2])
mirror = Mirror(Geometry=relay, Plane=xz_plane)  # -> Geometry, Transform
join_curves = JoinCurves(Curves=flatten([mirror.Geometry, relay]), Preserve=False)
fillet = Fillet(Curve=join_curves, Radius=radius)
curve = ClusterOutput(fillet)

# ==== cluster Arc
radius = ClusterInput()
target = ClusterInput()
W = ClusterInput()
H = ClusterInput()
maximum = Maximum(A=W, B=H)
expression = Expression(H=H, Expression="H/2")
expression_2 = Expression(x=maximum, Expression="x/2")
unit_x = UnitX(Factor=expression_2)
unit_y = UnitY(Factor=expression)
negative = Negative(Value=unit_x)
entwine = Entwine(Branch00=unit_x, Branch01=negative, Branch02=unit_y, FlattenInputs=True)
move = Move(Geometry=target, Motion=entwine)  # -> Geometry, Transform
explode_tree = ExplodeTree(Data=move.Geometry)  # -> Branch0, Branch1, Branch2
arc_3pt = Arc3Pt(PointA=explode_tree.Branch0, PointB=explode_tree.Branch2, PointC=explode_tree.Branch1)  # -> Arc, Plane, Radius
xz_plane = XZPlane(Origin=target)
mirror = Mirror(Geometry=arc_3pt.Arc, Plane=xz_plane)  # -> Geometry, Transform
join_curves = JoinCurves(Curves=flatten([arc_3pt.Arc, mirror.Geometry]), Preserve=False)
fillet = Fillet(Curve=join_curves, Radius=radius)
curve = ClusterOutput(fillet)

# ==== cluster Line
target = ClusterInput()
W = ClusterInput()
radius = ClusterInput()
subtraction = Subtraction(A=W, B=radius)
unit_x = UnitX(Factor=expr("x/2", subtraction))
negative = Negative(Value=unit_x)
entwine = Entwine(Branch00=negative, Branch01=unit_x, FlattenInputs=True)
move = Move(Geometry=target, Motion=entwine)  # -> Geometry, Transform
arc = Arc(Plane=move.Geometry, Radius=expr("x/2", radius), Angle=Domain(0, 3.141592654))  # -> Arc, Length
panel = Panel("""90
-90""")
rotate = Rotate(Geometry=arc.Arc, Angle=graft(degrees(panel)), Plane=move.Geometry)  # -> Geometry, Transform
end_points = EndPoints(Curve=rotate.Geometry)  # -> Start, End
explode_tree = ExplodeTree(Data=end_points.Start)  # -> Branch0, Branch1
explode_tree_2 = ExplodeTree(Data=end_points.End)  # -> Branch0, Branch1
line = Line(StartPoint=explode_tree.Branch0, EndPoint=explode_tree_2.Branch1)
line_2 = Line(StartPoint=explode_tree.Branch1, EndPoint=explode_tree_2.Branch0)
join_curves = JoinCurves(Curves=flatten([rotate.Geometry, line, line_2]), Preserve=False)
curves = ClusterOutput(join_curves)

# ==== cluster Cluster
A = ClusterInput()
B = ClusterInput()
division = Division(A=A, B=B)
round = Round(Number=division)  # -> Nearest, Floor, Ceiling
division_2 = Division(A=round.Ceiling, B=2)
integer = Integer(division_2)
equality = Equality(FirstNumber=division_2, SecondNumber=integer)  # -> Equality, Inequality
addition = Addition(A=round.Ceiling, B="1")
stream_filter = StreamFilter(Gate=equality.Equality, Stream0=addition, Stream1=round.Ceiling)
s_1 = ClusterOutput(stream_filter)

# ==== cluster Cluster_2
A = ClusterInput()
B = ClusterInput()
division = Division(A=A, B=B)
round = Round(Number=division)  # -> Nearest, Floor, Ceiling
division_2 = Division(A=round.Ceiling, B=2)
integer = Integer(division_2)
equality = Equality(FirstNumber=division_2, SecondNumber=integer)  # -> Equality, Inequality
addition = Addition(A=round.Ceiling, B="1")
stream_filter = StreamFilter(Gate=equality.Equality, Stream0=addition, Stream1=round.Ceiling)
stream = ClusterOutput(stream_filter)

# ==== cluster ToClassifyEdges

# ---- group: Cluster Input
curve = ClusterInput()

# ----
explode = Explode(Curve=curve, Recursive=True)  # -> Segments, Vertices
deconstruct_vector = DeconstructVector(Vector=explode.Segments)  # -> XComponent, YComponent, ZComponent
# 長方形のEdgeの方向による分類
# {0;0}：X方向　線分
# {0;1}：Y方向　線分
round = Round(Number=deconstruct_vector.YComponent)  # -> Nearest, Floor, Ceiling
equality = Equality(FirstNumber=round.Nearest, SecondNumber="0")  # -> Equality, Inequality
dispatch = Dispatch(List=explode.Segments, DispatchPattern=equality.Equality)  # -> ListA, ListB
entwine = Entwine(Branch00=dispatch.ListA, Branch01=dispatch.ListB, FlattenInputs=True)
result = ClusterOutput(entwine)  # {0;0}：Lines for X-axis {0;1}：Lines for Y-axis
